# Dynamo graph New.dyn (Dynamo 2.10.1.3976)
# packages: Dyn2Calc.Xframe3D 0.2.2

code_block = CodeBlock { ".Plates/Number"; ".Plates/Node"; ".Plates/h"; ".Plates/Material_type"; ".Plates/Material"; ".Plates/"; ".Plates"; }
create = List.Create(item0=code_block.out0, item1=code_block.out1, item2=code_block.out2, item3=code_block.out3, item4=code_block.out4, item5=code_block.out5, item6=code_block.out6)
file_path = Filename("C:\Users\mikev\3BM Dropbox\Maarten Vroegindeweij\Struct4U (1)\products\XFEM4U\xml\example.xml")
readText = FileSystem.ReadText(file=file_path)
python_script = Python(IN[0]=readText, IN[1]=create)  # IronPython2
# ---------- python_script.python (22 lines) ----------
import sys
sys.path.append("C:\Program Files (x86)\IronPython 2.7\Lib")
import xml.etree.ElementTree as ET

xml = IN[0]
xpathstr = IN[1]

root = ET.fromstring(xml)

xpathfound = []
for i in xpathstr:
	xpathfound.append(root.findall(i))

xtext = []
for i in xpathfound:
	temp = []
	
	for j in i:
		temp.append(j.text)
	xtext.append(temp)

OUT = xtext
# ----------------------------------------
addItemToFront = List.AddItemToFront(item=create, list=python_script)
dyn2Calc_Xframe3D_ImportXML = Custom[Dyn2Calc_Xframe3D_ImportXML](xmlFile=file_path)  # package Dyn2Calc.Xframe3D; Import Xframe3D XML and convert to points, lines and metadata
watch = Watch(dyn2Calc_Xframe3D_ImportXML.Xframe3DXMLData_Plates)
watch_2 = Watch(dyn2Calc_Xframe3D_ImportXML.Xframe3DXMLData_Nodes)
