# Dynamo graph Xframe3D To Revit.dyn (Dynamo 2.3.0.5885)
# packages: Dyn2Calc.Xframe3D 0.1.2

code_block = CodeBlock { "folder_family"; }  # frozen
dyn2Calc_Xframe3D_Settings = Custom[Dyn2Calc_Xframe3D_Settings](SearchSetting=code_block)  # package Dyn2Calc.Xframe3D; Settings regarding familiies, materials etc
dyn2Calc_Xframe3D_LoadFamilies = Custom[Dyn2Calc_Xframe3D_LoadFamilies](path=dyn2Calc_Xframe3D_Settings.SettingFound)  # package Dyn2Calc.Xframe3D; Load Families for Structural Columns Framings etc
file_path = Filename("..\..\..\..\Bureaublad\TEMP\test90.xml")  # graph input
dyn2Calc_Xframe3D_ImportXML = Custom[Dyn2Calc_Xframe3D_ImportXML](xmlFile=file_path)  # package Dyn2Calc.Xframe3D; Import Xframe3D XML and convert to points, lines and metadata
dyn2Calc_Xframe3D_SplitColumnsFramingsMa = Custom[Dyn2Calc_Xframe3D_SplitColumnsFramingsMaterial](Xframe3DXMLData_Beams=dyn2Calc_Xframe3D_ImportXML.Xframe3DXMLData_Beams, Xframe3DXMLData_Profiles=dyn2Calc_Xframe3D_ImportXML.Xframe3DXMLData_Profiles)  # package Dyn2Calc.Xframe3D; Split Beams from Xframe 3D in Columns, Framings and order per material
levels = Levels("00_begane grond")
dyn2Calc_Xframe3D_PlaceSteelColumnsFrami = Custom[Dyn2Calc_Xframe3D_PlaceSteelColumnsFramings](Data_Structural_Column_Steel=dyn2Calc_Xframe3D_SplitColumnsFramingsMa.Data_Structural_Column_Steel, Data_Structural_Framing_Steel=dyn2Calc_Xframe3D_SplitColumnsFramingsMa.Data_Structural_Framing_Steel, Level_To_Place=levels)  # frozen; package Dyn2Calc.Xframe3D; Place Structural Columns and Framings from an XML-file generated by X-frame 3D
code_block_2 = CodeBlock { 0; 0; 3000; 3000; }
dyn2Calc_Xframe3D_Grids = Custom[Dyn2Calc_Xframe3D_Grids](dx=code_block_2.out0, dy=code_block_2.out1, ExtentionGridX=code_block_2.out2, ExtentionGridY=code_block_2.out3, Xframe3DXML_Grids=dyn2Calc_Xframe3D_ImportXML.Xframe3DXMLData_Grids)  # frozen; package Dyn2Calc.Xframe3D; Create Grids in Revit based on Xframe3DXMLImport
