# Dynamo custom node Dyn2Calc_Xframe3D_Grids.dyf "Dyn2CalcXframe3DGrids" (Dynamo 2.3.0.5885)
# category: Dyn2Calc.Xframe3d
# Create Grids in Revit based on Xframe3DXMLImport
# packages: Clockwork for Dynamo 2.x 2.1.2

Xframe3DXML_Grids = Input(Xframe3DXML_Grids: var[]..[])
code_block = CodeBlock(Xframe3DXML_Grids=Xframe3DXML_Grids) { Xframe3DXML_Grids[1]; Xframe3DXML_Grids[2]; Xframe3DXML_Grids[3]; Xframe3DXML_Grids[4]; }
dx = Input(dx: double = 0)
dy = Input(dy: double = 0)
code_block_2 = CodeBlock(dx=dx, dy=dy) { dx; dy; }
ExtentionGridX = Input(ExtentionGridX: double = 3000)
ExtentionGridY = Input(ExtentionGridY: double = 3000)
code_block_3 = CodeBlock(ExtentieX=ExtentionGridX, ExtentieY=ExtentionGridY) { ExtentieX; ExtentieY; }

# group: GRID X
toNumber = String.ToNumber(str=code_block.out0)
python_script = Python(IN[0]=toNumber)
# ---------- python_script.python (21 lines) ----------
# Load the Python Standard and DesignScript Libraries
import sys
import clr
clr.AddReference('ProtoGeometry')
from Autodesk.DesignScript.Geometry import *

# The inputs to this node will be stored as a list in the IN variables.
dataEnteringNode = IN

GridDistances = IN[0]
# Place your code below this line

Coordinates = []

Coordinate = 0
for i in GridDistances:
	Coordinate = Coordinate+i
	Coordinates.append(Coordinate)
	
# Assign your output to the OUT variable.
OUT = Coordinates
# ----------------------------------------

code_block_4 = CodeBlock(x=python_script, dy=code_block_2.dy) { x+dy; }

# group: GRID Y
toNumber_2 = String.ToNumber(str=code_block.out2)
python_script_2 = Python(IN[0]=toNumber_2)  # same code as python_script
maximumItem = List.MaximumItem(list=code_block_4)
code_block_5 = CodeBlock(ExtentieX=code_block_3.ExtentieX, xmax=maximumItem) { 0; -ExtentieX; xmax+ExtentieX; }

code_block_6 = CodeBlock(y=python_script_2, dx=code_block_2.dx) { y+dx; }

# group (continued): GRID X
maximumItem_2 = List.MaximumItem(list=code_block_6)
code_block_7 = CodeBlock(ExtentieY=code_block_3.ExtentieY, ymax=maximumItem_2) { 0; -ExtentieY; ymax+ExtentieY; }
byCoordinates = Point.ByCoordinates(x=code_block_4, y=code_block_7.out1, z=code_block_7.out0)
byCoordinates_2 = Point.ByCoordinates(x=code_block_4, y=code_block_7.out2, z=code_block_7.out0)
byStartPointEndPoint = Line.ByStartPointEndPoint(startPoint=byCoordinates, endPoint=byCoordinates_2)

# group (continued): GRID Y
byCoordinates_3 = Point.ByCoordinates(x=code_block_5.out1, y=code_block_6, z=code_block_5.out0)
byCoordinates_4 = Point.ByCoordinates(x=code_block_5.out2, y=code_block_6, z=code_block_5.out0)
byStartPointEndPoint_2 = Line.ByStartPointEndPoint(startPoint=byCoordinates_3, endPoint=byCoordinates_4)

# group: CREATE GRIDS
byLine = Grid.ByLine(line=byStartPointEndPoint)
code_block_8 = CodeBlock { "Name"; }
count = List.Count(list=byLine)
code_block_9 = CodeBlock(a=count) { 100..99+a; }
string_from_object = FromObject(obj=code_block_9)
setParameterByName = Element.SetParameterByName(element=byLine, parameterName=code_block_8, value=string_from_object)
byLine_2 = Grid.ByLine(line=byStartPointEndPoint_2)
count_2 = List.Count(list=byLine_2)
code_block_10 = CodeBlock(a=count_2) { 300..299+a; }
string_from_object_2 = FromObject(obj=code_block_10)
setParameterByName_2 = Element.SetParameterByName(element=byLine_2, parameterName=code_block_8, value=string_from_object_2)

passthrough = Custom[Passthrough](passThrough=code_block.out1, waitFor=setParameterByName)  # package Clockwork for Dynamo 2.x; Forces a sequential order of execution. The node wired into the output of the Passthrough node will be executed *after* the node wired into the waitFor input (e.g. important for some Revit operations). The value of the passThrough input will be passed on to the node wired into the output port of the Passthrough node.
code_block_11 = CodeBlock(a=setParameterByName, b=code_block_8, c=passthrough) { a; b; c; d; }  # unwired: d

# group (continued): CREATE GRIDS
setParameterByName_3 = Element.SetParameterByName(element=code_block_11.a, parameterName=code_block_11.b, value=code_block_11.c)

GridX = Output(setParameterByName_3)
passthrough_2 = Custom[Passthrough](passThrough=code_block.out3, waitFor=setParameterByName_2)

# group (continued): CREATE GRIDS
setParameterByName_4 = Element.SetParameterByName(element=setParameterByName_2, parameterName=code_block_8, value=passthrough_2)

GridY = Output(setParameterByName_4)
