# Dynamo custom node Dyn2Calc_Xframe3D_LoadFamilies.dyf (Dynamo 2.3.0.5885)
# category: Dyn2Calc.Xframe3d
# Load Families for Structural Columns Framings etc

path = Input(path: var[]..[])
directory_from_path = DirectoryObject(path=path)
getDirectoryContents = FileSystem.GetDirectoryContents(directory=directory_from_path)

# group: CLOCKWORK LOAD FAMILY
create = List.Create(item0=getDirectoryContents.files)
flatten = List.Flatten(list=create)
directoryName = FileSystem.DirectoryName(path=flatten)
code_block = CodeBlock(path=directoryName) { path + "\\"; ""; ".rfa"; }
replace = String.Replace(str=flatten, searchFor=code_block.out0, replaceWith=code_block.out1)
replace_2 = String.Replace(str=replace, searchFor=code_block.out2, replaceWith=code_block.out1)
python_script = Python(IN[0]=flatten, IN[1]=replace_2)
# ---------- python_script.python (36 lines) ----------
import clr
clr.AddReference('RevitAPI')
from Autodesk.Revit.DB import *

clr.AddReference("RevitNodes")
import Revit
clr.ImportExtensions(Revit.Elements)

clr.AddReference("RevitServices")
import RevitServices
from RevitServices.Persistence import DocumentManager
from RevitServices.Transactions import TransactionManager

doc = DocumentManager.Instance.CurrentDBDocument
fampaths = IN[0]
famnames = IN[1]
elementlist = []
booleans = []

TransactionManager.Instance.EnsureInTransaction(doc)
for fampath in fampaths:
	try: 
		doc.LoadFamily(fampath)
		booleans.append(True)
	except: booleans.append(False)
TransactionManager.Instance.TransactionTaskDone()

collector = FilteredElementCollector(doc)
collector.OfClass(Family)
for item in collector.ToElements():
	if item.Name in famnames:
		typelist = list()
		for famtypeid in item.GetFamilySymbolIds():
			typelist.append(doc.GetElement(famtypeid).ToDSType(True))
		elementlist.append(typelist)
OUT = (elementlist,booleans)
# ----------------------------------------
lastItem = List.LastItem(list=python_script)
python_script_2 = Python(IN[0]=getDirectoryContents.files, IN[1]=lastItem)
# ---------- python_script_2.python (4 lines) ----------
check = IN[0]
items = IN[1]
if isinstance(check, (list)): OUT = items
else: OUT = items[0]
# ----------------------------------------
firstItem = List.FirstItem(list=python_script)
python_script_3 = Python(IN[0]=getDirectoryContents.files, IN[1]=firstItem)  # same code as python_script_2

success = Output(python_script_2)
familyTypes = Output(python_script_3)
