# Dynamo custom node Dyn2Calc_Xframe3D_Settings.dyf (Dynamo 2.3.0.5885)
# category: Dyn2Calc.Xframe3d
# Settings regarding familiies, materials etc

code_block = CodeBlock()
# ---------- code_block.designscript (9 lines) ----------
//keys
["folder_family",
"familyname_structural_framing_concrete_rectangle",
"familyname_structural_framing_wood_rectangle",
"familyname_structural_column_concrete_rectangle",
"familyname_structural_column_wood_rectangle",
"typename_unknown_structural_framing",
"typename_unknown_structural_column",
"steelprofiletypelistnumber"];
# ----------------------------------------
code_block_2 = CodeBlock()
# ---------- code_block_2.designscript (9 lines) ----------
//values
["C:/Users/mikev/AppData/Roaming/Dynamo/Dynamo Revit/2.3/packages/Dyn2Calc.Xframe3D/extra/Families",
"NLRS_28_SFR_balk_beton",
"NLRS_28_SFR_houten_balk",
"NLRS_28_SC_beton_rechthoek",
"NLRS_28_SC_HK",
"Unknown Framing",
"Unknown Column",
0];
# ----------------------------------------
byKeysValues = DesignScript.Builtin.Dictionary.ByKeysValues(keys=code_block, values=code_block_2)
SearchSetting = Input(SearchSetting: string = "folder_family")
valueAtKey = DesignScript.Builtin.Dictionary.ValueAtKey(dictionary=byKeysValues, key=SearchSetting)
SettingFound = Output(valueAtKey)
All_Settings = Output(byKeysValues)
