# Dynamo custom node Dyn2Calc_XFEM4U_ImportXML.dyf (Dynamo 2.10.1.3976)
# category: Dyn2Calc.Struct4U
# Import XFEM4U XML and convert to points, lines and metadata

xmlFile = Input(xmlFile: var[]..[])
readText = FileSystem.ReadText(file=xmlFile)

# group: PROJECTINFORMATION
code_block = CodeBlock { ".ProjectName"; ".ProjectNumber"; ".ExportDateTime"; ".XMLExportVersion"; }
create = List.Create(item0=code_block.out0, item1=code_block.out1, item2=code_block.out2, item3=code_block.out3)
python_script = Python(IN[0]=readText, IN[1]=create)  # IronPython2
# ---------- python_script.python (19 lines) ----------
import sys
sys.path.append("C:\Program Files (x86)\IronPython 2.7\Lib")
import xml.etree.ElementTree as ET

xml = IN[0]
xpathstr = IN[1]

root = ET.fromstring(xml)

xpathfound = []
for i in xpathstr:
	xpathfound.append(root.findall(i))

xtext = []
for i in xpathfound:
	for j in i:
		xtext.append(j.text)

OUT = xtext
# ----------------------------------------

XFEM4U_XMLData_ProjectInformation = Output(python_script)
code_block_2 = CodeBlock { "Nodes_Points"; }

# group: NODES
code_block_3 = CodeBlock { ".Nodes/Number"; ".Nodes/X"; ".Nodes/Y"; ".Nodes/Z"; }
create_2 = List.Create(item0=code_block_3.out0, item1=code_block_3.out1, item2=code_block_3.out2, item3=code_block_3.out3)
python_script_2 = Python(IN[0]=readText, IN[1]=create_2)  # IronPython2
# ---------- python_script_2.python (22 lines) ----------
import sys
sys.path.append("C:\Program Files (x86)\IronPython 2.7\Lib")
import xml.etree.ElementTree as ET

xml = IN[0]
xpathstr = IN[1]

root = ET.fromstring(xml)

xpathfound = []
for i in xpathstr:
	xpathfound.append(root.findall(i))

xtext = []
for i in xpathfound:
	temp = []
	
	for j in i:
		temp.append(j.text)
	xtext.append(temp)

OUT = xtext
# ----------------------------------------

addItemToEnd = List.AddItemToEnd(item=code_block_2, list=create_2)
code_block_4 = CodeBlock { ","; "."; }
replace = String.Replace(string=python_script_2, searchFor=code_block_4.out0, replaceWith=code_block_4.out1)

# group (continued): NODES
toNumber = String.ToNumber(str=replace)
code_block_5 = CodeBlock(point=toNumber) { point[0]; point[1]; point[2]; point[3]; }
byCoordinates = Point.ByCoordinates(x=code_block_5.out1, y=code_block_5.out2, z=code_block_5.out3)
addItemToEnd_2 = List.AddItemToEnd(item=byCoordinates, list=toNumber)
addItemToFront = List.AddItemToFront(item=addItemToEnd, list=addItemToEnd_2)

XFEM4U_XMLData_Nodes = Output(addItemToFront)

# group: GRIDS
code_block_6 = CodeBlock { ".Grids/X"; ".Grids/X_Lable"; ".Grids/Y"; ".Grids/Y_Lable"; ".Grids/Z"; ".Grids/Z_Lable"; }
create_3 = List.Create(item0=code_block_6.out0, item1=code_block_6.out1, item2=code_block_6.out2, item3=code_block_6.out3, item4=code_block_6.out4, item5=code_block_6.out5)
python_script_3 = Python(IN[0]=readText, IN[1]=create_3)  # IronPython2
# ---------- python_script_3.python (43 lines) ----------
import sys
sys.path.append("C:\Program Files (x86)\IronPython 2.7\Lib")
import xml.etree.ElementTree as ET

xml = IN[0]
xpathstr = IN[1]

def splitGrid(sent):
# Change sentence of '4x3000' to 3000 3000 3000 3000 
    sent = sent.split(" ")
    y = []
    for i in sent:
        if "x" in i:
            lstGrids = i.split("x")
            lstGridsNew = [lstGrids[1]] * int(lstGrids[0])
            for j in lstGridsNew:
                y.append(j)
        else:
            y.append(i)
    return y

root = ET.fromstring(xml)

xpathfound = []
for i in xpathstr:
	xpathfound.append(root.findall(i))

xtext = []
counter = 0

for i in xpathfound:
    temp = []
    for j in i:
        if (counter == 0 or counter == 2 or counter == 4):
            temp = splitGrid(j.text)
        else:
            temp = j.text.split(" ")
    xtext.append(temp)
    counter = counter  + 1
    
sent = xtext[0][0]

OUT = xtext
# ----------------------------------------
addItemToFront_2 = List.AddItemToFront(item=create_3, list=python_script_3)

XFEM4U_XMLData_Grids = Output(addItemToFront_2)

# group: PROFILES
code_block_7 = CodeBlock()
# ---------- code_block_7.designscript (16 lines) ----------
".Profiles/Number";
".Profiles/Profile_name";
".Profiles/Material_type";
".Profiles/Material";
".Profiles/Angle";
".Profiles/Profile_shape";
".Profiles/h";
".Profiles/b";
".Profiles/h1";
".Profiles/b1";
".Profiles/h2";
".Profiles/b2";
".Profiles/h3";
".Profiles/b3";
".Profiles/h4";
".Profiles/b4";
# ----------------------------------------
create_4 = List.Create(item0=code_block_7.out0, item1=code_block_7.out1, item2=code_block_7.out2, item3=code_block_7.out3, item4=code_block_7.out4, item5=code_block_7.out5, item6=code_block_7.out6, item7=code_block_7.out7, item8=code_block_7.out8, item9=code_block_7.out9, item10=code_block_7.out10, item11=code_block_7.out11, item12=code_block_7.out12, item13=code_block_7.out13, item14=code_block_7.out14, item15=code_block_7.out15)
python_script_4 = Python(IN[0]=readText, IN[1]=create_4)  # IronPython2; same code as python_script_2
addItemToFront_3 = List.AddItemToFront(item=create_4, list=python_script_4)
code_block_8 = CodeBlock { ".Profiles/Number"; ".Profiles/Profile_name"; ".Profiles/Material_type"; ".Profiles/Material"; ".Profiles/Angle"; }
create_5 = List.Create(item0=code_block_8.out0, item1=code_block_8.out1, item2=code_block_8.out2, item3=code_block_8.out3, item4=code_block_8.out4)
python_script_5 = Python(IN[0]=readText, IN[1]=create_5)  # IronPython2; same code as python_script_2
addItemToFront_4 = List.AddItemToFront(item=create_5, list=python_script_5)

XFEM4U_XMLData_ProfileShapeProperties = Output(addItemToFront_3)
code_block_9 = CodeBlock { "From_node_number_Point"; "To_node_number_Point"; "Beamcurve"; }

# group: BEAMS
code_block_10 = CodeBlock()
# ---------- code_block_10.designscript (9 lines) ----------
".Beams/Number";
".Beams/Beamgroupnumber";
".Beams/From_node_number";
".Beams/To_node_number";
".Beams/Angle";
".Beams/Angle_profile";
".Beams/Profile_number";
".Beams/Z";
".Beams/Top_Center_Bottom";
# ----------------------------------------
create_6 = List.Create(item0=code_block_10.out0, item1=code_block_10.out1, item2=code_block_10.out2, item3=code_block_10.out3, item4=code_block_10.out4, item5=code_block_10.out5, item6=code_block_10.out6, item7=code_block_10.out7, item8=code_block_10.out8)
python_script_6 = Python(IN[0]=readText, IN[1]=create_6)  # IronPython2; same code as python_script_2
code_block_11 = CodeBlock(beam=python_script_6) { beam[0]; beam[1]; beam[2]; beam[3]; beam[4]; beam[5]; beam[6]; beam[7]; }
toNumber_2 = String.ToNumber(str=code_block_11.out2)
python_script_7 = Python(IN[0]=code_block_5.out0, IN[1]=toNumber_2)  # IronPython2
# ---------- python_script_7.python (15 lines) ----------
import clr
clr.AddReference('ProtoGeometry')
from Autodesk.DesignScript.Geometry import *
#The inputs to this node will be stored as a list in the IN variables.
dataEnteringNode = IN

lst = IN[0]
value = IN[1]

indices = []
for i in value:
	indices.append(lst.index(i))

#Assign your output to the OUT variable.
OUT = indices
# ----------------------------------------
getItemAtIndex = List.GetItemAtIndex(list=byCoordinates, index=python_script_7)
toNumber_3 = String.ToNumber(str=code_block_11.out3)
python_script_8 = Python(IN[0]=code_block_5.out0, IN[1]=toNumber_3)  # IronPython2; same code as python_script_7
getItemAtIndex_2 = List.GetItemAtIndex(list=byCoordinates, index=python_script_8)

addItemToEnd_3 = List.AddItemToEnd(item=code_block_9.out0, list=create_6)
addItemToEnd_4 = List.AddItemToEnd(item=code_block_9.out1, list=addItemToEnd_3)
addItemToEnd_5 = List.AddItemToEnd(item=code_block_9.out2, list=addItemToEnd_4)
byStartPointEndPoint = Line.ByStartPointEndPoint(startPoint=getItemAtIndex, endPoint=getItemAtIndex_2)
addItemToEnd_6 = List.AddItemToEnd(item=getItemAtIndex, list=python_script_6)
addItemToEnd_7 = List.AddItemToEnd(item=getItemAtIndex_2, list=addItemToEnd_6)
addItemToEnd_8 = List.AddItemToEnd(item=byStartPointEndPoint, list=addItemToEnd_7)
addItemToFront_5 = List.AddItemToFront(item=addItemToEnd_5, list=addItemToEnd_8)
XFEM4U_XMLData_Beams = Output(addItemToFront_5)

# group: SUPPORTS
code_block_12 = CodeBlock { ".Supports/Number"; ".Supports/Nodenumber"; ".Supports/dx"; ".Supports/dy"; ".Supports/dz"; }
create_7 = List.Create(item0=code_block_12.out0, item1=code_block_12.out1, item2=code_block_12.out2, item3=code_block_12.out3, item4=code_block_12.out4)
python_script_9 = Python(IN[0]=readText, IN[1]=create_7)  # IronPython2; same code as python_script_2
addItemToFront_6 = List.AddItemToFront(item=create_7, list=python_script_9)

XFEM4U_XMLData_Supports = Output(addItemToFront_6)

# group: BEAMGROUP
code_block_13 = CodeBlock { ".Beamgroup/Number"; ".Beamgroup/Startnode"; ".Beamgroup/Endnode"; }
create_8 = List.Create(item0=code_block_13.out0, item1=code_block_13.out1, item2=code_block_13.out2)
python_script_10 = Python(IN[0]=readText, IN[1]=create_8)  # IronPython2; same code as python_script_2
addItemToFront_7 = List.AddItemToFront(item=create_8, list=python_script_10)

XFEM4U_XMLData_Beamgroup = Output(addItemToFront_7)

# group: PLATES
code_block_14 = CodeBlock()
# ---------- code_block_14.designscript (9 lines) ----------
".Plates/Number";
".Plates/Node";
".Plates/h";
".Plates/Material";
".Plates/Z";
".Plates/Top_Center_Bottom";
".Plates/";
".Plates/Points";
".Plates/Curves";
# ----------------------------------------
create_9 = List.Create(item0=code_block_14.out0, item1=code_block_14.out1, item2=code_block_14.out2, item3=code_block_14.out3, item4=code_block_14.out4, item5=code_block_14.out5, item6=code_block_14.out6)
python_script_11 = Python(IN[0]=readText, IN[1]=create_9)  # CPython3
# ---------- python_script_11.python (32 lines) ----------
import sys
sys.path.append("C:\Program Files (x86)\IronPython 2.7\Lib")
import xml.etree.ElementTree as ET

xml = IN[0]
xpathstr = IN[1]

root = ET.fromstring(xml)

xpathfound = []
xpathtags = []
for i in xpathstr:
	xpathfound.append(root.findall(i))
	xpathtag = []
	for j in root.findall(i):
		xpathtag.append(j.tag)
	xpathtags.append(xpathtag)

xtext = []
for i in xpathfound:
	temp = []
	
	for j in i:
		temp.append(j.text)
	xtext.append(temp)

#test = []
#for child in root:
#	for 
#	test.append(child.tag)
	
OUT = xtext, xpathtags
# ----------------------------------------
create_10 = List.Create(item0=code_block_14.out0, item1=code_block_14.out1, item2=code_block_14.out2, item3=code_block_14.out3, item4=code_block_14.out4, item5=code_block_14.out5, item6=code_block_14.out6, item7=code_block_14.out7, item8=code_block_14.out8)
code_block_15 = CodeBlock(a=python_script_11) { a[0]; }
addItemToFront_8 = List.AddItemToFront(item=create_10, list=code_block_15)

# group: GET NODENUMBERS OF FLOORCURVE
code_block_16 = CodeBlock(a=addItemToFront) { a[1]; a[5]; }
string_from_object = FromObject(object=code_block_16.out0)
byKeysValues = DesignScript.Builtin.Dictionary.ByKeysValues(keys=string_from_object, values=code_block_16.out1)
code_block_17 = CodeBlock(a=python_script_11) { a[1][6]; }
code_block_18 = CodeBlock(a=python_script_11) { a[0][6]; }
python_script_12 = Python(IN[0]=code_block_17, IN[1]=code_block_18)  # CPython3
# ---------- python_script_12.python (30 lines) ----------
# Load the Python Standard and DesignScript Libraries
import sys
import clr
clr.AddReference('ProtoGeometry')
from Autodesk.DesignScript.Geometry import *

# The inputs to this node will be stored as a list in the IN variables.
dataEnteringNode = IN

xmlnames = IN[0]
xmlvalues = IN[1]

indices = [i for i, x in enumerate(xmlnames) if x == "Number"]
indices2 = [i for i, x in enumerate(xmlnames) if x == "Node"]

indices.append(len(xmlnames))
indices.pop(0)

xmlnamesgroup = []
xmlvaluesgroup = []

x = 0
for i in indices:
    x1 = i
    xmlname = xmlnames[x:x1]
    xmlnamesgroup.append(xmlnames[x:x1])
    xmlvaluesgroup.append(xmlvalues[x:x1])
    x = i

OUT = xmlnamesgroup, xmlvaluesgroup
# ----------------------------------------
code_block_19 = CodeBlock(a=python_script_12)
# ---------- code_block_19.designscript (5 lines) ----------
a[0];
//list with nodenames;
"Node";
a[1];
//list with nodenumbers;
# ----------------------------------------
contains = String.Contains(str=code_block_19.out0, searchFor=code_block_19.out1)
filterByBoolMask = List.FilterByBoolMask(list=code_block_19.out2, mask=contains)
string_from_object_2 = FromObject(object=filterByBoolMask.in)
valueAtKey = DesignScript.Builtin.Dictionary.ValueAtKey(dictionary=byKeysValues, key=string_from_object_2)
boolean = BoolSelector(true)
byPoints = PolyCurve.ByPoints(points=valueAtKey, connectLastToFirst=boolean)
code_block_20 = CodeBlock { -1; }
dropItems = List.DropItems(list=addItemToFront_8, amount=code_block_20)
addItemToEnd_9 = List.AddItemToEnd(item=valueAtKey, list=dropItems)
addItemToEnd_10 = List.AddItemToEnd(item=byPoints, list=addItemToEnd_9)

XFEM4U_XMLData_Plates = Output(addItemToEnd_10)

# group: RebarLongitudinal
code_block_21 = CodeBlock()
# ---------- code_block_21.designscript (9 lines) ----------
".RebarLongitudinal/Number";
".RebarLongitudinal/Beamgroupnumber";
".RebarLongitudinal/FromX";
".RebarLongitudinal/ToX";
".RebarLongitudinal/Reinforcement";
".RebarLongitudinal/Z";
".RebarLongitudinal/Ldstart";
".RebarLongitudinal/Ldend";
".RebarLongitudinal/SteelGrade";
# ----------------------------------------
create_11 = List.Create(item0=code_block_21.out0, item1=code_block_21.out1, item2=code_block_21.out2, item3=code_block_21.out3, item4=code_block_21.out4, item5=code_block_21.out5, item6=code_block_21.out6, item7=code_block_21.out7, item8=code_block_21.out8)
python_script_13 = Python(IN[0]=readText, IN[1]=create_11)  # IronPython2; same code as python_script_2
addItemToFront_9 = List.AddItemToFront(item=create_11, list=python_script_13)

XFEM4U_XMLData_RebarLongitudinal = Output(addItemToFront_9)

# group: RebarStirrup
code_block_22 = CodeBlock()
# ---------- code_block_22.designscript (7 lines) ----------
".RebarStirrup/Number";
".RebarStirrup/Beamgroupnumber";
".RebarStirrup/FromX";
".RebarStirrup/ToX";
".RebarStirrup/Stirrips";
".RebarStirrup/NumberOfStirrupSections";
".RebarStirrup/SteelGrade";
# ----------------------------------------
create_12 = List.Create(item0=code_block_22.out0, item1=code_block_22.out1, item2=code_block_22.out2, item3=code_block_22.out3, item4=code_block_22.out4, item5=code_block_22.out5, item6=code_block_22.out6)
python_script_14 = Python(IN[0]=readText, IN[1]=create_12)  # IronPython2; same code as python_script_2
addItemToFront_10 = List.AddItemToFront(item=create_12, list=python_script_14)

XFEM4U_XMLData_RebarStirrup = Output(addItemToFront_10)
XFEM4U_XMLData_Profiles = Output(addItemToFront_4)

# group: Layers
code_block_23 = CodeBlock { ".Layers/Layer_number"; ".Layers/Layer_description"; }
create_13 = List.Create(item0=code_block_23.out0, item1=code_block_23.out1)
python_script_15 = Python(IN[0]=readText, IN[1]=create_13)  # IronPython2; same code as python_script_2
addItemToFront_11 = List.AddItemToFront(item=create_13, list=python_script_15)

XFEM4U_XMLData_Layers = Output(addItemToFront_11)
