# Dynamo custom node Dyn2Calc_XFEM4U_PlaceSteelColumnsFramings.dyf (Dynamo 2.10.1.3976)
# category: Dyn2Calc.Struct4U
# Place Structural Columns and Framings from an XML-file generated by XFEM4U
# packages: Clockwork for Dynamo 2.x 2.3.0, Dyn2Calc.Struct4U 0.0.2

Data_Structural_Framing_Steel = Input(Data_Structural_Framing_Steel: var[]..[])
transpose = List.Transpose(lists=Data_Structural_Framing_Steel)
code_block = CodeBlock(a=transpose) { a[11]; }
Level_To_Place = Input(Level_To_Place: var[]..[])
code_block_2 = CodeBlock(a=transpose) { a[13]; }
FamilyType_Unknown_Framing = Input(FamilyType_Unknown_Framing: var[]..[])

# group: Structural Framing Types Steel
dyn2Calc_XFEM4U_SteelSectionsNames = Custom[Dyn2Calc_XFEM4U_SteelSectionsNames]()  # package Dyn2Calc.Struct4U; Mapping node for XFEM4U Sectionnames and Revit Type Names
code_block_3 = CodeBlock { "Structural Framing"; }
byName = Category.ByName(name=code_block_3)
python_script = Python(IN[0]=byName)  # IronPython2
# ---------- python_script.python (29 lines) ----------
import System
import clr
clr.AddReference('RevitAPI')
from Autodesk.Revit.DB import *

clr.AddReference("RevitNodes")
import Revit
clr.ImportExtensions(Revit.Elements)

clr.AddReference("RevitServices")
import RevitServices
from RevitServices.Persistence import DocumentManager

def GetBicFromInput(var):	
	bic = None
	if var:
		cattype = var.GetType().ToString()
		if cattype == "Revit.Elements.Category": bic = System.Enum.ToObject(BuiltInCategory, var.Id)
		elif cattype == "Autodesk.Revit.DB.BuiltInCategory": bic = var
		elif cattype == "System.String": 
			found = [x for x in bics if x.ToString() == var]
			if len(found) > 0: bic = found[0]
	return bic

doc = DocumentManager.Instance.CurrentDBDocument
bics = System.Enum.GetValues(BuiltInCategory)

if isinstance(IN[0], list): OUT = [GetBicFromInput(x) for x in IN[0]]
else: OUT = GetBicFromInput(IN[0])
# ----------------------------------------
boolean = BoolSelector(true)
python_script_2 = Python(IN[0]=python_script, IN[1]=boolean)  # IronPython2; unwired: IN[2]
# ---------- python_script_2.python (21 lines) ----------
import System
import clr
clr.AddReference('RevitAPI')
from Autodesk.Revit.DB import *

clr.AddReference("RevitServices")
import RevitServices
from RevitServices.Persistence import DocumentManager

def ElementTypesByCategory(bic, doc):
	collector = FilteredElementCollector(doc).OfCategory(bic).WhereElementIsElementType()
	return collector.ToElements()

inputdoc = UnwrapElement(IN[2])
if not inputdoc: doc = DocumentManager.Instance.CurrentDBDocument
elif inputdoc.GetType().ToString() == "Autodesk.Revit.DB.RevitLinkInstance": doc = inputdoc.GetLinkDocument()
elif inputdoc.GetType().ToString() == "Autodesk.Revit.DB.Document": doc = inputdoc
else: doc = DocumentManager.Instance.CurrentDBDocument

if isinstance(IN[0], list): OUT = [ElementTypesByCategory(x, doc) for x in IN[0]]
else: OUT = ElementTypesByCategory(IN[0], doc)
# ----------------------------------------
name = FamilyType.Name(familyType=python_script_2)
python_script_3 = Python(IN[0]=dyn2Calc_XFEM4U_SteelSectionsNames.CombinedTransposedList, IN[1]=name, IN[2]=python_script_2, IN[3]=code_block_2, IN[4]=FamilyType_Unknown_Framing)  # CPython3
# ---------- python_script_3.python (62 lines) ----------
import System
import clr
clr.AddReference('RevitAPI')
from Autodesk.Revit.DB import *

LibXFEM4URevitNames = IN[0]
FamilyNamesInDoc = IN[1]
FamilyTypesInDoc = IN[2]
SectionNamesXML = IN[3]
UnknownFamilyType = IN[4]

#Bring all names to uppercase
for i in range(len(SectionNamesXML)):
    SectionNamesXML[i] = SectionNamesXML[i].upper()

#Map Available Families in Document to Lits
LibXFEM4URevitNamesNew = []


for i in LibXFEM4URevitNames:
	count = 0
	for j,k in zip(FamilyNamesInDoc,FamilyTypesInDoc):
		if j in i:
			i.insert(0,k)
			count = 1
	if count is 0:
	   i.insert(0,["FamilyType not Loaded",i[0]])
	LibXFEM4URevitNamesNew.append(i)

SectionsFound = []

for i in SectionNamesXML:
	count = 0
	for j in LibXFEM4URevitNamesNew:
		if i in j:
			SectionsFound.append(j[0])
			count = 1
	if count is 0:
		SectionsFound.append(["FamilyType not Loaded",i])

UnrecognisedSections = []

for i in SectionsFound:
    try:
        UnrecognisedSections.append(i[1])
    except: pass

SectionsFoundCleared = []

for i in SectionsFound:
    try:
        x = i[1]
        SectionsFoundCleared.append(UnknownFamilyType)
    except:
        SectionsFoundCleared.append(i)
    
UnrecognisedSectionsUnique = []
for x in UnrecognisedSections:
    if x not in UnrecognisedSectionsUnique:
        UnrecognisedSectionsUnique.append(x)
        
OUT = SectionsFound, UnrecognisedSectionsUnique, SectionsFoundCleared
# ----------------------------------------
code_block_4 = CodeBlock(a=python_script_3) { a[2]; a[1]; }
replaceNull = Custom[List.ReplaceNull](seq=code_block_4.out0, replacement=FamilyType_Unknown_Framing)  # package Clockwork for Dynamo 2.x; Replaces all null values within a given list with a substitute

# group: PLACE STRUCTURAL FRAMING
beamByCurve = StructuralFraming.BeamByCurve(curve=code_block, level=Level_To_Place, structuralFramingType=replaceNull)

code_block_5 = CodeBlock(a=transpose)
# ---------- code_block_5.designscript (8 lines) ----------
a[10];
a[11];
a[8];
//Z value;
a[7];
//Top Center Bottom;
DSCore.String.ToNumber(a[5])+DSCore.String.ToNumber(a[16]);
//Angle
# ----------------------------------------

# group: SET Z/Bottom/Center
code_block_6 = CodeBlock { "z Justification"; }
code_block_7 = CodeBlock()
# ---------- code_block_7.designscript (10 lines) ----------
//Top = 0
//Center = 1
//Bottom = 3
//Origin = 2
"Top";
"Center";
"Bottom";
"0";
"1";
"3";
# ----------------------------------------
replace = String.Replace(string=code_block_5.out2, searchFor=code_block_7.out0, replaceWith=code_block_7.out3)
replace_2 = String.Replace(string=replace, searchFor=code_block_7.out1, replaceWith=code_block_7.out4)
replace_3 = String.Replace(string=replace_2, searchFor=code_block_7.out2, replaceWith=code_block_7.out5)
toNumber = String.ToNumber(str=replace_3)
setParameterByName = Element.SetParameterByName(element=beamByCurve, parameterName=code_block_6, value=toNumber)

StructuralFramingPlaced = Output(setParameterByName)
Data_Structural_Column_Steel = Input(Data_Structural_Column_Steel: var[]..[])
transpose_2 = List.Transpose(lists=Data_Structural_Column_Steel)
code_block_8 = CodeBlock(a=transpose_2) { a[11]; }
code_block_9 = CodeBlock(a=transpose_2) { a[13]; }
FamilyType_Unknown_Column = Input(FamilyType_Unknown_Column: var[]..[])

# group: Structural Column Types Steel
dyn2Calc_XFEM4U_SteelSectionsNames_2 = Custom[Dyn2Calc_XFEM4U_SteelSectionsNames]()
code_block_10 = CodeBlock { "Structural Columns"; }
byName_2 = Category.ByName(name=code_block_10)
python_script_4 = Python(IN[0]=byName_2)  # IronPython2; same code as python_script
boolean_2 = BoolSelector(true)
python_script_5 = Python(IN[0]=python_script_4, IN[1]=boolean_2)  # IronPython2; unwired: IN[2]; same code as python_script_2
name_2 = FamilyType.Name(familyType=python_script_5)
python_script_6 = Python(IN[0]=dyn2Calc_XFEM4U_SteelSectionsNames_2.CombinedTransposedList, IN[1]=name_2, IN[2]=python_script_5, IN[3]=code_block_9, IN[4]=FamilyType_Unknown_Column)  # CPython3; same code as python_script_3
code_block_11 = CodeBlock(a=python_script_6) { a[2]; a[1]; }
replaceNull_2 = Custom[List.ReplaceNull](seq=code_block_11.out0, replacement=FamilyType_Unknown_Column)

# group: REVERSE LINE DIRECTION, PLACE COLUMNS
endPoint = Curve.EndPoint(curve=code_block_8)
Z = Point.Z(point=endPoint)
startPoint = Curve.StartPoint(curve=code_block_8)
Z_2 = Point.Z(point=startPoint)
lt = Z < Z_2
filterByBoolMask = List.FilterByBoolMask(list=code_block_8, mask=lt)
reverse = Curve.Reverse(curve=filterByBoolMask.in)
join = List.Join(list0=reverse, list1=filterByBoolMask.out)
columnByCurve = StructuralFraming.ColumnByCurve(curve=join, level=Level_To_Place, structuralColumnType=replaceNull_2)

code_block_12 = CodeBlock(a=transpose_2)  # same code as code_block_5

# group: SET ANGLE
code_block_13 = CodeBlock { "Cross-Section Rotation"; }
watch = Watch(code_block_12.out4)
python_script_7 = Python(IN[0]=watch)  # IronPython2
# ---------- python_script_7.python (21 lines) ----------
# Load the Python Standard and DesignScript Libraries
import sys
import clr
clr.AddReference('ProtoGeometry')
from Autodesk.DesignScript.Geometry import *

# The inputs to this node will be stored as a list in the IN variables.
dataEnteringNode = IN

lst = IN[0]

lst2 = []

for i in lst:
	if i == 360:
		lst2.append(0)
	else: lst2.append(i)
# Place your code below this line

# Assign your output to the OUT variable.
OUT = lst2
# ----------------------------------------
setParameterByName_2 = Element.SetParameterByName(element=columnByCurve, parameterName=code_block_13, value=python_script_7)

StructuralColumnsPlaced = Output(setParameterByName_2)

# group: SET Z OFFSET VALUE
code_block_14 = CodeBlock { "z Offset Value"; }
toNumber_2 = String.ToNumber(str=code_block_5.out3)
setParameterByName_3 = Element.SetParameterByName(element=beamByCurve, parameterName=code_block_14, value=toNumber_2)

# group: SET ANGLE
code_block_15 = CodeBlock { "Cross-Section Rotation"; }
watch_2 = Watch(code_block_5.out4)
python_script_8 = Python(IN[0]=watch_2)  # IronPython2; same code as python_script_7
setParameterByName_4 = Element.SetParameterByName(element=beamByCurve, parameterName=code_block_15, value=python_script_8)

StructuralColumnsNotFound = Output(code_block_11.out1)
StructuralFramingNotFound = Output(code_block_4.out1)
