# Dynamo custom node Dyn2Calc_XFEM4U_PlateToWallFloor.dyf (Dynamo 2.10.1.3976)
# category: Dyn2Calc.Struct4U
# Create Revit Floors, directshape from the XML from XFEM4U
# packages: Clockwork for Dynamo 2.x 2.3.0, Dyn2Calc.Struct4U 0.0.3

PlaceFloors = Input(PlaceFloors: bool = true)
XFEM4UXMLData_Plates = Input(XFEM4UXMLData_Plates: var[]..[])

# group: GROUP HORIZONTAL FLOORS AND OTHER ELEMENTS BASED ON ORIENTATION
code_block = CodeBlock(a=XFEM4UXMLData_Plates)
# ---------- code_block.designscript (4 lines) ----------
a[3];
 //thickness;
a[8];
 //curves;
# ----------------------------------------
byPatch = Surface.ByPatch(closedCurve=code_block.out1)
code_block_2 = CodeBlock { 0.5; }
normalAtParameter = Surface.NormalAtParameter(surface=byPatch, u=code_block_2, v=code_block_2)
ZAxis = Vector.ZAxis()
isParallel = Vector.IsParallel(vector=normalAtParameter, other=ZAxis)
filterByBoolMask = List.FilterByBoolMask(list=code_block.out1, mask=isParallel)
filterByBoolMask_2 = List.FilterByBoolMask(list=code_block.out0, mask=isParallel)

# group: FLOORS
code_block_3 = CodeBlock(a=filterByBoolMask.in) { a; }

code_block_4 = CodeBlock { ""; }
if_ = If(test=PlaceFloors, true=code_block_3, false=code_block_4)
if_2 = If(test=PlaceFloors, true=filterByBoolMask_2.in, false=code_block_4)
StandardFloorType = Input(StandardFloorType: var[]..[])

# group: CHECK CURRENT DOCUMENT FOR REQUIRED FLOORTYPES. IF NOT AVAILABLE, THEY WILL BE CREATED
code_block_5 = CodeBlock { "floor_prefix"; "floor_suffix"; ""; }
dyn2Calc_XFEM4U_Settings = Custom[Dyn2Calc_XFEM4U_Settings](SearchSetting=code_block_5.out1)  # package Dyn2Calc.Struct4U; Settings regarding familiies, materials etc
watch = Watch(if_2)
dyn2Calc_XFEM4U_Settings_2 = Custom[Dyn2Calc_XFEM4U_Settings](SearchSetting=code_block_5.out0)
concat = String.Concat(string0=dyn2Calc_XFEM4U_Settings_2.SettingFound, string2=code_block_5.out2)  # unwired: string1
uniqueItems = List.UniqueItems(list=watch)
string_from_object = FromObject(object=uniqueItems)
map = List.Map(list=string_from_object, function=concat)
byName = FloorType.ByName(name=map)
isNull = Object.IsNull(object=byName)
filterByBoolMask_3 = List.FilterByBoolMask(list=map, mask=isNull)
duplicate = Custom[FamilyType.Duplicate](elementType=StandardFloorType)  # package Clockwork for Dynamo 2.x; Duplicates a family type; unwired: name
map_2 = List.Map(list=filterByBoolMask_3.in, function=duplicate)
toNumber = String.ToNumber(str=uniqueItems)

map_3 = List.Map(list=watch, function=concat)
name = FamilyType.Name(familyType=map_2)
byName_2 = ElementType.ByName(name=name)
count = List.Count(list=byName_2)
code_block_6 = CodeBlock(m=count) { lst = 0..m-1..1; lst2 = lst*0; }
code_block_7 = CodeBlock(a=toNumber) { (a/0.3048)/1000; }

# group: set floor thickness
python_script = Python(IN[0]=byName_2, IN[1]=code_block_6.lst2, IN[2]=code_block_7)  # IronPython2
# ---------- python_script.python (29 lines) ----------
import clr
clr.AddReference('RevitAPI')
from Autodesk.Revit.DB import *

clr.AddReference("RevitServices")
import RevitServices
from RevitServices.Persistence import DocumentManager
from RevitServices.Transactions import TransactionManager

doc = DocumentManager.Instance.CurrentDBDocument
famtypes = UnwrapElement(IN[0])
indices = IN[1]
widths = IN[2]
booleans = list()
counter = 0

TransactionManager.Instance.EnsureInTransaction(doc)
for ft in famtypes:
	try:
		cs = ft.GetCompoundStructure()
		cs.SetLayerWidth(indices[counter],widths[counter])
		ft.SetCompoundStructure(cs)
		booleans.append(True)
	except:
		booleans.append(False)
	counter += 1	
TransactionManager.Instance.TransactionTaskDone()

OUT = (famtypes,booleans)
# ----------------------------------------

passthrough = Custom[Passthrough](passThrough=map_3, waitFor=python_script)  # package Clockwork for Dynamo 2.x; Forces a sequential order of execution. The node wired into the output of the Passthrough node will be executed *after* the node wired into the waitFor input (e.g. important for some Revit operations). The value of the passThrough input will be passed on to the node wired into the output port of the Passthrough node.
byName_3 = FloorType.ByName(name=passthrough)
Level_To_Place = Input(Level_To_Place: var[]..[])
byOutlineTypeAndLevel = Floor.ByOutlineTypeAndLevel(outlineCurves=if_, floorType=byName_3, level=Level_To_Place)
Floors = Output(byOutlineTypeAndLevel)
PlaceOthers = Input(PlaceOthers: bool = true)
if_3 = If(test=PlaceOthers, true=filterByBoolMask.out, false=code_block_4)

# group: OTHER (WALLS, SLOPED ELEMENTS)
code_block_8 = CodeBlock(a=if_3) { a; }

# group: WALLS/SLOPED FLOOR TO DIRECTSHAPE
byPatch_2 = Surface.ByPatch(closedCurve=code_block_8)
toNumber_2 = String.ToNumber(str=filterByBoolMask_2.out)
thicken = Surface.Thicken(surface=byPatch_2, thickness=toNumber_2)
code_block_9 = CodeBlock { "Generic Models"; }
byName_4 = Category.ByName(name=code_block_9)
code_block_10 = CodeBlock { "default_material_concrete"; }
dyn2Calc_XFEM4U_Settings_3 = Custom[Dyn2Calc_XFEM4U_Settings](SearchSetting=code_block_10)
byName_5 = Material.ByName(name=dyn2Calc_XFEM4U_Settings_3.SettingFound)
code_block_11 = CodeBlock { "Struct4USlopedElement"; }
byGeometry = DirectShape.ByGeometry(geometry=thicken, category=byName_4, material=byName_5, name=code_block_11)

Other = Output(byGeometry)
