# Dynamo graph Revit to XFEM4U.dyn (Dynamo 2.10.1.3976)
# packages: Dyn2Calc.Struct4U 0.0.2, archi-lab.net 2023.213.1722, spring nodes 210.1.1, LunchBox for Dynamo 2017.1.28

code_block = CodeBlock { "C:/TEMP/test130.xml"; }
writeText = FileSystem.WriteText(filePath=code_block)  # unwired: text
code_block_2 = CodeBlock { "Grids"; }
byName = Category.ByName(name=code_block_2)
all_elements_of_category = ElementsOfCategory(Category=byName)
select_model_elements = DSModelElementsSelection()  # 7 picked in the model
dyn2Calc_XFEM4U_ExportXML = Custom[Dyn2Calc_XFEM4U_ExportXML](revitGrids=all_elements_of_category, analyticalElements=select_model_elements)  # package Dyn2Calc.Struct4U; Export XML-file from Revit
code_block_3 = CodeBlock { analyticalElements: var[]..[]; }  # unwired: analyticalElements
python_script = Python(IN[0]=code_block_3)  # CPython3
# ---------- python_script.python (89 lines) ----------
# Load the Python Standard and DesignScript Libraries
import sys
import System
import clr
clr.AddReference('ProtoGeometry')
from Autodesk.DesignScript.Geometry import *
from Autodesk.Revit.DB import *

import clr
clr.AddReference('RevitAPI')
from Autodesk.Revit.DB import *

clr.AddReference("RevitNodes")
import Revit
clr.ImportExtensions(Revit.Elements)

# The inputs to this node will be stored as a list in the IN variables.
##HELPERS

def GetCategory(item):
	if not item: return None, None
	objtype = item.GetType().ToString()
	returnID = None
	returnIDs = None
	returnCat = None
	returnBic = None
	if objtype == "Autodesk.Revit.DB.ParameterFilterElement": returnIDs = item.GetCategories()
	elif objtype == "Autodesk.Revit.DB.ViewSchedule": returnID = item.Definition.CategoryId
	elif objtype == "Autodesk.Revit.DB.Family": returnID = item.FamilyCategoryId
	elif objtype == "Autodesk.Revit.DB.GraphicsStyle":  returnID = item.GraphicsStyleCategory.Id
	elif objtype == "Revit.Application.Document":
		if item.IsFamilyDocument: 
			clr.AddReference("RevitServices")
			import RevitServices
			from RevitServices.Persistence import DocumentManager
			returnID = DocumentManager.Instance.CurrentDBDocument.OwnerFamily.FamilyCategoryId
	elif objtype == "Autodesk.Revit.DB.Category": 
		if item.Parent: returnID = item.Parent.Id
	elif hasattr(item, "Category"): returnID = item.Category.Id
	if returnID:
		returnBic = System.Enum.ToObject(BuiltInCategory, returnID.IntegerValue)
		try: returnCat =  Revit.Elements.Category.ById(returnID.IntegerValue)
		except: pass
	elif returnIDs:
		returnCat = []
		returnBic = []
		for returnID in returnIDs:
			returnBic.append(System.Enum.ToObject(BuiltInCategory, returnID.IntegerValue))
			try: returnCat.append(Revit.Elements.Category.ById(returnID.IntegerValue))
			except: returnCat.append(None)
		returnCat.sort()
	
	return returnCat
	

elem = UnwrapElement(IN[0])

cat = []
for i in elem:
	cat.append(GetCategory(i))

Walls = []
Floors = []
Nodes = []
Beams = []
Columns = []
Braces = []

for i,j in zip(cat,elem):
	if str(i) == "Analytical Walls":
		Walls.append(j)
	elif str(i) == "Analytical Floors":
		Floors.append(j)
	elif str(i) == "Analytical Nodes":
		Nodes.append(j)
	elif str(i) == "Analytical Beams":
		Beams.append(j)
	elif str(i) == "Analytical Columns":
		Columns.append(j)
	elif str(i) == "Analytical Braces":
		Braces.append(j)
		
#curves = []
#for i in Columns:
#	curves.append(i.Curves)

#OUT = curves

OUT = cat, Walls, Floors, Nodes, Beams, Columns, Braces
# ----------------------------------------
code_block_4 = CodeBlock(a=python_script) { a[0]; a[1]; a[2]; a[3]; a[4]; a[5]; a[6]; }

# group: MERGE COLUMNS, BEAMS AND BRACES
code_block_5 = CodeBlock(AnalyticalBeams=code_block_4.out4) { AnalyticalBeams: var[]..[]; }
code_block_6 = CodeBlock(AnalyticalColumns=code_block_4.out5) { AnalyticalColumns: var[]..[]; }
code_block_7 = CodeBlock(AnalyticalBraces=code_block_4.out6) { AnalyticalBraces: var[]..[]; }
join = List.Join(list0=code_block_5, list1=code_block_6, list2=code_block_7)
curves = Element.Curves(element=code_block_5)
curves_2 = Element.Curves(element=code_block_6)
curves_3 = Element.Curves(element=code_block_7)
join_2 = List.Join(list0=curves, list1=curves_2, list2=curves_3)
code_block_8 = CodeBlock { 1; 2; }
getItemAtIndex = List.GetItemAtIndex(list=join_2@L2, index=code_block_8.out0)
getItemAtIndex_2 = List.GetItemAtIndex(list=join_2@L2, index=code_block_8.out1)

# group: Look for unique sectiontypes
code_block_9 = CodeBlock { "Family Type"; }
getParameterValueByName = Element.GetParameterValueByName(element=join, parameterName=code_block_9)
name = FamilyType.Name(familyType=getParameterValueByName)
uniqueItems = List.UniqueItems(list=name)
uniqueItems_2 = List.UniqueItems(list=getParameterValueByName)

code_block_10 = CodeBlock { abbreviationTypeNameConcrete: string = "BB"; }
code_block_11 = CodeBlock { abbreviationTypeNameWood: string = "HB"; }

# group: SEPERATE STEEL, WOOD, CONCRETE
code_block_12 = CodeBlock { Separator; }  # unwired: Separator
split = String.Split(str=uniqueItems, separator0=code_block_12)
firstItem = List.FirstItem(list=split@L2)
code_block_13 = CodeBlock(ConcreteAbbraviation=code_block_10, WoodAbbraviation=code_block_11) { ConcreteAbbraviation; WoodAbbraviation; }
code_block_14 = CodeBlock { "other then steel"; ""; }

code_block_15 = CodeBlock { standardMaterialWood: string = "C18"; }

# group: WOOD SECTION
eq = firstItem == code_block_13.WoodAbbraviation
code_block_16 = CodeBlock { ""; }
filterByBoolMask = List.FilterByBoolMask(mask=eq)  # unwired: list
concat = String.Concat()  # unwired: string0, string1
code_block_17 = CodeBlock { "Width"; "Height"; }
getParameterValueByName_2 = Element.GetParameterValueByName(element=uniqueItems_2, parameterName=code_block_17.out0)
string_from_object = FromObject(object=getParameterValueByName_2)
code_block_18 = CodeBlock { ","; }
split_2 = String.Split(str=string_from_object, separator0=code_block_18)
firstItem_2 = List.FirstItem(list=split_2@L2)
code_block_19 = CodeBlock { " x "; }
concat_2 = String.Concat(string1=code_block_19)  # unwired: string0
getParameterValueByName_3 = Element.GetParameterValueByName(element=uniqueItems_2, parameterName=code_block_17.out1)
string_from_object_2 = FromObject(object=getParameterValueByName_3)
code_block_20 = CodeBlock { ","; }
split_3 = String.Split(str=string_from_object_2, separator0=code_block_20)
firstItem_3 = List.FirstItem(list=split_3@L2)
code_block_21 = CodeBlock { 2; 0; }
if_ = If(test=eq, true=code_block_21.out0, false=code_block_21.out1)
if_2 = If(test=eq, true=code_block_15, false=code_block_16)

if_3 = If(test=eq, true=code_block_15, false=code_block_16)
code_block_22 = CodeBlock()
# ---------- code_block_22.designscript (3 lines) ----------
//steel is 0 in XFEM4U
//concrete is 1
//timber is 2
# ----------------------------------------

# group: PROJECTINFORMATION
string = StringInput("<?xml version=\"1.0\" encoding=\"utf-8\"?>")  # graph input
code_block_23 = CodeBlock { "Project Information"; }
byName_2 = Category.ByName(name=code_block_23)
all_elements_of_category_2 = ElementsOfCategory(Category=byName_2)
code_block_24 = CodeBlock(t1=all_elements_of_category_2)
# ---------- code_block_24.designscript (11 lines) ----------
ProjectInfo = DSCore.List.FirstItem(t1);
String.Replace(String.Replace(ProjectInfo.GetParameterValueByName("Project Name"), "<", ""), ">", "");
ProjectInfo.GetParameterValueByName("Project Number");
"<Frame>";
"<ProjectName>";
"</ProjectName>";
"<ProjectNumber>";
"</ProjectNumber>";
"<ExportDateTime>";
"</ExportDateTime>";
"<XMLExportVersion> v4.0.30319 </XMLExportVersion>";
# ----------------------------------------
code_block_25 = CodeBlock { t1 = DSCore.DateTime.Now; }
string_from_object_3 = FromObject(object=code_block_25)
concat_3 = String.Concat(string0=string, string1=code_block_24.out3, string2=code_block_24.out4, string3=code_block_24.out1, string4=code_block_24.out5, string5=code_block_24.out6, string6=code_block_24.out2, string7=code_block_24.out7, string8=code_block_24.out8, string9=string_from_object_3, string10=code_block_24.out9, string11=code_block_24.out10)

# group: GET ANALYTICAL FLOORS AND WALLS TO SURFACE
join_3 = List.Join(list0=code_block_4.out1, list1=code_block_4.out2)
geometry = Element.Geometry(element=join_3)
firstItem_4 = List.FirstItem(list=geometry@L2)

isNull = Object.IsNull(object=firstItem_4)
filterByBoolMask_2 = List.FilterByBoolMask(list=firstItem_4, mask=isNull)
code_block_26 = CodeBlock { platesSpacingSegmentation: int = 200; }

# group: separate line and other curved objects so that curved objects can be separated to lines. Split curved objects to lines
perimeterCurves = Surface.PerimeterCurves(surface=filterByBoolMask_2.out)
direction = Line.Direction(line=perimeterCurves)
isNull_2 = Object.IsNull(object=direction)
length = Curve.Length(curve=perimeterCurves)
code_block_27 = CodeBlock(a=length, spacing=code_block_26) { a/spacing; }
round = Math.Round(number=code_block_27)
X = Vector.X(vector=direction)
code_block_28 = CodeBlock { 0; }
mul = X * code_block_28
code_block_29 = CodeBlock { 1; }
add = mul + code_block_29
if_4 = If(test=isNull_2, true=round, false=add)
code_block_30 = CodeBlock(x=if_4) { 0..1..#x; }
pointAtParameter = Curve.PointAtParameter(curve=perimeterCurves, param=code_block_30)

code_block_31 = CodeBlock(pointlist=pointAtParameter) { pointlist; }
code_block_32 = CodeBlock(AnalyticalNodes=code_block_4.out3) { AnalyticalNodes: var[]..[]; }

# group: ANALYTICAL NODES AND PLATENODES COMBINAED
code_block_33 = CodeBlock(A=code_block_31) { A; }
flatten = List.Flatten(list=code_block_33)
point = ReferencePoint.Point(referencePoint=code_block_32)
join_4 = List.Join(list0=flatten, list1=point)

clear_list = Custom[Clear List](input=join_4)  # package archi-lab.net; This node will remove all Null and Empty Lists from any list.

# group (continued): ANALYTICAL NODES AND PLATENODES COMBINAED
count = List.Count(list=clear_list)
code_block_34 = CodeBlock(x=count) { 1..x..1; }

code_block_35 = CodeBlock { dx: double = 0; }
code_block_36 = CodeBlock { dy: double = 0; }

# group: NODES
string_from_object_4 = FromObject(object=code_block_34)
code_block_37 = CodeBlock { "<Number>"; "</Number>"; }
concat_4 = String.Concat(string0=code_block_37.out0, string2=code_block_37.out1)  # unwired: string1
map = List.Map(list=string_from_object_4, function=concat_4)
code_block_38 = CodeBlock(dx=code_block_35, dy=code_block_36) { -dx; -dy; }
translate = Geometry.Translate(geometry=clear_list, xTranslation=code_block_38.out0, yTranslation=code_block_38.out1)
code_block_39 = CodeBlock(NODES=translate) { t1 = NODES.X; X = Math.Round(t1); Y = Math.Round(NODES.Y); Z = Math.Round(NODES.Z); }
string_from_object_5 = FromObject(object=code_block_39.X)
code_block_40 = CodeBlock(t3=string_from_object_5) { t2 = String.Split(t3, [","]); t4 = DSCore.List.FirstItem(t2@-2<1>); }
code_block_41 = CodeBlock { "<X>"; "</X>"; }
concat_5 = String.Concat(string0=code_block_41.out0, string2=code_block_41.out1)  # unwired: string1
map_2 = List.Map(list=code_block_40.t4, function=concat_5)
string_from_object_6 = FromObject(object=code_block_39.Y)
code_block_42 = CodeBlock(t3=string_from_object_6) { t2 = String.Split(t3, [","]); t4 = DSCore.List.FirstItem(t2@-2<1>); }
code_block_43 = CodeBlock { "<Y>"; "</Y>"; }
concat_6 = String.Concat(string0=code_block_43.out0, string2=code_block_43.out1)  # unwired: string1
map_3 = List.Map(list=code_block_42.t4, function=concat_6)
string_from_object_7 = FromObject(object=code_block_39.Z)
code_block_44 = CodeBlock(t3=string_from_object_7) { t2 = String.Split(t3, [","]); t4 = DSCore.List.FirstItem(t2@-2<1>); }
code_block_45 = CodeBlock { "<Z>"; "</Z>"; }
concat_7 = String.Concat(string0=code_block_45.out0, string2=code_block_45.out1)  # unwired: string1
map_4 = List.Map(list=code_block_44.t4, function=concat_7)
create = List.Create(item0=map, item1=map_2, item2=map_3, item3=map_4)
transpose = List.Transpose(lists=create)
flatten_2 = List.Flatten(list=transpose)
string_from_array = FromArray(array=flatten_2)
code_block_46 = CodeBlock { ","; ""; "{"; "}"; "["; }

# group: XML <NODES>
code_block_47 = CodeBlock { "<Nodes>"; "</Nodes>"; }
replace = String.Replace(string=string_from_array, searchFor=code_block_46.out0, replaceWith=code_block_46.out1)
replace_2 = String.Replace(string=replace, searchFor=code_block_46.out2, replaceWith=code_block_46.out1)
replace_3 = String.Replace(string=replace_2, searchFor=code_block_46.out3, replaceWith=code_block_46.out1)
concat_8 = String.Concat(string0=code_block_47.out0, string1=replace_3, string2=code_block_47.out1)

code_block_48 = CodeBlock { RevitGrids: var[]..[]; }  # unwired: RevitGrids
code_block_49 = CodeBlock(RevitGrids=code_block_48) { RevitGrids; }
curve = Grid.Curve(grid=code_block_49)
code_block_50 = CodeBlock { "Name"; }
getParameterValueByName_4 = Element.GetParameterValueByName(element=code_block_49, parameterName=code_block_50)

# group: X-GRID ORDER BY COORDINATE CALCULATE DY
direction_2 = Line.Direction(line=curve)
YAxis = Vector.YAxis()
isParallel = Vector.IsParallel(vector=direction_2, other=YAxis)
filterByBoolMask_3 = List.FilterByBoolMask(list=curve, mask=isParallel)
startPoint = Curve.StartPoint(curve=filterByBoolMask_3.in)
X_2 = Point.X(point=startPoint)
sort = List.Sort(list=X_2)
code_block_51 = CodeBlock { -1; 0; }
dropItems = List.DropItems(list=sort, amount=code_block_51.out0)
addItemToFront = List.AddItemToFront(item=code_block_51.out1, list=dropItems)
sub = sort - addItemToFront
string_from_object_8 = FromObject(object=sub)
code_block_52 = CodeBlock { ","; }
split_4 = String.Split(str=string_from_object_8, separator0=code_block_52)
firstItem_5 = List.FirstItem(list=split_4@L2)
string_from_array_2 = FromArray(array=firstItem_5)
code_block_53 = CodeBlock(t7=string_from_array_2) { t6 = String.Replace(t7, ",", " "); t8 = String.Replace(t6, "{", ""); t9 = String.Replace(t8, "}", ""); }
filterByBoolMask_4 = List.FilterByBoolMask(list=getParameterValueByName_4, mask=isParallel)
byKeysValues = Custom[Springs.Dictionary.ByKeysValues](keys=X_2, values=filterByBoolMask_4.in, searchKeys=sort)  # package spring nodes; Dictionaries are an incredibly powerful tool for making associative sets between two equal length lists. The first list must be of unique strings (or numbers) and will be the key and the second list will be the matching values (it can be made up of geometry, elements, even other lists) The search keys list will provide the corresponding value to the input key.
string_from_array_3 = FromArray(array=byKeysValues)
code_block_54 = CodeBlock(t7=string_from_array_3) { t6 = String.Replace(t7, ",", " "); t8 = String.Replace(t6, "{", ""); t9 = String.Replace(t8, "}", ""); }

# group: XML X-GRID
code_block_55 = CodeBlock { "<X>"; "</X>"; "<X_Lable>"; "</X_Lable>"; }
concat_9 = String.Concat(string0=code_block_55.out0, string1=code_block_53.t9, string2=code_block_55.out1, string3=code_block_55.out2, string4=code_block_54.t9, string5=code_block_55.out3)

# group: Y-GRID ORDER BY COORDINATE CALCULATE DX
direction_3 = Line.Direction(line=curve)
XAxis = Vector.XAxis()
isParallel_2 = Vector.IsParallel(vector=direction_3, other=XAxis)
filterByBoolMask_5 = List.FilterByBoolMask(list=curve, mask=isParallel_2)
startPoint_2 = Curve.StartPoint(curve=filterByBoolMask_5.in)
Y = Point.Y(point=startPoint_2)
sort_2 = List.Sort(list=Y)
code_block_56 = CodeBlock { -1; 0; }
dropItems_2 = List.DropItems(list=sort_2, amount=code_block_56.out0)
addItemToFront_2 = List.AddItemToFront(item=code_block_56.out1, list=dropItems_2)
sub_2 = sort_2 - addItemToFront_2
string_from_object_9 = FromObject(object=sub_2)
code_block_57 = CodeBlock { ","; }
split_5 = String.Split(str=string_from_object_9, separator0=code_block_57)
firstItem_6 = List.FirstItem(list=split_5@L2)
string_from_array_4 = FromArray(array=firstItem_6)
code_block_58 = CodeBlock(t7=string_from_array_4) { t6 = String.Replace(t7, ",", " "); t8 = String.Replace(t6, "{", ""); t9 = String.Replace(t8, "}", ""); }
filterByBoolMask_6 = List.FilterByBoolMask(list=getParameterValueByName_4, mask=isParallel_2)
byKeysValues_2 = Custom[Springs.Dictionary.ByKeysValues](keys=Y, values=filterByBoolMask_6.in, searchKeys=sort_2)
string_from_array_5 = FromArray(array=byKeysValues_2)
code_block_59 = CodeBlock(t7=string_from_array_5) { t6 = String.Replace(t7, ",", " "); t8 = String.Replace(t6, "{", ""); t9 = String.Replace(t8, "}", ""); }

# group: XML Y-GRID
code_block_60 = CodeBlock { "<Y>"; "</Y>"; "<Y_Lable>"; "</Y_Lable>"; }
concat_10 = String.Concat(string0=code_block_60.out0, string1=code_block_58.t9, string2=code_block_60.out1, string3=code_block_60.out2, string4=code_block_59.t9, string5=code_block_60.out3)

# group: XML Z-GRID
code_block_61 = CodeBlock { "<Z>"; "</Z>"; "<Z_Lable>"; "</Z_Lable>"; "0"; "0+"; }
concat_11 = String.Concat(string0=code_block_61.out0, string1=code_block_61.out4, string2=code_block_61.out1, string3=code_block_61.out2, string4=code_block_61.out5, string5=code_block_61.out3)

# group: XML GRIDS
code_block_62 = CodeBlock { "<Grids>"; "</Grids>"; }
concat_12 = String.Concat(string0=code_block_62.out0, string1=concat_9, string2=concat_10, string3=concat_11, string4=code_block_62.out1)

# group: STARTPOINT ENDPOINT OF BEAM
endPoint = Curve.EndPoint(curve=getItemAtIndex)
startPoint_3 = Curve.StartPoint(curve=getItemAtIndex_2)

# group: SEARCH THE STARTNODE BELONGING TO THE BEAM
doesIntersect = Geometry.DoesIntersect(geometry=endPoint, other=clear_list, lacing=CrossProduct)
boolean = BoolSelector(true)  # graph input
indexOf = List.IndexOf(list=doesIntersect@L2, element=boolean)
code_block_63 = CodeBlock(x=indexOf) { x+1; }

count_2 = List.Count(list=code_block_63)
code_block_64 = CodeBlock(x=count_2) { 1..x..1; }
string_from_object_10 = FromObject(object=code_block_64)
code_block_65 = CodeBlock(t3=string_from_object_10) { t2 = String.Split(t3, [","]); t4 = DSCore.List.FirstItem(t2@-2<1>); }
code_block_66 = CodeBlock { "<Number>"; "</Number>"; }
concat_13 = String.Concat(string0=code_block_66.out0, string2=code_block_66.out1)  # unwired: string1
map_5 = List.Map(list=code_block_65.t4, function=concat_13)
string_from_object_11 = FromObject(object=code_block_63)
code_block_67 = CodeBlock(t3=string_from_object_11) { t2 = String.Split(t3, [","]); t4 = DSCore.List.FirstItem(t2@-2<1>); }
code_block_68 = CodeBlock { "<From_node_number>"; "</From_node_number>"; }
concat_14 = String.Concat(string0=code_block_68.out0, string2=code_block_68.out1)  # unwired: string1
map_6 = List.Map(list=code_block_67.t4, function=concat_14)

# group: SEARCH THE ENDNODE BELONGING TO THE BEAM
doesIntersect_2 = Geometry.DoesIntersect(geometry=startPoint_3, other=clear_list, lacing=CrossProduct)
boolean_2 = BoolSelector(true)  # graph input
indexOf_2 = List.IndexOf(list=doesIntersect_2@L2, element=boolean_2)
code_block_69 = CodeBlock(x=indexOf_2) { x+1; }

string_from_object_12 = FromObject(object=code_block_69)
code_block_70 = CodeBlock(t3=string_from_object_12) { t2 = String.Split(t3, [","]); t4 = DSCore.List.FirstItem(t2@-2<1>); }
code_block_71 = CodeBlock { "<To_node_number>"; "</To_node_number>"; }
concat_15 = String.Concat(string0=code_block_71.out0, string2=code_block_71.out1)  # unwired: string1
map_7 = List.Map(list=code_block_70.t4, function=concat_15)

# group: Rotation
code_block_72 = CodeBlock { "Cross-Section Rotation"; }
getParameterValueByName_5 = Element.GetParameterValueByName(element=join, parameterName=code_block_72)
string_from_object_13 = FromObject(object=getParameterValueByName_5)
code_block_73 = CodeBlock(t3=string_from_object_13) { t2 = String.Split(t3, [","]); t4 = DSCore.List.FirstItem(t2@-2<1>); }
code_block_74 = CodeBlock { "<Angle>"; "</Angle>"; }
concat_16 = String.Concat(string0=code_block_74.out0, string2=code_block_74.out1)  # unwired: string1
map_8 = List.Map(list=code_block_73.t4, function=concat_16)

indexOf_3 = List.IndexOf(list=uniqueItems, element=name)
code_block_75 = CodeBlock(a=indexOf_3) { a+1; }
string_from_object_14 = FromObject(object=code_block_75)
code_block_76 = CodeBlock()
# ---------- code_block_76.designscript (7 lines) ----------
"<Angle_profile>0</Angle_profile>";
"<Layer>1</Layer>";
"<Profile_number>";
"1";
"</Profile_number>";
"<Z>0</Z>";
"<Top_Center_Bottom>Center</Top_Center_Bottom>";
# ----------------------------------------
concat_17 = String.Concat(string0=code_block_76.out0, string1=code_block_76.out1, string2=code_block_76.out2)  # unwired: string3
map_9 = List.Map(list=string_from_object_14, function=concat_17)
concat_18 = String.Concat(string0=code_block_76.out4, string1=code_block_76.out5, string2=code_block_76.out6)
count_3 = List.Count(list=map_9)
ofRepeatedItem = List.OfRepeatedItem(item=concat_18, amount=count_3)
create_2 = List.Create(item0=map_5, item1=map_6, item2=map_7, item3=map_8, item4=map_9, item5=ofRepeatedItem)
transpose_2 = List.Transpose(lists=create_2)
flatten_3 = List.Flatten(list=transpose_2)
string_from_array_6 = FromArray(array=flatten_3)
code_block_77 = CodeBlock { ","; ""; "{"; "}"; }

# group: XML <BEAMS>
code_block_78 = CodeBlock { "<Beams>"; "</Beams>"; }
replace_4 = String.Replace(string=string_from_array_6, searchFor=code_block_77.out0, replaceWith=code_block_77.out1)
replace_5 = String.Replace(string=replace_4, searchFor=code_block_77.out2, replaceWith=code_block_77.out1)
replace_6 = String.Replace(string=replace_5, searchFor=code_block_77.out3, replaceWith=code_block_77.out1)
concat_19 = String.Concat(string0=code_block_78.out0, string1=replace_6, string2=code_block_78.out1)

code_block_79 = CodeBlock { "null"; }
contains = String.Contains(str=concat_19, searchFor=code_block_79)
code_block_80 = CodeBlock(nobeams=contains) { nobeams; }
code_block_81 = CodeBlock { "<Profiles>"; "</Profiles>"; }
concat_20 = String.Concat(string0=code_block_81.out0, string1=code_block_81.out1)
concat_21 = String.Concat()  # unwired: string0, string1, string2, string3, string4, string5
count_4 = List.Count(list=uniqueItems)
code_block_82 = CodeBlock(n=count_4) { 1..n; }
string_from_object_15 = FromObject(object=code_block_82)
code_block_83 = CodeBlock { "<Number>"; "1"; "</Number>"; }
concat_22 = String.Concat(string0=code_block_83.out0, string2=code_block_83.out2)  # unwired: string1
map_10 = List.Map(list=string_from_object_15, function=concat_22)
concat_23 = String.Concat()  # unwired: string0, string1, string2
string_from_object_16 = FromObject(object=firstItem_2)

# group (continued): WOOD SECTION
map_11 = List.Map(list=string_from_object_16, function=concat_2)

string_from_object_17 = FromObject(object=firstItem_3)

# group (continued): WOOD SECTION
combine = List.Combine(combineFunction=concat, list0=map_11, list1=string_from_object_17)

if_5 = If(test=eq, true=combine, false=code_block_16)
code_block_84 = CodeBlock { ""; }
code_block_85 = CodeBlock { unknownProfile: string = "HE1000M"; }
code_block_86 = CodeBlock(as=code_block_85) { as; }
code_block_87 = CodeBlock { "<Profile_name>"; "1"; "</Profile_name>"; }
concat_24 = String.Concat(string0=code_block_87.out0, string2=code_block_87.out2)  # unwired: string1
code_block_88 = CodeBlock { "<Material_type>"; "1"; "</Material_type>"; }
concat_25 = String.Concat(string0=code_block_88.out0, string2=code_block_88.out2)  # unwired: string1
concat_26 = String.Concat()  # unwired: string0, string1, string2
code_block_89 = CodeBlock { standardMaterialSteel: string = "S235"; }
code_block_90 = CodeBlock { standardMaterialConcrete: string = "C20/25"; }

# group: CONCRETE SECTION
eq_2 = firstItem == code_block_13.ConcreteAbbraviation
filterByBoolMask_7 = List.FilterByBoolMask(list=uniqueItems_2, mask=eq_2)
code_block_91 = CodeBlock { ""; }
code_block_92 = CodeBlock { 1; 0; }
if_6 = If(test=eq_2, true=code_block_92.out0, false=code_block_92.out1)
if_7 = If(test=eq_2, true=code_block_90, false=code_block_91)
concat_27 = String.Concat()  # unwired: string0, string1
code_block_93 = CodeBlock { "Width"; "Height"; }
getParameterValueByName_6 = Element.GetParameterValueByName(element=uniqueItems_2, parameterName=code_block_93.out1)
string_from_object_18 = FromObject(object=getParameterValueByName_6)
code_block_94 = CodeBlock(t1=string_from_object_18) { str2 = String.Split(t1, [","]); t2 = List.FirstItem(str2@L2<1>); }
code_block_95 = CodeBlock { "<Profile_shape>1</Profile_shape>"; "<h>"; "</h>"; "<b>"; "</b>"; }
concat_28 = String.Concat(string0=code_block_95.out0, string1=code_block_95.out1)  # unwired: string2
getParameterValueByName_7 = Element.GetParameterValueByName(element=uniqueItems_2, parameterName=code_block_93.out0)
string_from_object_19 = FromObject(object=getParameterValueByName_7)
code_block_96 = CodeBlock(t1=string_from_object_19) { str2 = String.Split(t1, [","]); t2 = List.FirstItem(str2@L2<1>); }
concat_29 = String.Concat(string0=code_block_95.out2, string1=code_block_95.out3, string3=code_block_95.out4)  # unwired: string2
code_block_97 = CodeBlock { ""; }

# group (continued): SEPERATE STEEL, WOOD, CONCRETE
python_script_2 = Python(IN[0]=uniqueItems, IN[1]=eq_2, IN[2]=eq)  # IronPython2
# ---------- python_script_2.python (13588 lines) ----------
XframeName =(
'HD260x541' ,
'HD260x682' ,
'HD260x93' ,
'HD260x114' ,
'HD260x142' ,
'HD260x172' ,
'HD260x225' ,
'HD260x299' ,
'HD320x742' ,
'HD320x976' ,
'HD320x127' ,
'HD320x158' ,
'HD320x198' ,
'HD320x245' ,
'HD320x300' ,
'HD320x368' ,
'HD320x451' ,
'HD360x134' ,
'HD360x147' ,
'HD360x162' ,
'HD360x179' ,
'HD360x196' ,
'HD400x187' ,
'HD400x216' ,
'HD400x237' ,
'HD400x262' ,
'HD400x287' ,
'HD400x314' ,
'HD400x347' ,
'HD400x382' ,
'HD400x421' ,
'HD400x463' ,
'HD400x509' ,
'HD400x551' ,
'HD400x592' ,
'HD400x634' ,
'HD400x677' ,
'HD400x744' ,
'HD400x818' ,
'HD400x900' ,
'HD400x990' ,
'HD400x1086' ,
'HE100A' ,
'HE120A' ,
'HE140A' ,
'HE160A' ,
'HE180A' ,
'HE200A' ,
'HE220A' ,
'HE240A' ,
'HE260A' ,
'HE280A' ,
'HE300A' ,
'HE320A' ,
'HE340A' ,
'HE360A' ,
'HE400A' ,
'HE450A' ,
'HE500A' ,
'HE550A' ,
'HE600A' ,
'HE650A' ,
'HE700A' ,
'HE800A' ,
'HE900A' ,
'HE1000A' ,
'HE100AA' ,
'HE120AA' ,
'HE140AA' ,
'HE160AA' ,
'HE180AA' ,
'HE200AA' ,
'HE220AA' ,
'HE240AA' ,
'HE260AA' ,
'HE280AA' ,
'HE300AA' ,
'HE320AA' ,
'HE340AA' ,
'HE360AA' ,
'HE400AA' ,
'HE450AA' ,
'HE500AA' ,
'HE550AA' ,
'HE600AA' ,
'HE650AA' ,
'HE700AA' ,
'HE800AA' ,
'HE900AA' ,
'HE1000AA' ,
'HE100B' ,
'HE120B' ,
'HE140B' ,
'HE160B' ,
'HE180B' ,
'HE200B' ,
'HE220B' ,
'HE240B' ,
'HE260B' ,
'HE280B' ,
'HE300B' ,
'HE320B' ,
'HE340B' ,
'HE360B' ,
'HE400B' ,
'HE450B' ,
'HE500B' ,
'HE550B' ,
'HE600B' ,
'HE650B' ,
'HE700B' ,
'HE800B' ,
'HE900B' ,
'HE1000B' ,
'HE100M' ,
'HE120M' ,
'HE140M' ,
'HE160M' ,
'HE180M' ,
'HE200M' ,
'HE220M' ,
'HE240M' ,
'HE260M' ,
'HE280M' ,
'HE300M' ,
'HE320M' ,
'HE340M' ,
'HE360M' ,
'HE400M' ,
'HE450M' ,
'HE500M' ,
'HE550M' ,
'HE600M' ,
'HE650M' ,
'HE700M' ,
'HE800M' ,
'HE900M' ,
'HE1000M' ,
'HE400x299' ,
'HE400x347' ,
'HE400x403' ,
'HE400x468' ,
'HE450x312' ,
'HE450x368' ,
'HE450x436' ,
'HE450x519' ,
'HE500x320' ,
'HE500x379' ,
'HE500x451' ,
'HE500x534' ,
'HE550x330' ,
'HE550x393' ,
'HE550x466' ,
'HE550x552' ,
'HE600x340' ,
'HE600x402' ,
'HE600x477' ,
'HE600x564' ,
'HE650x347' ,
'HE650x410' ,
'HE650x487' ,
'HE650x579' ,
'HE700x356' ,
'HE700x421' ,
'HE700x500' ,
'HE700x594' ,
'HE800x377' ,
'HE800x448' ,
'HE800x531' ,
'HE800x627' ,
'HE900x396' ,
'HE900x471' ,
'HE900x557' ,
'HE900x661' ,
'HE1000x415' ,
'HE1000x494' ,
'HE1000x584' ,
'HE1000x694' ,
'HL1000AA' ,
'HL1000A' ,
'HL1000B' ,
'HL1000M' ,
'HL1000x477' ,
'HL1000x554' ,
'HL1000x642' ,
'HL1000x748' ,
'HL1100A' ,
'HL1100B' ,
'HL1100M' ,
'HL1100R' ,
'HP220x57.2' ,
'HP260x75' ,
'HP260x87.3' ,
'HP305x88' ,
'HP305x95' ,
'HP305x110' ,
'HP305x126' ,
'HP305x149' ,
'HP305x180' ,
'HP305x186' ,
'HP305x223' ,
'HP320x88.5' ,
'HP320x103' ,
'HP320x117' ,
'HP320x147' ,
'HP320x184' ,
'HP360x84.3' ,
'HP360x109' ,
'HP360x133' ,
'HP360x152' ,
'HP360x174' ,
'HP360x180' ,
'HP400x122' ,
'HP400x140' ,
'HP400x158' ,
'HP400x176' ,
'HP400x194' ,
'HP400x213' ,
'HP400x231' ,
'INP80' ,
'INP100' ,
'INP120' ,
'INP140' ,
'INP160' ,
'INP180' ,
'INP200' ,
'INP220' ,
'INP240' ,
'INP260' ,
'INP280' ,
'INP300' ,
'INP320' ,
'INP340' ,
'INP360' ,
'INP380' ,
'INP400' ,
'INP425' ,
'INP450' ,
'INP475' ,
'INP500' ,
'INP550' ,
'INP600' ,
'IPE80' ,
'IPE100' ,
'IPE120' ,
'IPE140' ,
'IPE160' ,
'IPE180' ,
'IPE200' ,
'IPE220' ,
'IPE240' ,
'IPE270' ,
'IPE300' ,
'IPE330' ,
'IPE360' ,
'IPE400' ,
'IPE450' ,
'IPE500' ,
'IPE550' ,
'IPE600' ,
'IPE750x137' ,
'IPE750x147' ,
'IPE750x173' ,
'IPE750x196' ,
'IPEA80' ,
'IPEA100' ,
'IPEA120' ,
'IPEA140' ,
'IPEA160' ,
'IPEA180' ,
'IPEA200' ,
'IPEA220' ,
'IPEA240' ,
'IPEA270' ,
'IPEA300' ,
'IPEA330' ,
'IPEA360' ,
'IPEA400' ,
'IPEA450' ,
'IPEA500' ,
'IPEA550' ,
'IPEA600' ,
'IPEO180' ,
'IPEO200' ,
'IPEO220' ,
'IPEO240' ,
'IPEO270' ,
'IPEO300' ,
'IPEO330' ,
'IPEO360' ,
'IPEO400' ,
'IPEO450' ,
'IPEO500' ,
'IPEO550' ,
'IPEO600' ,
'IPEV400' ,
'IPEV450' ,
'IPEV500' ,
'IPEV550' ,
'IPEV600' ,
'UB178x102x19' ,
'UB203x102x23' ,
'UB203x133x25' ,
'UB203x133x30' ,
'UB254x102x22' ,
'UB254x102x25' ,
'UB254x102x28' ,
'UB254x146x31' ,
'UB254x146x37' ,
'UB254x146x43' ,
'UB305x165x40' ,
'UB305x165x46' ,
'UB305x165x54' ,
'UB356x171x45' ,
'UB356x171x51' ,
'UB356x171x57' ,
'UB356x171x67' ,
'UB406x178x54' ,
'UB406x178x60' ,
'UB406x178x67' ,
'UB406x178x74' ,
'UB457x152x52' ,
'UB457x152x60' ,
'UB457x152x67' ,
'UB457x152x74' ,
'UB457x152x82' ,
'UB457x191x67' ,
'UB457x191x74' ,
'UB457x191x82' ,
'UB457x191x89' ,
'UB457x191x98' ,
'UB533x210x82' ,
'UB533x210x92' ,
'UB533x210x101' ,
'UB533x210x109' ,
'UB533x210x122' ,
'UB610x229x101' ,
'UB610x229x113' ,
'UB610x229x125' ,
'UB610x229x140' ,
'UB610x305x149' ,
'UB610x305x179' ,
'UB610x305x238' ,
'UB686x254x125' ,
'UB686x254x140' ,
'UB686x254x152' ,
'UB686x254x170' ,
'UB762x267x147' ,
'UB762x267x173' ,
'UB762x267x197' ,
'UB838x292x176' ,
'UB838x292x194' ,
'UB838x292x226' ,
'UB914x305x201' ,
'UB914x305x224' ,
'UB914x305x253' ,
'UB914x305x289' ,
'UB914x419x343' ,
'UB914x419x388' ,
'UC152x152x23' ,
'UC152x152x30' ,
'UC152x152x37' ,
'UC203x203x46' ,
'UC203x203x52' ,
'UC203x203x60' ,
'UC203x203x71' ,
'UC203x203x86' ,
'UC254x254x73' ,
'UC254x254x89' ,
'UC254x254x107' ,
'UC254x254x132' ,
'UC254x254x167' ,
'UC305x305x97' ,
'UC305x305x118' ,
'UC305x305x137' ,
'UC305x305x158' ,
'UC305x305x198' ,
'UC305x305x240' ,
'UC305x305x283' ,
'UC356x368x129' ,
'UC356x368x153' ,
'UC356x368x177' ,
'UC356x368x202' ,
'UC356x406x235' ,
'UC356x406x287' ,
'UC356x406x340' ,
'UC356x406x393' ,
'UC356x406x467' ,
'UC356x406x551' ,
'UC356x406x634' ,
'W360x370x134' ,
'W360x370x147' ,
'W360x370x162' ,
'W360x370x179' ,
'W360x370x196' ,
'W360x410x216' ,
'W360x410x237' ,
'W360x410x262' ,
'W360x410x287' ,
'W360x410x314' ,
'W360x410x347' ,
'W360x410x382' ,
'W360x410x421' ,
'W360x410x463' ,
'W360x410x509' ,
'W360x410x551' ,
'W360x410x592' ,
'W360x410x634' ,
'W360x410x677' ,
'W360x410x744' ,
'W360x410x818' ,
'W360x410x900' ,
'W360x410x990' ,
'W360x410x1086' ,
'W610x325x155' ,
'W610x325x174' ,
'W610x325x195' ,
'W610x325x217' ,
'W610x325x241' ,
'W610x325x285' ,
'W610x325x341' ,
'W610x325x415' ,
'W610x325x498' ,
'W610x325x608' ,
'W610x325x732' ,
'W690x360x217' ,
'W690x360x240' ,
'W690x360x265' ,
'W690x360x323' ,
'W690x360x384' ,
'W690x360x457' ,
'W690x360x548' ,
'W690x360x667' ,
'W690x360x802' ,
'W760x265x147' ,
'W760x265x173' ,
'W760x265x196' ,
'W760x380x257' ,
'W760x380x284' ,
'W760x380x314' ,
'W760x380x389' ,
'W760x380x484' ,
'W760x380x582' ,
'W760x380x710' ,
'W840x400x299' ,
'W840x400x329' ,
'W840x400x359' ,
'W840x400x433' ,
'W840x400x527' ,
'W920x420x342' ,
'W920x420x365' ,
'W920x420x387' ,
'W920x420x417' ,
'W920x420x446' ,
'W920x420x534' ,
'W920x420x653' ,
'W920x420x784' ,
'W920x420x967' ,
'W920x420x1188' ,
'W1000x300x222' ,
'W1000x300x249' ,
'W1000x300x272' ,
'W1000x300x314' ,
'W1000x300x349' ,
'W1000x400x258' ,
'W1000x400x296' ,
'W1000x400x321' ,
'W1000x400x371' ,
'W1000x400x412' ,
'W1100x400x343' ,
'W1100x400x390' ,
'W1100x400x433' ,
'W1100x400x499' ,
'L20x20x3' ,
'L25x25x3' ,
'L25x25x4' ,
'L30x30x3' ,
'L30x30x4' ,
'L35x35x35' ,
'L35x35x5' ,
'L40x40x3' ,
'L40x40x4' ,
'L40x40x5' ,
'L45x45x4' ,
'L45x45x5' ,
'L50x50x4' ,
'L50x50x5' ,
'L50x50x6' ,
'L50x50x8' ,
'L60x60x5' ,
'L60x60x6' ,
'L60x60x8' ,
'L70x70x6' ,
'L70x70x7' ,
'L75x75x7' ,
'L75x75x8' ,
'L80x80x6' ,
'L80x80x8' ,
'L80x80x10' ,
'L90x90x7' ,
'L90x90x9' ,
'L100x100x8' ,
'L100x100x10' ,
'L100x100x12' ,
'L110x110x10' ,
'L120x120x10' ,
'L120x120x12' ,
'L120x120x15' ,
'L130x130x12' ,
'L140x140x10' ,
'L140x140x13' ,
'L150x150x10' ,
'L150x150x12' ,
'L150x150x15' ,
'L150x150x18' ,
'L160x160x15' ,
'L180x180x16' ,
'L180x180x18' ,
'L200x200x16' ,
'L200x200x18' ,
'L200x200x20' ,
'L200x200x24' ,
'L30x20x3' ,
'L30x20x4' ,
'L40x25x4' ,
'L50x30x4' ,
'L50x30x5' ,
'L60x30x5' ,
'L60x40x5' ,
'L60x40x6' ,
'L70x50x6' ,
'L75x50x7' ,
'L80x40x6' ,
'L80x40x8' ,
'L80x60x7' ,
'L80x65x8' ,
'L90x60x8' ,
'L100x50x6' ,
'L100x50x8' ,
'L100x65x9' ,
'L120x80x8' ,
'L120x80x10' ,
'L130x65x8' ,
'L130x65x10' ,
'L150x75x9' ,
'L150x75x11' ,
'L150x100x10' ,
'L150x100x12' ,
'L160x80x10' ,
'L160x80x12' ,
'L180x90x10' ,
'L200x100x10' ,
'L200x100x12' ,
'L200x100x14' ,
'HFRHS50x25x25' ,
'HFRHS50x25x3' ,
'HFRHS50x30x25' ,
'HFRHS50x30x3' ,
'HFRHS50x30x4' ,
'HFRHS50x30x5' ,
'HFRHS60x40x25' ,
'HFRHS60x40x3' ,
'HFRHS60x40x4' ,
'HFRHS60x40x5' ,
'HFRHS60x40x6' ,
'HFRHS80x40x3' ,
'HFRHS80x40x4' ,
'HFRHS80x40x5' ,
'HFRHS80x40x6' ,
'HFRHS80x40x63' ,
'HFRHS80x40x8' ,
'HFRHS90x50x3' ,
'HFRHS90x50x4' ,
'HFRHS90x50x5' ,
'HFRHS90x50x6' ,
'HFRHS90x50x63' ,
'HFRHS90x50x8' ,
'HFRHS100x50x3' ,
'HFRHS100x50x4' ,
'HFRHS100x50x5' ,
'HFRHS100x50x6' ,
'HFRHS100x50x63' ,
'HFRHS100x50x8' ,
'HFRHS100x60x3' ,
'HFRHS100x60x4' ,
'HFRHS100x60x5' ,
'HFRHS100x60x6' ,
'HFRHS100x60x63' ,
'HFRHS100x60x8' ,
'HFRHS120x60x4' ,
'HFRHS120x60x5' ,
'HFRHS120x60x6' ,
'HFRHS120x60x63' ,
'HFRHS120x60x8' ,
'HFRHS120x60x10' ,
'HFRHS120x80x4' ,
'HFRHS120x80x5' ,
'HFRHS120x80x6' ,
'HFRHS120x80x63' ,
'HFRHS120x80x8' ,
'HFRHS120x80x10' ,
'HFRHS140x80x4' ,
'HFRHS140x80x5' ,
'HFRHS140x80x6' ,
'HFRHS140x80x63' ,
'HFRHS140x80x8' ,
'HFRHS140x80x10' ,
'HFRHS150x100x4' ,
'HFRHS150x100x5' ,
'HFRHS150x100x6' ,
'HFRHS150x100x63' ,
'HFRHS150x100x8' ,
'HFRHS150x100x10' ,
'HFRHS150x100x12' ,
'HFRHS160x80x4' ,
'HFRHS160x80x5' ,
'HFRHS160x80x6' ,
'HFRHS160x80x63' ,
'HFRHS160x80x8' ,
'HFRHS160x80x10' ,
'HFRHS160x80x12' ,
'HFRHS160x80x125' ,
'HFRHS180x100x4' ,
'HFRHS180x100x5' ,
'HFRHS180x100x6' ,
'HFRHS180x100x63' ,
'HFRHS180x100x8' ,
'HFRHS180x100x10' ,
'HFRHS180x100x12' ,
'HFRHS180x100x125' ,
'HFRHS200x100x4' ,
'HFRHS200x100x5' ,
'HFRHS200x100x6' ,
'HFRHS200x100x63' ,
'HFRHS200x100x8' ,
'HFRHS200x100x10' ,
'HFRHS200x100x12' ,
'HFRHS200x100x125' ,
'HFRHS200x100x16' ,
'HFRHS200x120x6' ,
'HFRHS200x120x63' ,
'HFRHS200x120x8' ,
'HFRHS200x120x10' ,
'HFRHS200x120x12' ,
'HFRHS200x120x125' ,
'HFRHS250x150x6' ,
'HFRHS250x150x63' ,
'HFRHS250x150x8' ,
'HFRHS250x150x10' ,
'HFRHS250x150x12' ,
'HFRHS250x150x125' ,
'HFRHS250x150x16' ,
'HFRHS260x180x6' ,
'HFRHS260x180x63' ,
'HFRHS260x180x8' ,
'HFRHS260x180x10' ,
'HFRHS260x180x12' ,
'HFRHS260x180x125' ,
'HFRHS260x180x16' ,
'HFRHS300x200x6' ,
'HFRHS300x200x63' ,
'HFRHS300x200x8' ,
'HFRHS300x200x10' ,
'HFRHS300x200x12' ,
'HFRHS300x200x125' ,
'HFRHS300x200x16' ,
'HFRHS350x250x6' ,
'HFRHS350x250x63' ,
'HFRHS350x250x8' ,
'HFRHS350x250x10' ,
'HFRHS350x250x12' ,
'HFRHS350x250x125' ,
'HFRHS350x250x16' ,
'HFRHS400x200x8' ,
'HFRHS400x200x10' ,
'HFRHS400x200x12' ,
'HFRHS400x200x125' ,
'HFRHS400x200x16' ,
'HFRHS450x250x8' ,
'HFRHS450x250x10' ,
'HFRHS450x250x12' ,
'HFRHS450x250x125' ,
'HFRHS450x250x16' ,
'HFRHS500x300x10' ,
'HFRHS500x300x12' ,
'HFRHS500x300x125' ,
'HFRHS500x300x16' ,
'HFRHS500x300x20' ,
'HFRHS_I50x30x4' ,
'HFRHS_I60x40x32' ,
'HFRHS_I60x40x4' ,
'HFRHS_I60x40x5' ,
'HFRHS_I70x40x32' ,
'HFRHS_I70x40x4' ,
'HFRHS_I70x40x5' ,
'HFRHS_I80x40x32' ,
'HFRHS_I80x40x4' ,
'HFRHS_I80x40x5' ,
'HFRHS_I90x50x32' ,
'HFRHS_I90x50x36' ,
'HFRHS_I90x50x4' ,
'HFRHS_I90x50x5' ,
'HFRHS_I100x50x32' ,
'HFRHS_I100x50x36' ,
'HFRHS_I100x50x4' ,
'HFRHS_I100x50x5' ,
'HFRHS_I100x60x32' ,
'HFRHS_I100x60x36' ,
'HFRHS_I100x60x4' ,
'HFRHS_I100x60x5' ,
'HFRHS_I100x60x63' ,
'HFRHS_I120x60x32' ,
'HFRHS_I120x60x36' ,
'HFRHS_I120x60x4' ,
'HFRHS_I120x60x5' ,
'HFRHS_I120x60x63' ,
'HFRHS_I120x60x8' ,
'HFRHS_I120x80x32' ,
'HFRHS_I120x80x4' ,
'HFRHS_I120x80x5' ,
'HFRHS_I120x80x63' ,
'HFRHS_I120x80x8' ,
'HFRHS_I120x80x10' ,
'HFRHS_I140x80x32' ,
'HFRHS_I140x80x4' ,
'HFRHS_I140x80x5' ,
'HFRHS_I140x80x63' ,
'HFRHS_I140x80x8' ,
'HFRHS_I140x80x10' ,
'HFRHS_I150x100x32' ,
'HFRHS_I150x100x4' ,
'HFRHS_I150x100x5' ,
'HFRHS_I150x100x63' ,
'HFRHS_I150x100x8' ,
'HFRHS_I150x100x10' ,
'HFRHS_I160x80x32' ,
'HFRHS_I160x80x4' ,
'HFRHS_I160x80x5' ,
'HFRHS_I160x80x63' ,
'HFRHS_I160x80x8' ,
'HFRHS_I160x80x10' ,
'HFRHS_I180x100x36' ,
'HFRHS_I180x100x5' ,
'HFRHS_I180x100x63' ,
'HFRHS_I180x100x8' ,
'HFRHS_I180x100x10' ,
'HFRHS_I200x100x4' ,
'HFRHS_I200x100x5' ,
'HFRHS_I200x100x63' ,
'HFRHS_I200x100x8' ,
'HFRHS_I200x100x10' ,
'HFRHS_I200x120x4' ,
'HFRHS_I200x120x5' ,
'HFRHS_I200x120x63' ,
'HFRHS_I200x120x8' ,
'HFRHS_I200x120x10' ,
'HFRHS_I220x140x4' ,
'HFRHS_I220x140x5' ,
'HFRHS_I220x140x63' ,
'HFRHS_I220x140x8' ,
'HFRHS_I220x140x10' ,
'HFRHS_I250x150x5' ,
'HFRHS_I250x150x63' ,
'HFRHS_I250x150x8' ,
'HFRHS_I250x150x10' ,
'HFRHS_I300x200x59' ,
'HFRHS_I300x200x63' ,
'HFRHS_I300x200x8' ,
'HFRHS_I300x200x10' ,
'HFRHS_I400x200x71' ,
'HFRHS_I400x200x8' ,
'HFRHS_I400x200x10' ,
'HFRHS_I450x250x8' ,
'HFRHS_I450x250x10' ,
'HFRHS_I500x300x10' ,
'HFCHS213x23' ,
'HFCHS213x26' ,
'HFCHS213x32' ,
'HFCHS269x23' ,
'HFCHS269x26' ,
'HFCHS269x32' ,
'HFCHS337x26' ,
'HFCHS337x32' ,
'HFCHS337x4' ,
'HFCHS424x26' ,
'HFCHS424x32' ,
'HFCHS424x4' ,
'HFCHS483x26' ,
'HFCHS483x32' ,
'HFCHS483x4' ,
'HFCHS483x5' ,
'HFCHS603x26' ,
'HFCHS603x32' ,
'HFCHS603x4' ,
'HFCHS603x5' ,
'HFCHS761x26' ,
'HFCHS761x32' ,
'HFCHS761x4' ,
'HFCHS761x5' ,
'HFCHS889x32' ,
'HFCHS889x4' ,
'HFCHS889x5' ,
'HFCHS889x6' ,
'HFCHS889x63' ,
'HFCHS1016x32' ,
'HFCHS1016x4' ,
'HFCHS1016x5' ,
'HFCHS1016x6' ,
'HFCHS1016x63' ,
'HFCHS1016x8' ,
'HFCHS1016x10' ,
'HFCHS1143x32' ,
'HFCHS1143x4' ,
'HFCHS1143x5' ,
'HFCHS1143x6' ,
'HFCHS1143x63' ,
'HFCHS1143x8' ,
'HFCHS1143x10' ,
'HFCHS1397x4' ,
'HFCHS1397x5' ,
'HFCHS1397x6' ,
'HFCHS1397x63' ,
'HFCHS1397x8' ,
'HFCHS1397x10' ,
'HFCHS1397x12' ,
'HFCHS1397x125' ,
'HFCHS1683x4' ,
'HFCHS1683x5' ,
'HFCHS1683x6' ,
'HFCHS1683x63' ,
'HFCHS1683x8' ,
'HFCHS1683x10' ,
'HFCHS1683x12' ,
'HFCHS1683x125' ,
'HFCHS1778x5' ,
'HFCHS1778x6' ,
'HFCHS1778x63' ,
'HFCHS1778x8' ,
'HFCHS1778x10' ,
'HFCHS1778x12' ,
'HFCHS1778x125' ,
'HFCHS1937x5' ,
'HFCHS1937x56' ,
'HFCHS1937x6' ,
'HFCHS1937x63' ,
'HFCHS1937x8' ,
'HFCHS1937x10' ,
'HFCHS1937x12' ,
'HFCHS1937x125' ,
'HFCHS1937x16' ,
'HFCHS2191x5' ,
'HFCHS2191x6' ,
'HFCHS2191x63' ,
'HFCHS2191x8' ,
'HFCHS2191x10' ,
'HFCHS2191x12' ,
'HFCHS2191x125' ,
'HFCHS2191x16' ,
'HFCHS2191x20' ,
'HFCHS2445x5' ,
'HFCHS2445x6' ,
'HFCHS2445x63' ,
'HFCHS2445x8' ,
'HFCHS2445x10' ,
'HFCHS2445x12' ,
'HFCHS2445x125' ,
'HFCHS2445x16' ,
'HFCHS2445x20' ,
'HFCHS2445x25' ,
'HFCHS273x5' ,
'HFCHS273x6' ,
'HFCHS273x63' ,
'HFCHS273x8' ,
'HFCHS273x10' ,
'HFCHS273x12' ,
'HFCHS273x125' ,
'HFCHS273x16' ,
'HFCHS273x20' ,
'HFCHS273x25' ,
'HFCHS3239x5' ,
'HFCHS3239x6' ,
'HFCHS3239x63' ,
'HFCHS3239x8' ,
'HFCHS3239x10' ,
'HFCHS3239x12' ,
'HFCHS3239x125' ,
'HFCHS3239x16' ,
'HFCHS3239x20' ,
'HFCHS3239x25' ,
'HFCHS3556x6' ,
'HFCHS3556x63' ,
'HFCHS3556x8' ,
'HFCHS3556x10' ,
'HFCHS3556x12' ,
'HFCHS3556x125' ,
'HFCHS3556x16' ,
'HFCHS3556x20' ,
'HFCHS3556x25' ,
'HFCHS4064x6' ,
'HFCHS4064x63' ,
'HFCHS4064x8' ,
'HFCHS4064x10' ,
'HFCHS4064x12' ,
'HFCHS4064x125' ,
'HFCHS4064x16' ,
'HFCHS4064x20' ,
'HFCHS4064x25' ,
'HFCHS4064x30' ,
'HFCHS4064x40' ,
'HFCHS457x6' ,
'HFCHS457x63' ,
'HFCHS457x8' ,
'HFCHS457x10' ,
'HFCHS457x12' ,
'HFCHS457x125' ,
'HFCHS457x16' ,
'HFCHS457x20' ,
'HFCHS457x25' ,
'HFCHS457x30' ,
'HFCHS457x40' ,
'HFCHS508x6' ,
'HFCHS508x63' ,
'HFCHS508x8' ,
'HFCHS508x10' ,
'HFCHS508x12' ,
'HFCHS508x125' ,
'HFCHS508x16' ,
'HFCHS508x20' ,
'HFCHS508x25' ,
'HFCHS508x30' ,
'HFCHS508x40' ,
'HFCHS508x50' ,
'HFCHS610x6' ,
'HFCHS610x63' ,
'HFCHS610x8' ,
'HFCHS610x10' ,
'HFCHS610x12' ,
'HFCHS610x125' ,
'HFCHS610x16' ,
'HFCHS610x20' ,
'HFCHS610x25' ,
'HFCHS610x30' ,
'HFCHS610x40' ,
'HFCHS610x50' ,
'HFCHS711x6' ,
'HFCHS711x63' ,
'HFCHS711x8' ,
'HFCHS711x10' ,
'HFCHS711x12' ,
'HFCHS711x125' ,
'HFCHS711x16' ,
'HFCHS711x20' ,
'HFCHS711x25' ,
'HFCHS711x30' ,
'HFCHS711x40' ,
'HFCHS711x50' ,
'HFCHS711x60' ,
'HFCHS762x6' ,
'HFCHS762x63' ,
'HFCHS762x8' ,
'HFCHS762x10' ,
'HFCHS762x12' ,
'HFCHS762x125' ,
'HFCHS762x16' ,
'HFCHS762x20' ,
'HFCHS762x25' ,
'HFCHS762x30' ,
'HFCHS762x40' ,
'HFCHS762x50' ,
'HFCHS813x8' ,
'HFCHS813x10' ,
'HFCHS813x12' ,
'HFCHS813x125' ,
'HFCHS813x16' ,
'HFCHS813x20' ,
'HFCHS813x25' ,
'HFCHS813x30' ,
'HFCHS914x8' ,
'HFCHS914x10' ,
'HFCHS914x12' ,
'HFCHS914x125' ,
'HFCHS914x16' ,
'HFCHS914x20' ,
'HFCHS914x25' ,
'HFCHS914x30' ,
'HFCHS1016x8' ,
'HFCHS1016x10' ,
'HFCHS1016x12' ,
'HFCHS1016x125' ,
'HFCHS1016x16' ,
'HFCHS1016x20' ,
'HFCHS1016x25' ,
'HFCHS1016x30' ,
'HFCHS1067x10' ,
'HFCHS1067x12' ,
'HFCHS1067x125' ,
'HFCHS1067x16' ,
'HFCHS1067x20' ,
'HFCHS1067x25' ,
'HFCHS1067x30' ,
'HFCHS1168x10' ,
'HFCHS1168x12' ,
'HFCHS1168x125' ,
'HFCHS1168x16' ,
'HFCHS1168x20' ,
'HFCHS1168x25' ,
'HFCHS1219x10' ,
'HFCHS1219x12' ,
'HFCHS1219x125' ,
'HFCHS1219x16' ,
'HFCHS1219x20' ,
'HFCHS1219x25' ,
'HFCHS_I483x29' ,
'HFCHS_I603x29' ,
'HFCHS_I761x29' ,
'HFCHS_I1016x36' ,
'HFCHS_I1143x36' ,
'HFCHS_I1683x45' ,
'HFCHS_I1937x54' ,
'HFCHS_I2191x59' ,
'HFCHS_I3239x71' ,
'HFCHS_I4064x88' ,
'HFCHS_I4064x32' ,
'HFCHS_I457x32' ,
'UAP80' ,
'UAP100' ,
'UAP130' ,
'UAP150' ,
'UAP175' ,
'UAP200' ,
'UAP220' ,
'UAP250' ,
'UAP300' ,
'UNP80' ,
'UNP100' ,
'UNP120' ,
'UNP140' ,
'UNP160' ,
'UNP180' ,
'UNP200' ,
'UNP220' ,
'UNP240' ,
'UNP260' ,
'UNP280' ,
'UNP300' ,
'UNP320' ,
'UNP350' ,
'UNP380' ,
'UNP400' ,
'UNP320_eu' ,
'UNP350_eu' ,
'UNP380_eu' ,
'UNP400_eu' ,
'UPE80' ,
'UPE100' ,
'UPE120' ,
'UPE140' ,
'UPE160' ,
'UPE180' ,
'UPE200' ,
'UPE220' ,
'UPE240' ,
'UPE270' ,
'UPE300' ,
'UPE330' ,
'UPE360' ,
'UPE400' ,
'HFRHS20x20x2' ,
'HFRHS20x20x25' ,
'HFRHS25x25x2' ,
'HFRHS25x25x25' ,
'HFRHS25x25x3' ,
'HFRHS30x30x2' ,
'HFRHS30x30x25' ,
'HFRHS30x30x3' ,
'HFRHS40x40x25' ,
'HFRHS40x40x3' ,
'HFRHS40x40x4' ,
'HFRHS40x40x5' ,
'HFRHS50x50x25' ,
'HFRHS50x50x3' ,
'HFRHS50x50x4' ,
'HFRHS50x50x5' ,
'HFRHS50x50x6' ,
'HFRHS50x50x63' ,
'HFRHS60x60x25' ,
'HFRHS60x60x3' ,
'HFRHS60x60x4' ,
'HFRHS60x60x5' ,
'HFRHS60x60x6' ,
'HFRHS60x60x63' ,
'HFRHS60x60x8' ,
'HFRHS70x70x3' ,
'HFRHS70x70x4' ,
'HFRHS70x70x5' ,
'HFRHS70x70x6' ,
'HFRHS70x70x63' ,
'HFRHS70x70x8' ,
'HFRHS80x80x3' ,
'HFRHS80x80x4' ,
'HFRHS80x80x5' ,
'HFRHS80x80x6' ,
'HFRHS80x80x63' ,
'HFRHS80x80x8' ,
'HFRHS90x90x4' ,
'HFRHS90x90x5' ,
'HFRHS90x90x6' ,
'HFRHS90x90x63' ,
'HFRHS90x90x8' ,
'HFRHS100x100x4' ,
'HFRHS100x100x5' ,
'HFRHS100x100x6' ,
'HFRHS100x100x63' ,
'HFRHS100x100x8' ,
'HFRHS100x100x10' ,
'HFRHS120x120x5' ,
'HFRHS120x120x6' ,
'HFRHS120x120x63' ,
'HFRHS120x120x8' ,
'HFRHS120x120x10' ,
'HFRHS120x120x12' ,
'HFRHS120x120x125' ,
'HFRHS140x140x5' ,
'HFRHS140x140x6' ,
'HFRHS140x140x63' ,
'HFRHS140x140x8' ,
'HFRHS140x140x10' ,
'HFRHS140x140x12' ,
'HFRHS140x140x125' ,
'HFRHS150x150x5' ,
'HFRHS150x150x6' ,
'HFRHS150x150x63' ,
'HFRHS150x150x8' ,
'HFRHS150x150x10' ,
'HFRHS150x150x12' ,
'HFRHS150x150x125' ,
'HFRHS150x150x16' ,
'HFRHS160x160x5' ,
'HFRHS160x160x6' ,
'HFRHS160x160x63' ,
'HFRHS160x160x8' ,
'HFRHS160x160x10' ,
'HFRHS160x160x12' ,
'HFRHS160x160x125' ,
'HFRHS160x160x16' ,
'HFRHS180x180x5' ,
'HFRHS180x180x6' ,
'HFRHS180x180x63' ,
'HFRHS180x180x8' ,
'HFRHS180x180x10' ,
'HFRHS180x180x12' ,
'HFRHS180x180x125' ,
'HFRHS180x180x16' ,
'HFRHS200x200x5' ,
'HFRHS200x200x6' ,
'HFRHS200x200x63' ,
'HFRHS200x200x8' ,
'HFRHS200x200x10' ,
'HFRHS200x200x12' ,
'HFRHS200x200x125' ,
'HFRHS200x200x16' ,
'HFRHS220x220x6' ,
'HFRHS220x220x63' ,
'HFRHS220x220x8' ,
'HFRHS220x220x10' ,
'HFRHS220x220x12' ,
'HFRHS220x220x125' ,
'HFRHS220x220x16' ,
'HFRHS250x250x6' ,
'HFRHS250x250x63' ,
'HFRHS250x250x8' ,
'HFRHS250x250x10' ,
'HFRHS250x250x12' ,
'HFRHS250x250x125' ,
'HFRHS250x250x16' ,
'HFRHS260x260x6' ,
'HFRHS260x260x63' ,
'HFRHS260x260x8' ,
'HFRHS260x260x10' ,
'HFRHS260x260x12' ,
'HFRHS260x260x125' ,
'HFRHS260x260x16' ,
'HFRHS300x300x6' ,
'HFRHS300x300x63' ,
'HFRHS300x300x8' ,
'HFRHS300x300x10' ,
'HFRHS300x300x12' ,
'HFRHS300x300x125' ,
'HFRHS300x300x16' ,
'HFRHS350x350x8' ,
'HFRHS350x350x10' ,
'HFRHS350x350x12' ,
'HFRHS350x350x125' ,
'HFRHS350x350x16' ,
'HFRHS400x400x10' ,
'HFRHS400x400x12' ,
'HFRHS400x400x125' ,
'HFRHS400x400x16' ,
'HFRHS400x400x20' ,
'HFRHS_I20x20x2' ,
'HFRHS_I20x20x26' ,
'HFRHS_I30x30x2' ,
'HFRHS_I30x30x26' ,
'HFRHS_I30x30x32' ,
'HFRHS_I40x40x26' ,
'HFRHS_I40x40x32' ,
'HFRHS_I40x40x4' ,
'HFRHS_I50x50x32' ,
'HFRHS_I50x50x4' ,
'HFRHS_I50x50x5' ,
'HFRHS_I60x60x32' ,
'HFRHS_I60x60x4' ,
'HFRHS_I60x60x5' ,
'HFRHS_I70x70x32' ,
'HFRHS_I70x70x36' ,
'HFRHS_I70x70x4' ,
'HFRHS_I70x70x5' ,
'HFRHS_I80x80x32' ,
'HFRHS_I80x80x36' ,
'HFRHS_I80x80x4' ,
'HFRHS_I80x80x5' ,
'HFRHS_I80x80x63' ,
'HFRHS_I90x90x32' ,
'HFRHS_I90x90x36' ,
'HFRHS_I90x90x4' ,
'HFRHS_I90x90x5' ,
'HFRHS_I90x90x63' ,
'HFRHS_I90x90x8' ,
'HFRHS_I100x100x32' ,
'HFRHS_I100x100x4' ,
'HFRHS_I100x100x5' ,
'HFRHS_I100x100x63' ,
'HFRHS_I100x100x8' ,
'HFRHS_I100x100x10' ,
'HFRHS_I120x120x32' ,
'HFRHS_I120x120x4' ,
'HFRHS_I120x120x5' ,
'HFRHS_I120x120x63' ,
'HFRHS_I120x120x8' ,
'HFRHS_I120x120x10' ,
'HFRHS_I140x140x36' ,
'HFRHS_I140x140x5' ,
'HFRHS_I140x140x63' ,
'HFRHS_I140x140x8' ,
'HFRHS_I140x140x10' ,
'HFRHS_I150x150x4' ,
'HFRHS_I150x150x5' ,
'HFRHS_I150x150x63' ,
'HFRHS_I150x150x8' ,
'HFRHS_I150x150x10' ,
'HFRHS_I160x160x4' ,
'HFRHS_I160x160x5' ,
'HFRHS_I160x160x63' ,
'HFRHS_I160x160x8' ,
'HFRHS_I160x160x10' ,
'HFRHS_I180x180x4' ,
'HFRHS_I180x180x5' ,
'HFRHS_I180x180x63' ,
'HFRHS_I180x180x8' ,
'HFRHS_I180x180x10' ,
'HFRHS_I200x200x5' ,
'HFRHS_I200x200x63' ,
'HFRHS_I200x200x8' ,
'HFRHS_I200x200x10' ,
'HFRHS_I220x220x5' ,
'HFRHS_I220x220x63' ,
'HFRHS_I220x220x8' ,
'HFRHS_I220x220x10' ,
'HFRHS_I250x250x59' ,
'HFRHS_I250x250x63' ,
'HFRHS_I250x250x8' ,
'HFRHS_I250x250x10' ,
'HFRHS_I260x260x59' ,
'HFRHS_I260x260x63' ,
'HFRHS_I260x260x8' ,
'HFRHS_I260x260x10' ,
'HFRHS_I300x300x71' ,
'HFRHS_I300x300x8' ,
'HFRHS_I300x300x10' ,
'HFRHS_I350x350x8' ,
'HFRHS_I350x350x10' ,
'HFRHS_I400x400x10' ,
'HFRHS_I260x260x8' ,
'HFRHS_I260x260x10' ,
'HFRHS_I300x300x71' ,
'HFRHS_I300x300x8' ,
'HFRHS_I300x300x10' ,
'HFRHS_I300x300x125' ,
'HFRHS_I350x350x8' ,
'HFRHS_I350x350x10' ,
'HFRHS_I350x350x125' ,
'HFRHS_I400x400x10' ,
'HFRHS_I400x400x125' ,
'HFRHS_I400x400x16' ,
'CFC25x25x7x15' ,
'CFC25x25x75x2' ,
'CFC30x15x8x2' ,
'CFC30x30x85x2' ,
'CFC30x30x10x2' ,
'CFC30x50x10x2' ,
'CFC40x20x10x2' ,
'CFC80x40x16x2' ,
'CFC80x40x16x3' ,
'CFC100x50x16x3' ,
'CFL_eq15x15x15' ,
'CFL_eq15x15x2' ,
'CFL_eq15x15x3' ,
'CFL_eq20x20x2' ,
'CFL_eq20x20x3' ,
'CFL_eq25x25x2' ,
'CFL_eq25x25x3' ,
'CFL_eq30x30x2' ,
'CFL_eq30x30x3' ,
'CFL_eq35x35x2' ,
'CFL_eq35x35x3' ,
'CFL_eq35x35x4' ,
'CFL_eq40x40x2' ,
'CFL_eq40x40x3' ,
'CFL_eq40x40x4' ,
'CFL_eq50x50x2' ,
'CFL_eq50x50x3' ,
'CFL_eq50x50x4' ,
'CFL_eq50x50x5' ,
'CFL_eq60x60x3' ,
'CFL_eq60x60x4' ,
'CFL_eq65x65x3' ,
'CFL_eq70x70x4' ,
'CFL_eq80x80x5' ,
'CFL_ue20x15x2' ,
'CFL_ue25x15x2' ,
'CFL_ue30x15x2' ,
'CFL_ue30x15x3' ,
'CFL_ue30x20x2' ,
'CFL_ue30x20x3' ,
'CFL_ue30x25x3' ,
'CFL_ue35x25x3' ,
'CFL_ue40x20x2' ,
'CFL_ue40x20x3' ,
'CFL_ue40x25x2' ,
'CFL_ue40x25x3' ,
'CFL_ue40x30x2' ,
'CFL_ue40x30x3' ,
'CFL_ue50x20x2' ,
'CFL_ue50x25x3' ,
'CFL_ue50x30x2' ,
'CFL_ue50x30x3' ,
'CFL_ue50x40x2' ,
'CFL_ue50x40x3' ,
'CFL_ue60x30x3' ,
'CFL_ue60x40x3' ,
'CFL_ue60x40x4' ,
'CFL_ue70x40x3' ,
'CFL_ue70x50x4' ,
'CFL_ue75x40x3' ,
'CFL_ue80x40x3' ,
'CFL_ue80x40x4' ,
'CFL_ue80x50x3' ,
'CFL_ue80x50x4' ,
'CFL_ue90x40x3' ,
'CFL_ue100x50x3' ,
'CFL_ue100x50x4' ,
'CFRHS40x20x2' ,
'CFRHS40x20x25' ,
'CFRHS40x20x3' ,
'CFRHS50x30x2' ,
'CFRHS50x30x25' ,
'CFRHS50x30x3' ,
'CFRHS50x30x4' ,
'CFRHS60x40x2' ,
'CFRHS60x40x25' ,
'CFRHS60x40x3' ,
'CFRHS60x40x4' ,
'CFRHS60x40x5' ,
'CFRHS70x50x2' ,
'CFRHS70x50x25' ,
'CFRHS70x50x3' ,
'CFRHS70x50x4' ,
'CFRHS70x50x5' ,
'CFRHS80x40x2' ,
'CFRHS80x40x25' ,
'CFRHS80x40x3' ,
'CFRHS80x40x4' ,
'CFRHS80x40x5' ,
'CFRHS80x60x2' ,
'CFRHS80x60x25' ,
'CFRHS80x60x3' ,
'CFRHS80x60x4' ,
'CFRHS80x60x5' ,
'CFRHS90x50x2' ,
'CFRHS90x50x25' ,
'CFRHS90x50x3' ,
'CFRHS90x50x4' ,
'CFRHS90x50x5' ,
'CFRHS100x40x25' ,
'CFRHS100x40x3' ,
'CFRHS100x40x4' ,
'CFRHS100x40x5' ,
'CFRHS100x50x25' ,
'CFRHS100x50x3' ,
'CFRHS100x50x4' ,
'CFRHS100x50x5' ,
'CFRHS100x50x6' ,
'CFRHS100x50x63' ,
'CFRHS100x60x25' ,
'CFRHS100x60x3' ,
'CFRHS100x60x4' ,
'CFRHS100x60x5' ,
'CFRHS100x60x6' ,
'CFRHS100x60x63' ,
'CFRHS100x80x25' ,
'CFRHS100x80x3' ,
'CFRHS100x80x4' ,
'CFRHS100x80x5' ,
'CFRHS100x80x6' ,
'CFRHS100x80x63' ,
'CFRHS120x60x25' ,
'CFRHS120x60x3' ,
'CFRHS120x60x4' ,
'CFRHS120x60x5' ,
'CFRHS120x60x6' ,
'CFRHS120x60x63' ,
'CFRHS120x60x8' ,
'CFRHS120x80x3' ,
'CFRHS120x80x4' ,
'CFRHS120x80x5' ,
'CFRHS120x80x6' ,
'CFRHS120x80x63' ,
'CFRHS120x80x8' ,
'CFRHS140x80x4' ,
'CFRHS140x80x5' ,
'CFRHS140x80x6' ,
'CFRHS140x80x63' ,
'CFRHS140x80x8' ,
'CFRHS150x100x4' ,
'CFRHS150x100x5' ,
'CFRHS150x100x6' ,
'CFRHS150x100x63' ,
'CFRHS150x100x8' ,
'CFRHS150x100x10' ,
'CFRHS150x100x12' ,
'CFRHS150x100x125' ,
'CFRHS160x80x4' ,
'CFRHS160x80x5' ,
'CFRHS160x80x6' ,
'CFRHS160x80x63' ,
'CFRHS160x80x8' ,
'CFRHS160x80x10' ,
'CFRHS160x80x12' ,
'CFRHS160x80x125' ,
'CFRHS180x100x4' ,
'CFRHS180x100x5' ,
'CFRHS180x100x6' ,
'CFRHS180x100x63' ,
'CFRHS180x100x8' ,
'CFRHS180x100x10' ,
'CFRHS180x100x12' ,
'CFRHS180x100x125' ,
'CFRHS200x100x4' ,
'CFRHS200x100x5' ,
'CFRHS200x100x6' ,
'CFRHS200x100x63' ,
'CFRHS200x100x8' ,
'CFRHS200x100x10' ,
'CFRHS200x100x12' ,
'CFRHS200x100x125' ,
'CFRHS200x120x4' ,
'CFRHS200x120x5' ,
'CFRHS200x120x6' ,
'CFRHS200x120x63' ,
'CFRHS200x120x8' ,
'CFRHS200x120x10' ,
'CFRHS200x120x12' ,
'CFRHS200x120x125' ,
'CFRHS250x150x5' ,
'CFRHS250x150x6' ,
'CFRHS250x150x63' ,
'CFRHS250x150x8' ,
'CFRHS250x150x10' ,
'CFRHS250x150x12' ,
'CFRHS250x150x125' ,
'CFRHS250x150x16' ,
'CFRHS260x180x5' ,
'CFRHS260x180x6' ,
'CFRHS260x180x63' ,
'CFRHS260x180x8' ,
'CFRHS260x180x10' ,
'CFRHS260x180x12' ,
'CFRHS260x180x125' ,
'CFRHS260x180x16' ,
'CFRHS300x100x6' ,
'CFRHS300x100x63' ,
'CFRHS300x100x8' ,
'CFRHS300x100x10' ,
'CFRHS300x100x12' ,
'CFRHS300x100x125' ,
'CFRHS300x100x16' ,
'CFRHS300x150x6' ,
'CFRHS300x150x63' ,
'CFRHS300x150x8' ,
'CFRHS300x150x10' ,
'CFRHS300x150x12' ,
'CFRHS300x150x125' ,
'CFRHS300x150x16' ,
'CFRHS300x200x6' ,
'CFRHS300x200x63' ,
'CFRHS300x200x8' ,
'CFRHS300x200x10' ,
'CFRHS300x200x12' ,
'CFRHS300x200x125' ,
'CFRHS300x200x16' ,
'CFRHS350x250x6' ,
'CFRHS350x250x63' ,
'CFRHS350x250x8' ,
'CFRHS350x250x10' ,
'CFRHS350x250x12' ,
'CFRHS350x250x125' ,
'CFRHS350x250x16' ,
'CFRHS400x200x8' ,
'CFRHS400x200x10' ,
'CFRHS400x200x12' ,
'CFRHS400x200x125' ,
'CFRHS400x200x16' ,
'CFRHS400x300x8' ,
'CFRHS400x300x10' ,
'CFRHS400x300x12' ,
'CFRHS400x300x125' ,
'CFRHS400x300x16' ,
'CFRHS_I40x20x12' ,
'CFRHS_I40x20x16' ,
'CFRHS_I40x20x2' ,
'CFRHS_I40x20x26' ,
'CFRHS_I50x30x12' ,
'CFRHS_I50x30x16' ,
'CFRHS_I50x30x2' ,
'CFRHS_I50x30x26' ,
'CFRHS_I50x30x32' ,
'CFRHS_I50x30x4' ,
'CFRHS_I60x40x16' ,
'CFRHS_I60x40x2' ,
'CFRHS_I60x40x26' ,
'CFRHS_I60x40x32' ,
'CFRHS_I60x40x4' ,
'CFRHS_I60x40x5' ,
'CFRHS_I80x40x16' ,
'CFRHS_I80x40x2' ,
'CFRHS_I80x40x26' ,
'CFRHS_I80x40x32' ,
'CFRHS_I80x40x4' ,
'CFRHS_I80x40x5' ,
'CFRHS_I90x50x16' ,
'CFRHS_I90x50x2' ,
'CFRHS_I90x50x26' ,
'CFRHS_I90x50x32' ,
'CFRHS_I90x50x4' ,
'CFRHS_I90x50x5' ,
'CFRHS_I100x60x2' ,
'CFRHS_I100x60x26' ,
'CFRHS_I100x60x32' ,
'CFRHS_I100x60x4' ,
'CFRHS_I100x60x5' ,
'CFRHS_I120x60x2' ,
'CFRHS_I120x60x26' ,
'CFRHS_I120x60x32' ,
'CFRHS_I120x60x4' ,
'CFRHS_I120x60x5' ,
'CFRHS_I120x60x63' ,
'CFRHS_I120x80x26' ,
'CFRHS_I120x80x32' ,
'CFRHS_I120x80x4' ,
'CFRHS_I120x80x5' ,
'CFRHS_I120x80x63' ,
'CFRHS_I120x80x71' ,
'CFRHS_I140x90x32' ,
'CFRHS_I140x90x4' ,
'CFRHS_I140x90x5' ,
'CFRHS_I140x90x63' ,
'CFRHS_I140x90x71' ,
'CFRHS_I150x100x32' ,
'CFRHS_I150x100x4' ,
'CFRHS_I150x100x5' ,
'CFRHS_I150x100x63' ,
'CFRHS_I150x100x71' ,
'CFRHS_I150x100x8' ,
'CFRHS_I150x100x10' ,
'CFRHS_I160x80x32' ,
'CFRHS_I160x80x4' ,
'CFRHS_I160x80x5' ,
'CFRHS_I160x80x63' ,
'CFRHS_I160x80x71' ,
'CFRHS_I160x80x8' ,
'CFRHS_I160x80x10' ,
'CFRHS_I180x100x32' ,
'CFRHS_I180x100x4' ,
'CFRHS_I180x100x5' ,
'CFRHS_I180x100x63' ,
'CFRHS_I180x100x71' ,
'CFRHS_I180x100x8' ,
'CFRHS_I180x100x10' ,
'CFRHS_I200x100x4' ,
'CFRHS_I200x100x5' ,
'CFRHS_I200x100x63' ,
'CFRHS_I200x100x71' ,
'CFRHS_I200x100x8' ,
'CFRHS_I200x100x10' ,
'CFRHS_I200x120x4' ,
'CFRHS_I200x120x5' ,
'CFRHS_I200x120x63' ,
'CFRHS_I200x120x71' ,
'CFRHS_I200x120x8' ,
'CFRHS_I200x120x10' ,
'CFRHS_I220x140x4' ,
'CFRHS_I220x140x5' ,
'CFRHS_I220x140x63' ,
'CFRHS_I220x140x71' ,
'CFRHS_I220x140x8' ,
'CFRHS_I220x140x10' ,
'CFRHS_I250x150x4' ,
'CFRHS_I250x150x5' ,
'CFRHS_I250x150x63' ,
'CFRHS_I250x150x71' ,
'CFRHS_I250x150x8' ,
'CFRHS_I250x150x10' ,
'CFRHS_I250x150x125' ,
'CFRHS_I260x180x4' ,
'CFRHS_I260x180x5' ,
'CFRHS_I260x180x63' ,
'CFRHS_I260x180x71' ,
'CFRHS_I260x180x8' ,
'CFRHS_I260x180x10' ,
'CFRHS_I260x180x125' ,
'CFRHS_I300x200x4' ,
'CFRHS_I300x200x5' ,
'CFRHS_I300x200x63' ,
'CFRHS_I300x200x71' ,
'CFRHS_I300x200x8' ,
'CFRHS_I300x200x10' ,
'CFRHS_I300x200x125' ,
'CFRHS_I320x200x4' ,
'CFRHS_I320x200x5' ,
'CFRHS_I320x200x63' ,
'CFRHS_I320x200x71' ,
'CFRHS_I320x200x8' ,
'CFRHS_I320x200x10' ,
'CFRHS_I320x200x125' ,
'CFRHS_I350x220x4' ,
'CFRHS_I350x220x5' ,
'CFRHS_I350x220x63' ,
'CFRHS_I350x220x71' ,
'CFRHS_I350x220x8' ,
'CFRHS_I350x220x10' ,
'CFRHS_I350x220x125' ,
'CFRHS_I400x200x4' ,
'CFRHS_I400x200x5' ,
'CFRHS_I400x200x63' ,
'CFRHS_I400x200x71' ,
'CFRHS_I400x200x8' ,
'CFRHS_I400x200x10' ,
'CFRHS_I400x200x125' ,
'CFRHS_I400x250x4' ,
'CFRHS_I400x250x5' ,
'CFRHS_I400x250x63' ,
'CFRHS_I400x250x71' ,
'CFRHS_I400x250x8' ,
'CFRHS_I400x250x10' ,
'CFRHS_I400x250x125' ,
'CFRHS_I450x250x63' ,
'CFRHS_I450x250x71' ,
'CFRHS_I450x250x8' ,
'CFRHS_I450x250x10' ,
'CFRHS_I450x250x125' ,
'CFRHS_I500x300x63' ,
'CFRHS_I500x300x71' ,
'CFRHS_I500x300x8' ,
'CFRHS_I500x300x10' ,
'CFRHS_I500x300x125' ,
'CFCHS213x2' ,
'CFCHS213x25' ,
'CFCHS213x3' ,
'CFCHS269x2' ,
'CFCHS269x25' ,
'CFCHS269x3' ,
'CFCHS337x2' ,
'CFCHS337x25' ,
'CFCHS337x3' ,
'CFCHS424x2' ,
'CFCHS424x25' ,
'CFCHS424x3' ,
'CFCHS424x4' ,
'CFCHS483x2' ,
'CFCHS483x25' ,
'CFCHS483x3' ,
'CFCHS483x4' ,
'CFCHS483x5' ,
'CFCHS603x2' ,
'CFCHS603x25' ,
'CFCHS603x3' ,
'CFCHS603x4' ,
'CFCHS603x5' ,
'CFCHS761x2' ,
'CFCHS761x25' ,
'CFCHS761x3' ,
'CFCHS761x4' ,
'CFCHS761x5' ,
'CFCHS761x6' ,
'CFCHS761x63' ,
'CFCHS889x2' ,
'CFCHS889x25' ,
'CFCHS889x3' ,
'CFCHS889x4' ,
'CFCHS889x5' ,
'CFCHS889x6' ,
'CFCHS889x63' ,
'CFCHS1016x2' ,
'CFCHS1016x25' ,
'CFCHS1016x3' ,
'CFCHS1016x4' ,
'CFCHS1016x5' ,
'CFCHS1016x6' ,
'CFCHS1016x63' ,
'CFCHS1143x25' ,
'CFCHS1143x3' ,
'CFCHS1143x4' ,
'CFCHS1143x5' ,
'CFCHS1143x6' ,
'CFCHS1143x63' ,
'CFCHS1143x8' ,
'CFCHS1397x3' ,
'CFCHS1397x4' ,
'CFCHS1397x5' ,
'CFCHS1397x6' ,
'CFCHS1397x63' ,
'CFCHS1397x8' ,
'CFCHS1397x10' ,
'CFCHS1683x3' ,
'CFCHS1683x4' ,
'CFCHS1683x5' ,
'CFCHS1683x6' ,
'CFCHS1683x63' ,
'CFCHS1683x8' ,
'CFCHS1683x10' ,
'CFCHS1778x4' ,
'CFCHS1778x5' ,
'CFCHS1778x6' ,
'CFCHS1778x63' ,
'CFCHS1778x8' ,
'CFCHS1778x10' ,
'CFCHS1778x12' ,
'CFCHS1778x125' ,
'CFCHS1937x4' ,
'CFCHS1937x5' ,
'CFCHS1937x56' ,
'CFCHS1937x6' ,
'CFCHS1937x63' ,
'CFCHS1937x8' ,
'CFCHS1937x10' ,
'CFCHS1937x12' ,
'CFCHS1937x125' ,
'CFCHS2191x4' ,
'CFCHS2191x5' ,
'CFCHS2191x59' ,
'CFCHS2191x6' ,
'CFCHS2191x63' ,
'CFCHS2191x8' ,
'CFCHS2191x10' ,
'CFCHS2191x12' ,
'CFCHS2191x125' ,
'CFCHS2445x5' ,
'CFCHS2445x6' ,
'CFCHS2445x63' ,
'CFCHS2445x8' ,
'CFCHS2445x10' ,
'CFCHS2445x12' ,
'CFCHS2445x125' ,
'CFCHS273x5' ,
'CFCHS273x6' ,
'CFCHS273x63' ,
'CFCHS273x8' ,
'CFCHS273x10' ,
'CFCHS273x12' ,
'CFCHS273x125' ,
'CFCHS3239x5' ,
'CFCHS3239x6' ,
'CFCHS3239x63' ,
'CFCHS3239x8' ,
'CFCHS3239x10' ,
'CFCHS3239x12' ,
'CFCHS3239x125' ,
'CFCHS3556x5' ,
'CFCHS3556x6' ,
'CFCHS3556x63' ,
'CFCHS3556x8' ,
'CFCHS3556x10' ,
'CFCHS3556x12' ,
'CFCHS3556x125' ,
'CFCHS3556x16' ,
'CFCHS3556x20' ,
'CFCHS4064x6' ,
'CFCHS4064x63' ,
'CFCHS4064x8' ,
'CFCHS4064x10' ,
'CFCHS4064x12' ,
'CFCHS4064x125' ,
'CFCHS4064x16' ,
'CFCHS4064x20' ,
'CFCHS4064x25' ,
'CFCHS457x6' ,
'CFCHS457x63' ,
'CFCHS457x8' ,
'CFCHS457x10' ,
'CFCHS457x12' ,
'CFCHS457x125' ,
'CFCHS457x16' ,
'CFCHS457x20' ,
'CFCHS457x25' ,
'CFCHS457x30' ,
'CFCHS508x6' ,
'CFCHS508x63' ,
'CFCHS508x8' ,
'CFCHS508x10' ,
'CFCHS508x12' ,
'CFCHS508x125' ,
'CFCHS508x16' ,
'CFCHS508x20' ,
'CFCHS508x25' ,
'CFCHS508x30' ,
'CFCHS610x6' ,
'CFCHS610x63' ,
'CFCHS610x8' ,
'CFCHS610x10' ,
'CFCHS610x12' ,
'CFCHS610x125' ,
'CFCHS610x16' ,
'CFCHS610x20' ,
'CFCHS610x25' ,
'CFCHS610x30' ,
'CFCHS711x6' ,
'CFCHS711x63' ,
'CFCHS711x8' ,
'CFCHS711x10' ,
'CFCHS711x12' ,
'CFCHS711x125' ,
'CFCHS711x16' ,
'CFCHS711x20' ,
'CFCHS711x25' ,
'CFCHS711x30' ,
'CFCHS762x6' ,
'CFCHS762x63' ,
'CFCHS762x8' ,
'CFCHS762x10' ,
'CFCHS762x12' ,
'CFCHS762x125' ,
'CFCHS762x16' ,
'CFCHS762x20' ,
'CFCHS762x25' ,
'CFCHS762x30' ,
'CFCHS813x8' ,
'CFCHS813x10' ,
'CFCHS813x12' ,
'CFCHS813x125' ,
'CFCHS813x16' ,
'CFCHS813x20' ,
'CFCHS813x25' ,
'CFCHS813x30' ,
'CFCHS914x8' ,
'CFCHS914x10' ,
'CFCHS914x12' ,
'CFCHS914x125' ,
'CFCHS914x16' ,
'CFCHS914x20' ,
'CFCHS914x25' ,
'CFCHS914x30' ,
'CFCHS1016x8' ,
'CFCHS1016x10' ,
'CFCHS1016x12' ,
'CFCHS1016x125' ,
'CFCHS1016x16' ,
'CFCHS1016x20' ,
'CFCHS1016x25' ,
'CFCHS1016x30' ,
'CFCHS1067x10' ,
'CFCHS1067x12' ,
'CFCHS1067x125' ,
'CFCHS1067x16' ,
'CFCHS1067x20' ,
'CFCHS1067x25' ,
'CFCHS1067x30' ,
'CFCHS1168x10' ,
'CFCHS1168x12' ,
'CFCHS1168x125' ,
'CFCHS1168x16' ,
'CFCHS1168x20' ,
'CFCHS1168x25' ,
'CFCHS1219x10' ,
'CFCHS1219x12' ,
'CFCHS1219x125' ,
'CFCHS1219x16' ,
'CFCHS1219x20' ,
'CFCHS1219x25' ,
'CFCHS_I213x12' ,
'CFCHS_I213x16' ,
'CFCHS_I269x12' ,
'CFCHS_I269x16' ,
'CFCHS_I269x26' ,
'CFCHS_I337x12' ,
'CFCHS_I337x16' ,
'CFCHS_I337x26' ,
'CFCHS_I337x32' ,
'CFCHS_I337x4' ,
'CFCHS_I424x12' ,
'CFCHS_I424x16' ,
'CFCHS_I424x26' ,
'CFCHS_I424x32' ,
'CFCHS_I483x12' ,
'CFCHS_I483x16' ,
'CFCHS_I483x26' ,
'CFCHS_I483x32' ,
'CFCHS_I603x12' ,
'CFCHS_I603x16' ,
'CFCHS_I603x26' ,
'CFCHS_I603x32' ,
'CFCHS_I761x16' ,
'CFCHS_I761x26' ,
'CFCHS_I761x32' ,
'CFCHS_I889x16' ,
'CFCHS_I889x26' ,
'CFCHS_I889x32' ,
'CFCHS_I1143x2' ,
'CFCHS_I1143x26' ,
'CFCHS_I1143x32' ,
'CFCHS_I1143x71' ,
'CFCHS_I1143x10' ,
'CFCHS_I1397x26' ,
'CFCHS_I1397x32' ,
'CFCHS_I1397x71' ,
'CFCHS_I1683x32' ,
'CFCHS_I1683x71' ,
'CFCHS_I2191x71' ,
'CFCHS_I273x4' ,
'CFCHS_I273x71' ,
'CFCHS_I3239x4' ,
'CFCHS_I3239x71' ,
'CFCHS_I3556x4' ,
'CFCHS_I3556x71' ,
'CFCHS_I4064x4' ,
'CFCHS_I4064x5' ,
'CFCHS_I4064x71' ,
'CFCHS_I457x71' ,
'CFCHS_I508x71' ,
'CFU_eq10x10x10x15' ,
'CFU_eq12x12x12x15' ,
'CFU_eq12x12x12x2' ,
'CFU_eq15x15x15x15' ,
'CFU_eq15x15x15x2' ,
'CFU_eq18x18x18x15' ,
'CFU_eq18x18x18x2' ,
'CFU_eq20x20x20x15' ,
'CFU_eq20x20x20x2' ,
'CFU_eq20x20x20x3' ,
'CFU_eq22x22x22x2' ,
'CFU_eq23x23x23x15' ,
'CFU_eq23x23x23x2' ,
'CFU_eq25x25x25x15' ,
'CFU_eq25x25x25x2' ,
'CFU_eq25x25x25x25' ,
'CFU_eq25x25x25x3' ,
'CFU_eq28x28x28x15' ,
'CFU_eq30x30x30x15' ,
'CFU_eq30x30x30x2' ,
'CFU_eq30x30x30x25' ,
'CFU_eq30x30x30x3' ,
'CFU_eq32x32x32x2' ,
'CFU_eq35x35x35x3' ,
'CFU_eq36x36x36x2' ,
'CFU_eq40x40x40x2' ,
'CFU_eq40x40x40x3' ,
'CFU_eq40x40x40x4' ,
'CFU_eq40x40x40x5' ,
'CFU_eq45x45x45x3' ,
'CFU_eq50x50x50x2' ,
'CFU_eq50x50x50x3' ,
'CFU_eq50x50x50x4' ,
'CFU_eq50x50x50x5' ,
'CFU_eq60x60x60x3' ,
'CFU_eq60x60x60x4' ,
'CFU_eq60x60x60x5' ,
'CFU_eq70x70x70x4' ,
'CFU_eq80x80x80x4' ,
'CFU_eq100x100x100x4' ,
'CFU_ue19x13x19x15' ,
'CFU_ue20x15x20x15' ,
'CFU_ue25x15x25x2' ,
'CFU_ue10x20x10x2' ,
'CFU_ue15x20x15x2' ,
'CFU_ue25x20x25x2' ,
'CFU_ue30x20x30x15' ,
'CFU_ue30x20x30x2' ,
'CFU_ue40x20x40x2' ,
'CFU_ue35x22x35x2' ,
'CFU_ue15x25x15x15' ,
'CFU_ue15x25x15x2' ,
'CFU_ue35x25x35x2' ,
'CFU_ue54x28x54x3' ,
'CFU_ue15x30x15x2' ,
'CFU_ue15x30x15x3' ,
'CFU_ue20x30x20x2' ,
'CFU_ue20x30x20x3' ,
'CFU_ue40x30x40x2' ,
'CFU_ue40x30x40x3' ,
'CFU_ue50x30x50x2' ,
'CFU_ue50x30x50x3' ,
'CFU_ue48x33x48x3' ,
'CFU_ue20x34x20x2' ,
'CFU_ue30x35x30x3' ,
'CFU_ue12x36x12x2' ,
'CFU_ue50x37x50x3' ,
'CFU_ue15x40x15x2' ,
'CFU_ue20x40x20x2' ,
'CFU_ue20x40x20x3' ,
'CFU_ue25x40x25x2' ,
'CFU_ue25x40x25x3' ,
'CFU_ue30x40x30x2' ,
'CFU_ue30x40x30x3' ,
'CFU_ue50x40x50x3' ,
'CFU_ue60x40x60x3' ,
'CFU_ue32x44x32x3' ,
'CFU_ue20x45x20x4' ,
'CFU_ue40x45x40x2' ,
'CFU_ue20x50x20x15' ,
'CFU_ue20x50x20x2' ,
'CFU_ue20x50x20x3' ,
'CFU_ue25x50x25x2' ,
'CFU_ue25x50x25x3' ,
'CFU_ue30x50x30x2' ,
'CFU_ue30x50x30x3' ,
'CFU_ue40x50x40x2' ,
'CFU_ue40x50x40x3' ,
'CFU_ue40x50x40x4' ,
'CFU_ue70x50x70x4' ,
'CFU_ue30x55x30x2' ,
'CFU_ue30x55x30x5' ,
'CFU_ue30x60x30x2' ,
'CFU_ue30x60x30x3' ,
'CFU_ue30x60x30x4' ,
'CFU_ue40x60x40x2' ,
'CFU_ue40x60x40x3' ,
'CFU_ue40x60x40x4' ,
'CFU_ue50x60x50x3' ,
'CFU_ue40x65x40x4' ,
'CFU_ue40x65x40x5' ,
'CFU_ue42x65x42x5' ,
'CFU_ue425x65x425x4' ,
'CFU_ue20x70x20x2' ,
'CFU_ue25x70x25x3' ,
'CFU_ue30x70x30x2' ,
'CFU_ue30x70x30x25' ,
'CFU_ue30x70x30x3' ,
'CFU_ue35x70x35x3' ,
'CFU_ue35x70x35x4' ,
'CFU_ue40x70x40x3' ,
'CFU_ue40x70x40x4' ,
'CFU_ue50x70x50x4' ,
'CFU_ue30x80x30x3' ,
'CFU_ue30x80x30x3' ,
'CFU_ue40x80x40x3' ,
'CFU_ue40x80x40x4' ,
'CFU_ue45x80x45x3' ,
'CFU_ue45x80x45x4' ,
'CFU_ue45x80x45x5' ,
'CFU_ue45x80x45x6' ,
'CFU_ue50x80x50x3' ,
'CFU_ue50x80x50x4' ,
'CFU_ue50x80x50x5' ,
'CFU_ue50x80x50x6' ,
'CFU_ue60x80x60x6' ,
'CFU_ue30x90x30x225' ,
'CFU_ue30x90x30x3' ,
'CFU_ue40x90x40x3' ,
'CFU_ue40x90x40x4' ,
'CFU_ue30x100x30x3' ,
'CFU_ue30x100x30x4' ,
'CFU_ue40x100x40x3' ,
'CFU_ue40x100x40x4' ,
'CFU_ue40x100x40x5' ,
'CFU_ue50x100x50x3' ,
'CFU_ue50x100x50x4' ,
'CFU_ue50x100x50x5' ,
'CFU_ue50x100x50x6' ,
'CFU_ue60x100x60x4' ,
'CFU_ue60x100x60x5' ,
'CFU_ue60x100x60x6' ,
'CFU_ue50x110x50x3' ,
'CFU_ue50x110x50x4' ,
'CFU_ue50x110x50x5' ,
'CFU_ue50x120x50x3' ,
'CFU_ue50x120x50x4' ,
'CFU_ue50x120x50x5' ,
'CFU_ue50x120x50x6' ,
'CFU_ue60x120x60x4' ,
'CFU_ue60x120x60x5' ,
'CFU_ue60x120x60x6' ,
'CFU_ue41x133x41x3' ,
'CFU_ue40x140x40x3' ,
'CFU_ue50x140x50x4' ,
'CFU_ue50x140x50x5' ,
'CFU_ue60x140x60x4' ,
'CFU_ue60x140x60x5' ,
'CFU_ue60x140x60x6' ,
'CFU_ue65x140x65x6' ,
'CFU_ue80x140x80x3' ,
'CFU_ue80x140x80x4' ,
'CFU_ue50x150x50x4' ,
'CFU_ue50x150x50x5' ,
'CFU_ue50x160x50x4' ,
'CFU_ue50x160x50x5' ,
'CFU_ue60x160x60x4' ,
'CFU_ue60x160x60x5' ,
'CFU_ue60x160x60x6' ,
'CFU_ue65x160x65x6' ,
'CFU_ue70x160x70x4' ,
'CFU_ue70x160x70x5' ,
'CFU_ue35x180x35x4' ,
'CFU_ue50x180x50x4' ,
'CFU_ue60x180x60x4' ,
'CFU_ue60x180x60x5' ,
'CFU_ue60x200x60x4' ,
'CFU_ue60x200x60x5' ,
'CFU_ue60x200x60x6' ,
'CFU_ue70x200x70x5' ,
'CFU_ue80x200x80x4' ,
'CFU_ue80x200x80x5' ,
'CFRHS20x20x2' ,
'CFRHS25x25x2' ,
'CFRHS25x25x25' ,
'CFRHS25x25x3' ,
'CFRHS30x30x2' ,
'CFRHS30x30x25' ,
'CFRHS30x30x3' ,
'CFRHS40x40x2' ,
'CFRHS40x40x25' ,
'CFRHS40x40x3' ,
'CFRHS40x40x4' ,
'CFRHS50x50x2' ,
'CFRHS50x50x25' ,
'CFRHS50x50x3' ,
'CFRHS50x50x4' ,
'CFRHS50x50x5' ,
'CFRHS60x60x2' ,
'CFRHS60x60x25' ,
'CFRHS60x60x3' ,
'CFRHS60x60x4' ,
'CFRHS60x60x5' ,
'CFRHS60x60x6' ,
'CFRHS60x60x63' ,
'CFRHS70x70x25' ,
'CFRHS70x70x3' ,
'CFRHS70x70x4' ,
'CFRHS70x70x5' ,
'CFRHS70x70x6' ,
'CFRHS70x70x63' ,
'CFRHS80x80x3' ,
'CFRHS80x80x4' ,
'CFRHS80x80x5' ,
'CFRHS80x80x6' ,
'CFRHS80x80x63' ,
'CFRHS80x80x8' ,
'CFRHS90x90x3' ,
'CFRHS90x90x4' ,
'CFRHS90x90x5' ,
'CFRHS90x90x6' ,
'CFRHS90x90x63' ,
'CFRHS90x90x8' ,
'CFRHS100x100x3' ,
'CFRHS100x100x4' ,
'CFRHS100x100x5' ,
'CFRHS100x100x6' ,
'CFRHS100x100x63' ,
'CFRHS100x100x8' ,
'CFRHS100x100x10' ,
'CFRHS100x100x12' ,
'CFRHS100x100x125' ,
'CFRHS120x120x3' ,
'CFRHS120x120x4' ,
'CFRHS120x120x5' ,
'CFRHS120x120x6' ,
'CFRHS120x120x63' ,
'CFRHS120x120x8' ,
'CFRHS120x120x10' ,
'CFRHS120x120x12' ,
'CFRHS120x120x125' ,
'CFRHS140x140x4' ,
'CFRHS140x140x5' ,
'CFRHS140x140x6' ,
'CFRHS140x140x63' ,
'CFRHS140x140x8' ,
'CFRHS140x140x10' ,
'CFRHS140x140x12' ,
'CFRHS140x140x125' ,
'CFRHS150x150x4' ,
'CFRHS150x150x5' ,
'CFRHS150x150x6' ,
'CFRHS150x150x63' ,
'CFRHS150x150x8' ,
'CFRHS150x150x10' ,
'CFRHS150x150x12' ,
'CFRHS150x150x125' ,
'CFRHS150x150x16' ,
'CFRHS160x160x4' ,
'CFRHS160x160x5' ,
'CFRHS160x160x6' ,
'CFRHS160x160x63' ,
'CFRHS160x160x8' ,
'CFRHS160x160x10' ,
'CFRHS160x160x12' ,
'CFRHS160x160x125' ,
'CFRHS160x160x16' ,
'CFRHS180x180x4' ,
'CFRHS180x180x5' ,
'CFRHS180x180x6' ,
'CFRHS180x180x63' ,
'CFRHS180x180x8' ,
'CFRHS180x180x10' ,
'CFRHS180x180x12' ,
'CFRHS180x180x125' ,
'CFRHS180x180x16' ,
'CFRHS200x200x4' ,
'CFRHS200x200x5' ,
'CFRHS200x200x6' ,
'CFRHS200x200x63' ,
'CFRHS200x200x8' ,
'CFRHS200x200x10' ,
'CFRHS200x200x12' ,
'CFRHS200x200x125' ,
'CFRHS200x200x16' ,
'CFRHS220x220x4' ,
'CFRHS220x220x5' ,
'CFRHS220x220x6' ,
'CFRHS220x220x63' ,
'CFRHS220x220x8' ,
'CFRHS220x220x10' ,
'CFRHS220x220x12' ,
'CFRHS220x220x125' ,
'CFRHS220x220x16' ,
'CFRHS250x250x5' ,
'CFRHS250x250x6' ,
'CFRHS250x250x63' ,
'CFRHS250x250x8' ,
'CFRHS250x250x10' ,
'CFRHS250x250x12' ,
'CFRHS250x250x125' ,
'CFRHS250x250x16' ,
'CFRHS260x260x6' ,
'CFRHS260x260x63' ,
'CFRHS260x260x8' ,
'CFRHS260x260x10' ,
'CFRHS260x260x12' ,
'CFRHS260x260x125' ,
'CFRHS260x260x16' ,
'CFRHS300x300x6' ,
'CFRHS300x300x63' ,
'CFRHS300x300x8' ,
'CFRHS300x300x10' ,
'CFRHS300x300x12' ,
'CFRHS300x300x125' ,
'CFRHS300x300x16' ,
'CFRHS350x350x8' ,
'CFRHS350x350x10' ,
'CFRHS350x350x12' ,
'CFRHS350x350x125' ,
'CFRHS350x350x16' ,
'CFRHS400x400x10' ,
'CFRHS400x400x12' ,
'CFRHS400x400x125' ,
'CFRHS400x400x16' ,
'CFRHS_I20x20x12' ,
'CFRHS_I20x20x16' ,
'CFRHS_I20x20x2' ,
'CFRHS_I30x30x12' ,
'CFRHS_I30x30x16' ,
'CFRHS_I30x30x2' ,
'CFRHS_I30x30x26' ,
'CFRHS_I40x40x12' ,
'CFRHS_I40x40x16' ,
'CFRHS_I40x40x2' ,
'CFRHS_I40x40x26' ,
'CFRHS_I40x40x32' ,
'CFRHS_I40x40x4' ,
'CFRHS_I50x50x16' ,
'CFRHS_I50x50x2' ,
'CFRHS_I50x50x26' ,
'CFRHS_I50x50x32' ,
'CFRHS_I50x50x4' ,
'CFRHS_I50x50x5' ,
'CFRHS_I60x60x16' ,
'CFRHS_I60x60x2' ,
'CFRHS_I60x60x26' ,
'CFRHS_I60x60x32' ,
'CFRHS_I60x60x4' ,
'CFRHS_I60x60x5' ,
'CFRHS_I70x70x16' ,
'CFRHS_I70x70x2' ,
'CFRHS_I70x70x26' ,
'CFRHS_I70x70x32' ,
'CFRHS_I70x70x4' ,
'CFRHS_I70x70x5' ,
'CFRHS_I80x80x2' ,
'CFRHS_I80x80x26' ,
'CFRHS_I80x80x32' ,
'CFRHS_I80x80x4' ,
'CFRHS_I80x80x5' ,
'CFRHS_I90x90x2' ,
'CFRHS_I90x90x26' ,
'CFRHS_I90x90x32' ,
'CFRHS_I90x90x4' ,
'CFRHS_I90x90x5' ,
'CFRHS_I90x90x63' ,
'CFRHS_I100x100x26' ,
'CFRHS_I100x100x32' ,
'CFRHS_I100x100x4' ,
'CFRHS_I100x100x5' ,
'CFRHS_I100x100x63' ,
'CFRHS_I100x100x71' ,
'CFRHS_I115x115x26' ,
'CFRHS_I115x115x32' ,
'CFRHS_I115x115x4' ,
'CFRHS_I115x115x5' ,
'CFRHS_I115x115x63' ,
'CFRHS_I115x115x71' ,
'CFRHS_I120x120x32' ,
'CFRHS_I120x120x4' ,
'CFRHS_I120x120x5' ,
'CFRHS_I120x120x63' ,
'CFRHS_I120x120x71' ,
'CFRHS_I120x120x8' ,
'CFRHS_I120x120x10' ,
'CFRHS_I135x135x32' ,
'CFRHS_I135x135x4' ,
'CFRHS_I135x135x5' ,
'CFRHS_I135x135x63' ,
'CFRHS_I135x135x71' ,
'CFRHS_I135x135x8' ,
'CFRHS_I135x135x10' ,
'CFRHS_I140x140x4' ,
'CFRHS_I140x140x5' ,
'CFRHS_I140x140x63' ,
'CFRHS_I140x140x71' ,
'CFRHS_I140x140x8' ,
'CFRHS_I140x140x10' ,
'CFRHS_I150x150x4' ,
'CFRHS_I150x150x5' ,
'CFRHS_I150x150x63' ,
'CFRHS_I150x150x71' ,
'CFRHS_I150x150x8' ,
'CFRHS_I150x150x10' ,
'CFRHS_I160x160x4' ,
'CFRHS_I160x160x5' ,
'CFRHS_I160x160x63' ,
'CFRHS_I160x160x71' ,
'CFRHS_I160x160x8' ,
'CFRHS_I160x160x10' ,
'CFRHS_I175x175x4' ,
'CFRHS_I175x175x5' ,
'CFRHS_I175x175x63' ,
'CFRHS_I175x175x71' ,
'CFRHS_I175x175x8' ,
'CFRHS_I175x175x10' ,
'CFRHS_I180x180x4' ,
'CFRHS_I180x180x5' ,
'CFRHS_I180x180x63' ,
'CFRHS_I180x180x71' ,
'CFRHS_I180x180x8' ,
'CFRHS_I180x180x10' ,
'CFRHS_I180x180x125' ,
'CFRHS_I200x200x4' ,
'CFRHS_I200x200x5' ,
'CFRHS_I200x200x63' ,
'CFRHS_I200x200x71' ,
'CFRHS_I200x200x8' ,
'CFRHS_I200x200x10' ,
'CFRHS_I200x200x125' ,
'CFRHS_I220x220x4' ,
'CFRHS_I220x220x5' ,
'CFRHS_I220x220x63' ,
'CFRHS_I220x220x71' ,
'CFRHS_I220x220x8' ,
'CFRHS_I220x220x10' ,
'CFRHS_I220x220x125' ,
'CFRHS_I250x250x4' ,
'CFRHS_I250x250x5' ,
'CFRHS_I250x250x63' ,
'CFRHS_I250x250x71' ,
'CFRHS_I250x250x8' ,
'CFRHS_I250x250x10' ,
'CFRHS_I250x250x125' ,
'CFRHS_I260x260x4' ,
'CFRHS_I260x260x5' ,
'CFRHS_I260x260x63' ,
'CFRHS_I260x260x71' ,
'CFRHS_I260x260x8' ,
'CFRHS_I260x260x10' ,
'CFRHS_I260x260x125' ,
'CFRHS_I285x285x4' ,
'CFRHS_I285x285x5' ,
'CFRHS_I285x285x63' ,
'CFRHS_I285x285x71' ,
'CFRHS_I285x285x8' ,
'CFRHS_I285x285x10' ,
'CFRHS_I285x285x125' ,
'CFRHS_I300x300x4' ,
'CFRHS_I300x300x5' ,
'CFRHS_I300x300x63' ,
'CFRHS_I300x300x71' ,
'CFRHS_I300x300x8' ,
'CFRHS_I300x300x10' ,
'CFRHS_I300x300x125' ,
'CFRHS_I325x325x4' ,
'CFRHS_I325x325x5' ,
'CFRHS_I325x325x63' ,
'CFRHS_I325x325x71' ,
'CFRHS_I325x325x8' ,
'CFRHS_I325x325x10' ,
'CFRHS_I325x325x125' ,
'CFRHS_I350x350x63' ,
'CFRHS_I350x350x71' ,
'CFRHS_I350x350x8' ,
'CFRHS_I350x350x10' ,
'CFRHS_I350x350x125' ,
'CFRHS_I400x400x8' ,
'CFRHS_I400x400x10' ,
'CFRHS_I400x400x125' ,
'S20x3' ,
'S20x4' ,
'S20x5' ,
'S20x6' ,
'S20x8' ,
'S20x10' ,
'S20x12' ,
'S20x15' ,
'S25x3' ,
'S25x4' ,
'S25x5' ,
'S25x6' ,
'S25x8' ,
'S25x10' ,
'S25x12' ,
'S25x15' ,
'S30x3' ,
'S30x4' ,
'S30x5' ,
'S30x6' ,
'S30x8' ,
'S30x10' ,
'S30x12' ,
'S30x15' ,
'S30x20' ,
'S35x4' ,
'S35x5' ,
'S35x6' ,
'S35x8' ,
'S35x10' ,
'S35x12' ,
'S35x15' ,
'S40x3' ,
'S40x4' ,
'S40x5' ,
'S40x6' ,
'S40x8' ,
'S40x10' ,
'S40x12' ,
'S40x15' ,
'S40x20' ,
'S40x25' ,
'S50x3' ,
'S50x4' ,
'S50x5' ,
'S50x6' ,
'S50x8' ,
'S50x10' ,
'S50x12' ,
'S50x15' ,
'S50x20' ,
'S50x25' ,
'S50x30' ,
'S60x4' ,
'S60x5' ,
'S60x6' ,
'S60x8' ,
'S60x10' ,
'S60x12' ,
'S60x15' ,
'S60x20' ,
'S60x25' ,
'S60x30' ,
'S60x40' ,
'S60x50' ,
'S70x5' ,
'S70x6' ,
'S70x8' ,
'S70x10' ,
'S70x12' ,
'S70x15' ,
'S70x20' ,
'S70x25' ,
'S70x30' ,
'S70x40' ,
'S70x50' ,
'S75x5' ,
'S75x6' ,
'S75x8' ,
'S75x10' ,
'S75x12' ,
'S75x15' ,
'S75x20' ,
'S75x25' ,
'S75x30' ,
'S75x40' ,
'S75x50' ,
'S80x5' ,
'S80x6' ,
'S80x8' ,
'S80x10' ,
'S80x12' ,
'S80x15' ,
'S80x20' ,
'S80x25' ,
'S80x30' ,
'S90x5' ,
'S90x6' ,
'S90x8' ,
'S90x10' ,
'S90x12' ,
'S90x15' ,
'S90x20' ,
'S90x25' ,
'S100x4' ,
'S100x5' ,
'S100x6' ,
'S100x8' ,
'S100x10' ,
'S100x12' ,
'S100x15' ,
'S100x20' ,
'S100x25' ,
'S100x30' ,
'S100x40' ,
'S100x50' ,
'S120x6' ,
'S120x8' ,
'S120x10' ,
'S120x12' ,
'S120x15' ,
'S120x20' ,
'S120x25' ,
'S120x30' ,
'S130x6' ,
'S130x8' ,
'S130x10' ,
'S130x12' ,
'S130x15' ,
'S130x20' ,
'S130x25' ,
'S140x8' ,
'S140x10' ,
'S140x12' ,
'S140x15' ,
'S140x20' ,
'S140x25' ,
'S150x6' ,
'S150x8' ,
'S150x10' ,
'S150x12' ,
'S150x15' ,
'S150x20' ,
'S150x25' ,
'S150x30' ,
'S150x40' ,
'S150x50' ,
'S160x8' ,
'S160x10' ,
'S160x12' ,
'S160x15' ,
'S160x20' ,
'S165x5' ,
'S165x6' ,
'S165x8' ,
'S165x10' ,
'S165x12' ,
'S165x15' ,
'S165x20' ,
'S165x25' ,
'S180x5' ,
'S180x6' ,
'S180x8' ,
'S180x10' ,
'S180x12' ,
'S180x15' ,
'S180x20' ,
'S180x25' ,
'S180x30' ,
'S200x5' ,
'S200x6' ,
'S200x8' ,
'S200x10' ,
'S200x12' ,
'S200x15' ,
'S200x20' ,
'S200x25' ,
'S200x30' ,
'S200x40' ,
'S230x5' ,
'S230x6' ,
'S230x8' ,
'S230x10' ,
'S230x12' ,
'S230x15' ,
'S230x20' ,
'S230x25' ,
'S250x5' ,
'S250x6' ,
'S250x8' ,
'S250x10' ,
'S250x12' ,
'S250x15' ,
'S250x20' ,
'S250x25' ,
'S250x30' ,
'S300x5' ,
'S300x6' ,
'S300x8' ,
'S300x10' ,
'S300x12' ,
'S300x15' ,
'S300x20' ,
'S300x25' ,
'S350x6' ,
'S350x8' ,
'S350x10' ,
'S350x12' ,
'S350x15' ,
'S350x20' ,
'S350x25' ,
'S400x6' ,
'S400x8' ,
'S400x10' ,
'S400x12' ,
'S400x15' ,
'S400x20' ,
'S450x6' ,
'S450x8' ,
'S450x10' ,
'S450x12' ,
'S450x15' ,
'S500x8' ,
'S500x10' ,
'S500x12' ,
'S500x15' ,
'S500x20' ,
'S6x6' ,
'S8x8' ,
'S10x10' ,
'S12x12' ,
'S14x14' ,
'S16x16' ,
'S18x18' ,
'S19x19' ,
'S20x20' ,
'S25x25' ,
'S30x30' ,
'S32x32' ,
'S35x35' ,
'S40x40' ,
'S45x45' ,
'S50x50' ,
'S55x55' ,
'S60x60' ,
'S70x70' ,
'S75x75' ,
'S80x80' ,
'S100x100' ,
'R8 ' ,
'R10' ,
'R12' ,
'R14' ,
'R15' ,
'R16' ,
'R18' ,
'R19' ,
'R20' ,
'R22' ,
'R24' ,
'R25' ,
'R27' ,
'R28' ,
'R30' ,
'R31' ,
'R32' ,
'R35' ,
'R38' ,
'R40' ,
'R45' ,
'R50' ,
'R55' ,
'R60' ,
'R65' ,
'R70' ,
'R75' ,
'R80' ,
'R90' ,
'R100' ,
''
)
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