# Dynamo graph XFEM4U To Revit Rebar.dyn (Dynamo 2.12.1.8246)
# packages: Dyn2Calc.Struct4U 0.0.4

file_path = Filename("C:\TEMP\Test.xml")
dyn2Calc_XFEM4U_ImportXML = Custom[Dyn2Calc_XFEM4U_ImportXML](xmlFile=file_path)  # package Dyn2Calc.Struct4U; Import XFEM4U XML and convert to points, lines and metadata
watch = Watch(dyn2Calc_XFEM4U_ImportXML.XFEM4U_XMLData_RebarLongitudinal)
