# Dynamo graph XFEM4U To Revit.dyn (Dynamo 2.12.1.8246)
# packages: Dyn2Calc.Struct4U 0.0.2, Dyn2Calc.Struct4U 0.0.4

code_block = CodeBlock { 0; 0; 3000; 3000; }
file_path = Filename("..\..\..\..\..\..\Desktop\TEMP\test balken met wapening.xml")  # graph input
dyn2Calc_XFEM4U_ImportXML = Custom[Dyn2Calc_XFEM4U_ImportXML](xmlFile=file_path)  # package Dyn2Calc.Struct4U; Import XFEM4U XML and convert to points, lines and metadata
dyn2Calc_XFEM4U_Grids = Custom[Dyn2Calc_XFEM4U_Grids](dx=code_block.out0, dy=code_block.out1, ExtensionGridX=code_block.out2, ExtensionGridY=code_block.out3, XFEM4UXML_Grids=dyn2Calc_XFEM4U_ImportXML.XFEM4U_XMLData_Grids)  # frozen; package Dyn2Calc.Struct4U; Create Grids in Revit based on XFEM4U XMLImport
dyn2Calc_XFEM4U_SplitColumnsFramingsMate = Custom[Dyn2Calc_XFEM4U_SplitColumnsFramingsMaterial](XFEM4UXMLData_Beams=dyn2Calc_XFEM4U_ImportXML.XFEM4U_XMLData_Beams, XFEM4UXMLData_Profiles=dyn2Calc_XFEM4U_ImportXML.XFEM4U_XMLData_Profiles)  # frozen; package Dyn2Calc.Struct4U; Split Beams from XFEM4U in Columns, Framings and order per material
levels = Levels("Level 1")
family_types = FamilyTypes("NLRS_28_SC_HEA:HEA100")
family_types_2 = FamilyTypes("NLRS_28_SFR_HEA:HEA100")
dyn2Calc_XFEM4U_PlaceSteelColumnsFraming = Custom[Dyn2Calc_XFEM4U_PlaceSteelColumnsFramings](Data_Structural_Column_Steel=dyn2Calc_XFEM4U_SplitColumnsFramingsMate.Data_Structural_Column_Steel, Data_Structural_Framing_Steel=dyn2Calc_XFEM4U_SplitColumnsFramingsMate.Data_Structural_Framing_Steel, Level_To_Place=levels, FamilyType_Unknown_Column=family_types, FamilyType_Unknown_Framing=family_types_2)  # package Dyn2Calc.Struct4U; Place Structural Columns and Framings from an XML-file generated by XFEM4U
code_block_2 = CodeBlock { "NLRS_23_FL_ihwg_beton_300"; }
byName = FloorType.ByName(name=code_block_2)
dyn2Calc_XFEM4U_PlateToWallFloor = Custom[Dyn2Calc_XFEM4U_PlateToWallFloor](XFEM4UXMLData_Plates=dyn2Calc_XFEM4U_ImportXML.XFEM4U_XMLData_Plates, Level_To_Place=levels, StandardFloorType=byName)  # package Dyn2Calc.Struct4U; Create Revit Floors, directshape from the XML from XFEM4U
string = StringInput("C:\Users\mikev\Documents\GitHub\Dyn2Calc.Struct4U\Nodes\XFEM4U\extra\Families")
dyn2Calc_XFEM4U_LoadFamilies = Custom[Dyn2Calc_XFEM4U_LoadFamilies](path=string)  # package Dyn2Calc.Struct4U; Load Families for Structural Columns Framings etc
