# Dynamo custom node Xframe3DImportXML.dyf (Dynamo 2.3.0.5885)
# category: Dyn2Calc.Xframe3d
# Import Xframe3D XML and convert to points, lines and metadata

file_path = Filename("Examples\staal_edit.xml")  # graph input
xmlFile = Input(xmlFile: var[]..[])
readText = FileSystem.ReadText(file=xmlFile)

# group: PROJECTINFORMATION
code_block = CodeBlock { ".ProjectName"; ".ProjectNumber"; ".ExportDateTime"; ".XMLExportVersion"; }
create = List.Create(item0=code_block.out0, item1=code_block.out1, item2=code_block.out2, item3=code_block.out3)
python_script = Python(IN[0]=readText, IN[1]=create)
# ---------- python_script.python (19 lines) ----------
import sys
sys.path.append("C:\Program Files (x86)\IronPython 2.7\Lib")
import xml.etree.ElementTree as ET

xml = IN[0]
xpathstr = IN[1]

root = ET.fromstring(xml)

xpathfound = []
for i in xpathstr:
	xpathfound.append(root.findall(i))

xtext = []
for i in xpathfound:
	for j in i:
		xtext.append(j.text)

OUT = xtext
# ----------------------------------------

projectInformation = Output(python_script)

# group: NODES
code_block_2 = CodeBlock { ".Nodes/Number"; ".Nodes/X"; ".Nodes/Y"; ".Nodes/Z"; }
create_2 = List.Create(item0=code_block_2.out0, item1=code_block_2.out1, item2=code_block_2.out2, item3=code_block_2.out3)
python_script_2 = Python(IN[0]=readText, IN[1]=create_2)
# ---------- python_script_2.python (22 lines) ----------
import sys
sys.path.append("C:\Program Files (x86)\IronPython 2.7\Lib")
import xml.etree.ElementTree as ET

xml = IN[0]
xpathstr = IN[1]

root = ET.fromstring(xml)

xpathfound = []
for i in xpathstr:
	xpathfound.append(root.findall(i))

xtext = []
for i in xpathfound:
	temp = []
	
	for j in i:
		temp.append(j.text)
	xtext.append(temp)

OUT = xtext
# ----------------------------------------
toNumber = String.ToNumber(str=python_script_2)
code_block_3 = CodeBlock(point=toNumber) { point[0]; point[1]; point[2]; point[3]; }
byCoordinates = Point.ByCoordinates(x=code_block_3.out1, y=code_block_3.out2, z=code_block_3.out3)

nodes = Output(byCoordinates)
nodeNumbers = Output(code_block_3.out0)

# group: GRIDS
code_block_4 = CodeBlock { ".Grids/X"; ".Grids/X_Lable"; ".Grids/Y"; ".Grids/Y_Lable"; ".Grids/Z"; ".Grids/Z_Lable"; }
create_3 = List.Create(item0=code_block_4.out0, item1=code_block_4.out1, item2=code_block_4.out2, item3=code_block_4.out3, item4=code_block_4.out4, item5=code_block_4.out5)
python_script_3 = Python(IN[0]=readText, IN[1]=create_3)  # same code as python_script_2
code_block_5 = CodeBlock(grid=python_script_3) { grid[0]; grid[1]; grid[2]; grid[3]; grid[4]; grid[5]; }

gridX = Output(code_block_5.out0)
gridXLable = Output(code_block_5.out1)
gridY = Output(code_block_5.out2)
gridYLable = Output(code_block_5.out3)
gridZ = Output(code_block_5.out4)
gridZLable = Output(code_block_5.out5)

# group: PROFILES
code_block_6 = CodeBlock { ".Profiles/Number"; ".Profiles/Profile_name"; ".Profiles/Material_type"; ".Profiles/Material"; ".Profiles/Angle"; }
create_4 = List.Create(item0=code_block_6.out0, item1=code_block_6.out1, item2=code_block_6.out2, item3=code_block_6.out3, item4=code_block_6.out4)
python_script_4 = Python(IN[0]=readText, IN[1]=create_4)  # same code as python_script_2
code_block_7 = CodeBlock(profile=python_script_4) { profile[0]; profile[1]; profile[2]; profile[3]; profile[4]; }

profileName = Output(code_block_7.out1)
profileMaterialType = Output(code_block_7.out2)
profileMaterial = Output(code_block_7.out3)
profileAngle = Output(code_block_7.out4)

# group: BEAMS
code_block_8 = CodeBlock()
# ---------- code_block_8.designscript (8 lines) ----------
".Beams/Number";
".Beams/From_node_number";
".Beams/To_node_number";
".Beams/Angle";
".Beams/Angle_profile";
".Beams/Profile_name";
".Beams/Z";
".Beams/Top_Center_Bottom";
# ----------------------------------------
create_5 = List.Create(item0=code_block_8.out0, item1=code_block_8.out1, item2=code_block_8.out2, item3=code_block_8.out3, item4=code_block_8.out4, item5=code_block_8.out5, item6=code_block_8.out6, item7=code_block_8.out7)
python_script_5 = Python(IN[0]=readText, IN[1]=create_5)  # same code as python_script_2
code_block_9 = CodeBlock(beam=python_script_5) { beam[0]; beam[1]; beam[2]; beam[3]; beam[4]; beam[5]; beam[6]; beam[7]; }
toNumber_2 = String.ToNumber(str=code_block_9.out1)
python_script_6 = Python(IN[0]=code_block_3.out0, IN[1]=toNumber_2)
# ---------- python_script_6.python (15 lines) ----------
import clr
clr.AddReference('ProtoGeometry')
from Autodesk.DesignScript.Geometry import *
#The inputs to this node will be stored as a list in the IN variables.
dataEnteringNode = IN

lst = IN[0]
value = IN[1]

indices = []
for i in value:
	indices.append(lst.index(i))

#Assign your output to the OUT variable.
OUT = indices
# ----------------------------------------
getItemAtIndex = List.GetItemAtIndex(list=byCoordinates, index=python_script_6)
toNumber_3 = String.ToNumber(str=code_block_9.out2)
python_script_7 = Python(IN[0]=code_block_3.out0, IN[1]=toNumber_3)  # same code as python_script_6
getItemAtIndex_2 = List.GetItemAtIndex(list=byCoordinates, index=python_script_7)

beamFromNodeNumber = Output(getItemAtIndex)
beamAngle = Output(code_block_9.out3)
beamNumber = Output(code_block_9.out0)
beamToNodeNumber = Output(getItemAtIndex_2)
beamAngleProfile = Output(code_block_9.out4)
beamProfileName = Output(code_block_9.out5)
beamZ = Output(code_block_9.out6)
beam_TopCenterBottom = Output(code_block_9.out7)

# group: GRID X
toNumber_4 = String.ToNumber(str=code_block_5.out0)
toNumber_5 = String.ToNumber(str=code_block_5.out2)
maximumItem = List.MaximumItem(list=toNumber_5)
code_block_10 = CodeBlock(xmax=maximumItem) { 0; -3000; xmax+3000; }
byCoordinates_2 = Point.ByCoordinates(x=toNumber_4, y=code_block_10.out1, z=code_block_10.out0)
byCoordinates_3 = Point.ByCoordinates(x=toNumber_4, y=code_block_10.out2, z=code_block_10.out0)
byStartPointEndPoint = Line.ByStartPointEndPoint(startPoint=byCoordinates_2, endPoint=byCoordinates_3)

gridXline = Output(byStartPointEndPoint)

# group: GRID Y
toNumber_6 = String.ToNumber(str=code_block_5.out0)
maximumItem_2 = List.MaximumItem(list=toNumber_6)
code_block_11 = CodeBlock(xmax=maximumItem_2) { 0; -3000; xmax+3000; }
toNumber_7 = String.ToNumber(str=code_block_5.out2)
byCoordinates_4 = Point.ByCoordinates(x=code_block_11.out1, y=toNumber_7, z=code_block_11.out0)
byCoordinates_5 = Point.ByCoordinates(x=code_block_11.out2, y=toNumber_7, z=code_block_11.out0)
byStartPointEndPoint_2 = Line.ByStartPointEndPoint(startPoint=byCoordinates_4, endPoint=byCoordinates_5)

gridYline = Output(byStartPointEndPoint_2)

# group: SUPPORTS
code_block_12 = CodeBlock { ".Supports/Number"; ".Supports/Nodenumber"; ".Supports/dx"; ".Supports/dy"; ".Supports/dz"; }
create_6 = List.Create(item0=code_block_12.out0, item1=code_block_12.out1, item2=code_block_12.out2, item3=code_block_12.out3, item4=code_block_12.out4)
python_script_8 = Python(IN[0]=readText, IN[1]=create_6)  # same code as python_script_2
code_block_13 = CodeBlock(Supports=python_script_8) { Supports[0]; Supports[1]; Supports[2]; Supports[3]; Supports[4]; }

support_number = Output(code_block_13.out0)
support_nodenumber = Output(code_block_13.out1)
support_dx = Output(code_block_13.out2)
support_dy = Output(code_block_13.out3)
support_dz = Output(code_block_13.out4)
