# Dynamo custom node Dyn2Calc_XFEM4U_PlaceSteelColumnsFramings.dyf (Dynamo 2.10.1.3976)
# category: Dyn2Calc.Struct4U
# Place Structural Columns and Framings from an XML-file generated by XFEM4U
# packages: Clockwork for Dynamo 2.x 2.3.0, Dyn2Calc.Struct4U 0.0.1, spring nodes 204.1.0

Data_Structural_Framing_Steel = Input(Data_Structural_Framing_Steel: var[]..[])
transpose = List.Transpose(lists=Data_Structural_Framing_Steel)
code_block = CodeBlock(a=transpose) { a[11]; }
Level_To_Place = Input(Level_To_Place: var[]..[])
dyn2Calc_XFEM4U_SteelSectionsNames = Custom[Dyn2Calc_XFEM4U_SteelSectionsNames]()  # package Dyn2Calc.Struct4U; Mapping node for XFEM4U Sectionnames and Revit Type Names

# group: STEEL FAMILY TYPES
code_block_2 = CodeBlock { "steelprofiletypelistnumber"; }

dyn2Calc_XFEM4U_Settings = Custom[Dyn2Calc_XFEM4U_Settings](SearchSetting=code_block_2)  # package Dyn2Calc.Struct4U; Settings regarding familiies, materials etc

# group (continued): STEEL FAMILY TYPES
python_script = Python(IN[0]=dyn2Calc_XFEM4U_SteelSectionsNames.XFEM4U_Steelsectionnames, IN[1]=dyn2Calc_XFEM4U_SteelSectionsNames.Revit_SteelsectionTypeNames, IN[2]=transpose, IN[3]=dyn2Calc_XFEM4U_Settings.SettingFound)  # IronPython2
# ---------- python_script.python (18 lines) ----------
XframeNames = IN[0]
RevitTypeNamesLists = IN[1]
XMLDataSteelSections = IN[2]
ListNumberSteelSections = IN[3]

RevitTypeNames = RevitTypeNamesLists[ListNumberSteelSections]
SectionNamesXframe = XMLDataSteelSections[13]

RevitTypeNamesFound = []
NotFound = []

for i in SectionNamesXframe:
	try: 
		RevitTypeNamesFound.append(RevitTypeNames[XframeNames.index(i)])
	except ValueError:
		RevitTypeNamesFound.append("TypeName not found")
		NotFound.append(i)
OUT = RevitTypeNamesFound, NotFound
# ----------------------------------------

code_block_3 = CodeBlock(a=python_script) { a[0]; a[1]; }

# group: Structural Framing Types Steel
code_block_4 = CodeBlock { "Structural Framing"; }
byName = Category.ByName(name=code_block_4)
all_family_types_of_category = Custom[All Family Types Of Category](category=byName)  # package Clockwork for Dynamo 2.x; Gets all family types/symbols of a given category in the model.
name = FamilyType.Name(familyType=all_family_types_of_category)
ꟿ_dictionary_bykeysvalues = Custom[ꟿ Dictionary.ByKeysValues](keys=name, values=all_family_types_of_category, searchKeys=code_block_3.out0)  # package spring nodes; Dictionaries are an incredibly powerful tool for making associative sets between two equal length lists. The first list must be of unique strings (or numbers) and will be the key and the second list will be the matching values (it can be made up of geometry, elements, even other lists) The search keys list will provide the corresponding value to the input key.

code_block_5 = CodeBlock { "typename_unknown_structural_framing"; }
dyn2Calc_Xframe3D_Settings = Custom[Dyn2Calc_Xframe3D_Settings](SearchSetting=code_block_5)  # package Dyn2Calc.Struct4U; Settings regarding familiies, materials etc
byName_2 = FamilyType.ByName(name=dyn2Calc_Xframe3D_Settings.SettingFound)
replaceNull = Custom[List.ReplaceNull](seq=ꟿ_dictionary_bykeysvalues, replacement=byName_2)  # package Clockwork for Dynamo 2.x; Replaces all null values within a given list with a substitute

# group: PLACE STRUCTURAL FRAMING
beamByCurve = StructuralFraming.BeamByCurve(curve=code_block, level=Level_To_Place, structuralFramingType=replaceNull)

code_block_6 = CodeBlock(a=transpose)
# ---------- code_block_6.designscript (8 lines) ----------
a[10];
a[11];
a[8];
//Z value;
a[7];
//Top Center Bottom;
DSCore.String.ToNumber(a[5])+DSCore.String.ToNumber(a[16]);
//Angle
# ----------------------------------------

# group: SET Z/Bottom/Center
code_block_7 = CodeBlock { "z Justification"; }
code_block_8 = CodeBlock()
# ---------- code_block_8.designscript (10 lines) ----------
//Top = 0
//Center = 1
//Bottom = 3
//Origin = 2
"Top";
"Center";
"Bottom";
"0";
"1";
"3";
# ----------------------------------------
replace = String.Replace(string=code_block_6.out2, searchFor=code_block_8.out0, replaceWith=code_block_8.out3)
replace_2 = String.Replace(string=replace, searchFor=code_block_8.out1, replaceWith=code_block_8.out4)
replace_3 = String.Replace(string=replace_2, searchFor=code_block_8.out2, replaceWith=code_block_8.out5)
toNumber = String.ToNumber(str=replace_3)
setParameterByName = Element.SetParameterByName(element=beamByCurve, parameterName=code_block_7, value=toNumber)

StructuralFramingPlaced = Output(setParameterByName)
Data_Structural_Column_Steel = Input(Data_Structural_Column_Steel: var[]..[])
transpose_2 = List.Transpose(lists=Data_Structural_Column_Steel)
code_block_9 = CodeBlock(a=transpose_2) { a[11]; }
code_block_10 = CodeBlock { "Structural Columns"; }
byName_3 = Category.ByName(name=code_block_10)
all_family_types_of_category_2 = Custom[All Family Types Of Category](category=byName_3)
name_2 = FamilyType.Name(familyType=all_family_types_of_category_2)

# group: STEEL FAMILY TYPES
dyn2Calc_XFEM4U_SteelSectionsNames_2 = Custom[Dyn2Calc_XFEM4U_SteelSectionsNames]()
code_block_11 = CodeBlock { "steelprofiletypelistnumber"; }
dyn2Calc_XFEM4U_Settings_2 = Custom[Dyn2Calc_XFEM4U_Settings](SearchSetting=code_block_11)
python_script_2 = Python(IN[0]=dyn2Calc_XFEM4U_SteelSectionsNames_2.XFEM4U_Steelsectionnames, IN[1]=dyn2Calc_XFEM4U_SteelSectionsNames_2.Revit_SteelsectionTypeNames, IN[2]=transpose_2, IN[3]=dyn2Calc_XFEM4U_Settings_2.SettingFound)  # IronPython2
# ---------- python_script_2.python (19 lines) ----------
XframeNames = IN[0]
RevitTypeNamesLists = IN[1]
XMLDataSteelSections = IN[2]
ListNumberSteelSections = IN[3]

RevitTypeNames = RevitTypeNamesLists[ListNumberSteelSections]
SectionNamesXframe = XMLDataSteelSections[13]

RevitTypeNamesFound = []
NotFound = []

for i in SectionNamesXframe:
	try: 
		RevitTypeNamesFound.append(RevitTypeNames[XframeNames.index(i)])
	except ValueError:
		RevitTypeNamesFound.append("TypeName not found")
		NotFound.append(i)

OUT = RevitTypeNamesFound,NotFound
# ----------------------------------------
code_block_12 = CodeBlock { "not implemented yet"; }

code_block_13 = CodeBlock(a=python_script_2) { a[0]; a[1]; }
ꟿ_dictionary_bykeysvalues_2 = Custom[ꟿ Dictionary.ByKeysValues](keys=name_2, values=all_family_types_of_category_2, searchKeys=code_block_13.out0)
code_block_14 = CodeBlock { "typename_unknown_structural_column"; }
dyn2Calc_Xframe3D_Settings_2 = Custom[Dyn2Calc_Xframe3D_Settings](SearchSetting=code_block_14)
byName_4 = FamilyType.ByName(name=dyn2Calc_Xframe3D_Settings_2.SettingFound)
replaceNull_2 = Custom[List.ReplaceNull](seq=ꟿ_dictionary_bykeysvalues_2, replacement=byName_4)

# group: REVERSE LINE DIRECTION, PLACE COLUMNS
endPoint = Curve.EndPoint(curve=code_block_9)
Z = Point.Z(point=endPoint)
startPoint = Curve.StartPoint(curve=code_block_9)
Z_2 = Point.Z(point=startPoint)
lt = Z < Z_2
filterByBoolMask = List.FilterByBoolMask(list=code_block_9, mask=lt)
reverse = Curve.Reverse(curve=filterByBoolMask.in)
join = List.Join(list0=reverse, list1=filterByBoolMask.out)
columnByCurve = StructuralFraming.ColumnByCurve(curve=join, level=Level_To_Place, structuralColumnType=replaceNull_2)

code_block_15 = CodeBlock(a=transpose_2)  # same code as code_block_6

# group: SET ANGLE
code_block_16 = CodeBlock { "Cross-Section Rotation"; }
watch = Watch(code_block_15.out4)
python_script_3 = Python(IN[0]=watch)  # IronPython2
# ---------- python_script_3.python (21 lines) ----------
# Load the Python Standard and DesignScript Libraries
import sys
import clr
clr.AddReference('ProtoGeometry')
from Autodesk.DesignScript.Geometry import *

# The inputs to this node will be stored as a list in the IN variables.
dataEnteringNode = IN

lst = IN[0]

lst2 = []

for i in lst:
	if i == 360:
		lst2.append(0)
	else: lst2.append(i)
# Place your code below this line

# Assign your output to the OUT variable.
OUT = lst2
# ----------------------------------------
setParameterByName_2 = Element.SetParameterByName(element=columnByCurve, parameterName=code_block_16, value=python_script_3)

StructuralColumnsPlaced = Output(setParameterByName_2)

# group: SET Z OFFSET VALUE
code_block_17 = CodeBlock { "z Offset Value"; }
toNumber_2 = String.ToNumber(str=code_block_6.out3)
setParameterByName_3 = Element.SetParameterByName(element=beamByCurve, parameterName=code_block_17, value=toNumber_2)

# group: SET ANGLE
code_block_18 = CodeBlock { "Cross-Section Rotation"; }
watch_2 = Watch(code_block_6.out4)
python_script_4 = Python(IN[0]=watch_2)  # IronPython2; same code as python_script_3
setParameterByName_4 = Element.SetParameterByName(element=beamByCurve, parameterName=code_block_18, value=python_script_4)

StructuralColumnsNotFound = Output(code_block_13.out1)
StructuralFramingNotFound = Output(code_block_3.out1)
