# Dynamo custom node Dyn2Calc_XFEM4U_ImportXML.dyf "Dyn2Calc_Xframe3D_ImportXML" (Dynamo 2.10.1.3976)
# category: Dyn2Calc.Xframe3d
# Import Xframe3D XML and convert to points, lines and metadata

xmlFile = Input(xmlFile: var[]..[])
readText = FileSystem.ReadText(file=xmlFile)

# group: PROJECTINFORMATION
code_block = CodeBlock { ".ProjectName"; ".ProjectNumber"; ".ExportDateTime"; ".XMLExportVersion"; }
create = List.Create(item0=code_block.out0, item1=code_block.out1, item2=code_block.out2, item3=code_block.out3)
python_script = Python(IN[0]=readText, IN[1]=create)  # IronPython2
# ---------- python_script.python (19 lines) ----------
import sys
sys.path.append("C:\Program Files (x86)\IronPython 2.7\Lib")
import xml.etree.ElementTree as ET

xml = IN[0]
xpathstr = IN[1]

root = ET.fromstring(xml)

xpathfound = []
for i in xpathstr:
	xpathfound.append(root.findall(i))

xtext = []
for i in xpathfound:
	for j in i:
		xtext.append(j.text)

OUT = xtext
# ----------------------------------------

Xframe3DXMLData_ProjectInformation = Output(python_script)
code_block_2 = CodeBlock { "Nodes_Points"; }

# group: NODES
code_block_3 = CodeBlock { ".Nodes/Number"; ".Nodes/X"; ".Nodes/Y"; ".Nodes/Z"; }
create_2 = List.Create(item0=code_block_3.out0, item1=code_block_3.out1, item2=code_block_3.out2, item3=code_block_3.out3)
python_script_2 = Python(IN[0]=readText, IN[1]=create_2)  # IronPython2
# ---------- python_script_2.python (22 lines) ----------
import sys
sys.path.append("C:\Program Files (x86)\IronPython 2.7\Lib")
import xml.etree.ElementTree as ET

xml = IN[0]
xpathstr = IN[1]

root = ET.fromstring(xml)

xpathfound = []
for i in xpathstr:
	xpathfound.append(root.findall(i))

xtext = []
for i in xpathfound:
	temp = []
	
	for j in i:
		temp.append(j.text)
	xtext.append(temp)

OUT = xtext
# ----------------------------------------

addItemToEnd = List.AddItemToEnd(item=code_block_2, list=create_2)
code_block_4 = CodeBlock { ","; "."; }
replace = String.Replace(string=python_script_2, searchFor=code_block_4.out0, replaceWith=code_block_4.out1)

# group (continued): NODES
toNumber = String.ToNumber(str=replace)
code_block_5 = CodeBlock(point=toNumber) { point[0]; point[1]; point[2]; point[3]; }
byCoordinates = Point.ByCoordinates(x=code_block_5.out1, y=code_block_5.out2, z=code_block_5.out3)
addItemToEnd_2 = List.AddItemToEnd(item=byCoordinates, list=toNumber)
addItemToFront = List.AddItemToFront(item=addItemToEnd, list=addItemToEnd_2)

Xframe3DXMLData_Nodes = Output(addItemToFront)

# group: GRIDS
code_block_6 = CodeBlock { ".Grids/X"; ".Grids/X_Lable"; ".Grids/Y"; ".Grids/Y_Lable"; ".Grids/Z"; ".Grids/Z_Lable"; }
create_3 = List.Create(item0=code_block_6.out0, item1=code_block_6.out1, item2=code_block_6.out2, item3=code_block_6.out3, item4=code_block_6.out4, item5=code_block_6.out5)
python_script_3 = Python(IN[0]=readText, IN[1]=create_3)  # IronPython2; same code as python_script_2
code_block_7 = CodeBlock { " "; }
split = String.Split(str=python_script_3@L1, separator0=code_block_7)
addItemToFront_2 = List.AddItemToFront(item=create_3, list=split)

Xframe3DXMLData_Grids = Output(addItemToFront_2)

# group: PROFILES
code_block_8 = CodeBlock()
# ---------- code_block_8.designscript (16 lines) ----------
".Profiles/Number";
".Profiles/Profile_name";
".Profiles/Material_type";
".Profiles/Material";
".Profiles/Angle";
".Profiles/Profile_shape";
".Profiles/h";
".Profiles/b";
".Profiles/h1";
".Profiles/b1";
".Profiles/h2";
".Profiles/b2";
".Profiles/h3";
".Profiles/b3";
".Profiles/h4";
".Profiles/b4";
# ----------------------------------------
create_4 = List.Create(item0=code_block_8.out0, item1=code_block_8.out1, item2=code_block_8.out2, item3=code_block_8.out3, item4=code_block_8.out4, item5=code_block_8.out5, item6=code_block_8.out6, item7=code_block_8.out7, item8=code_block_8.out8, item9=code_block_8.out9, item10=code_block_8.out10, item11=code_block_8.out11, item12=code_block_8.out12, item13=code_block_8.out13, item14=code_block_8.out14, item15=code_block_8.out15)
python_script_4 = Python(IN[0]=readText, IN[1]=create_4)  # IronPython2; same code as python_script_2
addItemToFront_3 = List.AddItemToFront(item=create_4, list=python_script_4)
code_block_9 = CodeBlock { ".Profiles/Number"; ".Profiles/Profile_name"; ".Profiles/Material_type"; ".Profiles/Material"; ".Profiles/Angle"; }
create_5 = List.Create(item0=code_block_9.out0, item1=code_block_9.out1, item2=code_block_9.out2, item3=code_block_9.out3, item4=code_block_9.out4)
python_script_5 = Python(IN[0]=readText, IN[1]=create_5)  # IronPython2; same code as python_script_2
addItemToFront_4 = List.AddItemToFront(item=create_5, list=python_script_5)

Xframe3DXMLData_ProfileShapeProperties = Output(addItemToFront_3)
code_block_10 = CodeBlock { "From_node_number_Point"; "To_node_number_Point"; "Beamcurve"; }

# group: BEAMS
code_block_11 = CodeBlock()
# ---------- code_block_11.designscript (9 lines) ----------
".Beams/Number";
".Beams/Beamgroupnumber";
".Beams/From_node_number";
".Beams/To_node_number";
".Beams/Angle";
".Beams/Angle_profile";
".Beams/Profile_number";
".Beams/Z";
".Beams/Top_Center_Bottom";
# ----------------------------------------
create_6 = List.Create(item0=code_block_11.out0, item1=code_block_11.out1, item2=code_block_11.out2, item3=code_block_11.out3, item4=code_block_11.out4, item5=code_block_11.out5, item6=code_block_11.out6, item7=code_block_11.out7, item8=code_block_11.out8)
python_script_6 = Python(IN[0]=readText, IN[1]=create_6)  # IronPython2; same code as python_script_2
code_block_12 = CodeBlock(beam=python_script_6) { beam[0]; beam[1]; beam[2]; beam[3]; beam[4]; beam[5]; beam[6]; beam[7]; }
toNumber_2 = String.ToNumber(str=code_block_12.out2)
python_script_7 = Python(IN[0]=code_block_5.out0, IN[1]=toNumber_2)  # IronPython2
# ---------- python_script_7.python (15 lines) ----------
import clr
clr.AddReference('ProtoGeometry')
from Autodesk.DesignScript.Geometry import *
#The inputs to this node will be stored as a list in the IN variables.
dataEnteringNode = IN

lst = IN[0]
value = IN[1]

indices = []
for i in value:
	indices.append(lst.index(i))

#Assign your output to the OUT variable.
OUT = indices
# ----------------------------------------
getItemAtIndex = List.GetItemAtIndex(list=byCoordinates, index=python_script_7)
toNumber_3 = String.ToNumber(str=code_block_12.out3)
python_script_8 = Python(IN[0]=code_block_5.out0, IN[1]=toNumber_3)  # IronPython2; same code as python_script_7
getItemAtIndex_2 = List.GetItemAtIndex(list=byCoordinates, index=python_script_8)

addItemToEnd_3 = List.AddItemToEnd(item=code_block_10.out0, list=create_6)
addItemToEnd_4 = List.AddItemToEnd(item=code_block_10.out1, list=addItemToEnd_3)
addItemToEnd_5 = List.AddItemToEnd(item=code_block_10.out2, list=addItemToEnd_4)
byStartPointEndPoint = Line.ByStartPointEndPoint(startPoint=getItemAtIndex, endPoint=getItemAtIndex_2)
addItemToEnd_6 = List.AddItemToEnd(item=getItemAtIndex, list=python_script_6)
addItemToEnd_7 = List.AddItemToEnd(item=getItemAtIndex_2, list=addItemToEnd_6)
addItemToEnd_8 = List.AddItemToEnd(item=byStartPointEndPoint, list=addItemToEnd_7)
addItemToFront_5 = List.AddItemToFront(item=addItemToEnd_5, list=addItemToEnd_8)
Xframe3DXMLData_Beams = Output(addItemToFront_5)

# group: SUPPORTS
code_block_13 = CodeBlock { ".Supports/Number"; ".Supports/Nodenumber"; ".Supports/dx"; ".Supports/dy"; ".Supports/dz"; }
create_7 = List.Create(item0=code_block_13.out0, item1=code_block_13.out1, item2=code_block_13.out2, item3=code_block_13.out3, item4=code_block_13.out4)
python_script_9 = Python(IN[0]=readText, IN[1]=create_7)  # IronPython2; same code as python_script_2
addItemToFront_6 = List.AddItemToFront(item=create_7, list=python_script_9)

Xframe3DXMLData_Supports = Output(addItemToFront_6)

# group: BEAMGROUP
code_block_14 = CodeBlock { ".Beamgroup/Number"; ".Beamgroup/Startnode"; ".Beamgroup/Endnode"; }
create_8 = List.Create(item0=code_block_14.out0, item1=code_block_14.out1, item2=code_block_14.out2)
python_script_10 = Python(IN[0]=readText, IN[1]=create_8)  # IronPython2; same code as python_script_2
addItemToFront_7 = List.AddItemToFront(item=create_8, list=python_script_10)

Xframe3DXMLData_Beamgroup = Output(addItemToFront_7)

# group: PLATES
code_block_15 = CodeBlock { ".Plates/Number"; ".Plates/Node"; ".Plates/h"; ".Plates/Material"; ".Plates/Z"; ".Plates/Top_Center_Bottom"; }
create_9 = List.Create(item0=code_block_15.out0, item1=code_block_15.out1, item2=code_block_15.out2, item3=code_block_15.out3, item4=code_block_15.out4, item5=code_block_15.out5)
python_script_11 = Python(IN[0]=readText, IN[1]=create_9)  # IronPython2; same code as python_script_2
addItemToFront_8 = List.AddItemToFront(item=create_9, list=python_script_11)

Xframe3DXMLData_Plates = Output(addItemToFront_8)

# group: RebarLongitudinal
code_block_16 = CodeBlock()
# ---------- code_block_16.designscript (9 lines) ----------
".RebarLongitudinal/Number";
".RebarLongitudinal/Beamgroupnumber";
".RebarLongitudinal/FromX";
".RebarLongitudinal/ToX";
".RebarLongitudinal/Reinforcement";
".RebarLongitudinal/Z";
".RebarLongitudinal/Ldstart";
".RebarLongitudinal/Ldend";
".RebarLongitudinal/SteelGrade";
# ----------------------------------------
create_10 = List.Create(item0=code_block_16.out0, item1=code_block_16.out1, item2=code_block_16.out2, item3=code_block_16.out3, item4=code_block_16.out4, item5=code_block_16.out5, item6=code_block_16.out6, item7=code_block_16.out7, item8=code_block_16.out8)
python_script_12 = Python(IN[0]=readText, IN[1]=create_10)  # IronPython2; same code as python_script_2
addItemToFront_9 = List.AddItemToFront(item=create_10, list=python_script_12)

Xframe3DXMLData_RebarLongitudinal = Output(addItemToFront_9)

# group: RebarStirrup
code_block_17 = CodeBlock()
# ---------- code_block_17.designscript (7 lines) ----------
".RebarStirrup/Number";
".RebarStirrup/Beamgroupnumber";
".RebarStirrup/FromX";
".RebarStirrup/ToX";
".RebarStirrup/Stirrips";
".RebarStirrup/NumberOfStirrupSections";
".RebarStirrup/SteelGrade";
# ----------------------------------------
create_11 = List.Create(item0=code_block_17.out0, item1=code_block_17.out1, item2=code_block_17.out2, item3=code_block_17.out3, item4=code_block_17.out4, item5=code_block_17.out5, item6=code_block_17.out6)
python_script_13 = Python(IN[0]=readText, IN[1]=create_11)  # IronPython2; same code as python_script_2
addItemToFront_10 = List.AddItemToFront(item=create_11, list=python_script_13)

Xframe3DXMLData_RebarStirrup = Output(addItemToFront_10)
Xframe3DXMLData_Profiles = Output(addItemToFront_4)

# group: Layers
code_block_18 = CodeBlock { ".Layers/Layer_number"; ".Layers/Layer_description"; }
create_12 = List.Create(item0=code_block_18.out0, item1=code_block_18.out1)
python_script_14 = Python(IN[0]=readText, IN[1]=create_12)  # IronPython2; same code as python_script_2
addItemToFront_11 = List.AddItemToFront(item=create_12, list=python_script_14)

Xframe3DXMLData_Layers = Output(addItemToFront_11)
