# Dynamo custom node Dyn2Calc_Xframe3D_PlaceSteelColumnsFramings.dyf (Dynamo 2.3.0.5885)
# category: Dyn2Calc.Xframe3d
# Place Structural Columns and Framings from an XML-file generated by X-frame 3D
# packages: Dyn2Calc.Xframe3D 0.1.2, Clockwork for Dynamo 2.x 2.1.2, spring nodes 203.1.0

Data_Structural_Framing_Steel = Input(Data_Structural_Framing_Steel: var[]..[])
transpose = List.Transpose(lists=Data_Structural_Framing_Steel)
code_block = CodeBlock(a=transpose) { a[11]; }
Level_To_Place = Input(Level_To_Place: var[]..[])

# group: STEEL FAMILY TYPES
dyn2Calc_Xframe3D_SteelSectionsNames = Custom[Dyn2Calc_Xframe3D_SteelSectionsNames]()  # package Dyn2Calc.Xframe3D; Mapping node for Xframe3D Sectionnames and Revit Type Names
code_block_2 = CodeBlock { "steelprofiletypelistnumber"; }
dyn2Calc_Xframe3D_Settings = Custom[Dyn2Calc_Xframe3D_Settings](SearchSetting=code_block_2)  # package Dyn2Calc.Xframe3D; Settings regarding familiies, materials etc
python_script = Python(IN[0]=dyn2Calc_Xframe3D_SteelSectionsNames.Xframe3D_Steelsectionnames, IN[1]=dyn2Calc_Xframe3D_SteelSectionsNames.Revit_SteelsectionTypeNames, IN[2]=transpose, IN[3]=dyn2Calc_Xframe3D_Settings.SettingFound)
# ---------- python_script.python (17 lines) ----------
XframeNames = IN[0]
RevitTypeNamesLists = IN[1]
XMLDataSteelSections = IN[2]
ListNumberSteelSections = IN[3]

RevitTypeNames = RevitTypeNamesLists[ListNumberSteelSections]
SectionNamesXframe = XMLDataSteelSections[13]

RevitTypeNamesFound = []

for i in SectionNamesXframe:
	try: 
		RevitTypeNamesFound.append(RevitTypeNames[XframeNames.index(i)])
	except ValueError:
		RevitTypeNamesFound.append("TypeName not found")

OUT = RevitTypeNamesFound
# ----------------------------------------

# group: Structural Framing Types Steel
code_block_3 = CodeBlock { "Structural Framing"; }
byName = Category.ByName(name=code_block_3)
all_family_types_of_category = Custom[All Family Types Of Category](category=byName)  # package Clockwork for Dynamo 2.x; Gets all family types/symbols of a given category in the model.
name = FamilyType.Name(familyType=all_family_types_of_category)
ꟿ_dictionary_bykeysvalues = Custom[ꟿ Dictionary.ByKeysValues](keys=name, values=all_family_types_of_category, searchKeys=python_script)  # package spring nodes; Dictionaries are an incredibly powerful tool for making associative sets between two equal length lists. The first list must be of unique strings (or numbers) and will be the key and the second list will be the matching values (it can be made up of geometry, elements, even other lists) The search keys list will provide the corresponding value to the input key.

code_block_4 = CodeBlock { "typename_unknown_structural_framing"; }
dyn2Calc_Xframe3D_Settings_2 = Custom[Dyn2Calc_Xframe3D_Settings](SearchSetting=code_block_4)
replaceNull = Custom[List.ReplaceNull](seq=ꟿ_dictionary_bykeysvalues, replacement=dyn2Calc_Xframe3D_Settings_2.SettingFound)  # package Clockwork for Dynamo 2.x; Replaces all null values within a given list with a substitute

# group: PLACE STRUCTURAL FRAMING
beamByCurve = StructuralFraming.BeamByCurve(curve=code_block, level=Level_To_Place, structuralFramingType=replaceNull)

code_block_5 = CodeBlock(a=transpose)
# ---------- code_block_5.designscript (8 lines) ----------
a[10];
a[11];
a[8];
//Z value;
a[7];
//Top Center Bottom;
DSCore.String.ToNumber(a[5])+DSCore.String.ToNumber(a[16]);
//Angle
# ----------------------------------------

# group: SET Z OFFSET VALUE
code_block_6 = CodeBlock { "z Offset Value"; }
toNumber = String.ToNumber(str=code_block_5.out3)
setParameterByName = Element.SetParameterByName(element=beamByCurve, parameterName=code_block_6, value=toNumber)

# group: SET ANGLE
code_block_7 = CodeBlock { "Cross-Section Rotation"; }
watch = Watch(code_block_5.out4)
python_script_2 = Python(IN[0]=watch)
# ---------- python_script_2.python (21 lines) ----------
# Load the Python Standard and DesignScript Libraries
import sys
import clr
clr.AddReference('ProtoGeometry')
from Autodesk.DesignScript.Geometry import *

# The inputs to this node will be stored as a list in the IN variables.
dataEnteringNode = IN

lst = IN[0]

lst2 = []

for i in lst:
	if i == 360:
		lst2.append(0)
	else: lst2.append(i)
# Place your code below this line

# Assign your output to the OUT variable.
OUT = lst2
# ----------------------------------------
setParameterByName_2 = Element.SetParameterByName(element=beamByCurve, parameterName=code_block_7, value=python_script_2)

# group: SET Z/Bottom/Center
code_block_8 = CodeBlock { "z Justification"; }
code_block_9 = CodeBlock()
# ---------- code_block_9.designscript (10 lines) ----------
//Top = 0
//Center = 1
//Bottom = 3
//Origin = 2
"Top";
"Center";
"Bottom";
"0";
"1";
"3";
# ----------------------------------------
replace = String.Replace(str=code_block_5.out2, searchFor=code_block_9.out0, replaceWith=code_block_9.out3)
replace_2 = String.Replace(str=replace, searchFor=code_block_9.out1, replaceWith=code_block_9.out4)
replace_3 = String.Replace(str=replace_2, searchFor=code_block_9.out2, replaceWith=code_block_9.out5)
toNumber_2 = String.ToNumber(str=replace_3)
setParameterByName_3 = Element.SetParameterByName(element=beamByCurve, parameterName=code_block_8, value=toNumber_2)

StructuralFramingPlaced = Output(setParameterByName_3)
Data_Structural_Column_Steel = Input(Data_Structural_Column_Steel: var[]..[])
transpose_2 = List.Transpose(lists=Data_Structural_Column_Steel)
code_block_10 = CodeBlock(a=transpose_2) { a[11]; }
code_block_11 = CodeBlock { "Structural Columns"; }
byName_2 = Category.ByName(name=code_block_11)
all_family_types_of_category_2 = Custom[All Family Types Of Category](category=byName_2)
name_2 = FamilyType.Name(familyType=all_family_types_of_category_2)

# group: STEEL FAMILY TYPES
dyn2Calc_Xframe3D_SteelSectionsNames_2 = Custom[Dyn2Calc_Xframe3D_SteelSectionsNames]()
code_block_12 = CodeBlock { "steelprofiletypelistnumber"; }
dyn2Calc_Xframe3D_Settings_3 = Custom[Dyn2Calc_Xframe3D_Settings](SearchSetting=code_block_12)
python_script_3 = Python(IN[0]=dyn2Calc_Xframe3D_SteelSectionsNames_2.Xframe3D_Steelsectionnames, IN[1]=dyn2Calc_Xframe3D_SteelSectionsNames_2.Revit_SteelsectionTypeNames, IN[2]=transpose_2, IN[3]=dyn2Calc_Xframe3D_Settings_3.SettingFound)  # same code as python_script

ꟿ_dictionary_bykeysvalues_2 = Custom[ꟿ Dictionary.ByKeysValues](keys=name_2, values=all_family_types_of_category_2, searchKeys=python_script_3)
code_block_13 = CodeBlock { "typename_unknown_structural_column"; }
dyn2Calc_Xframe3D_Settings_4 = Custom[Dyn2Calc_Xframe3D_Settings](SearchSetting=code_block_13)
replaceNull_2 = Custom[List.ReplaceNull](seq=ꟿ_dictionary_bykeysvalues_2, replacement=dyn2Calc_Xframe3D_Settings_4.SettingFound)

# group: REVERSE LINE DIRECTION, PLACE COLUMNS
endPoint = Curve.EndPoint(curve=code_block_10)
Z = Point.Z(point=endPoint)
startPoint = Curve.StartPoint(curve=code_block_10)
Z_2 = Point.Z(point=startPoint)
lt = Z < Z_2
filterByBoolMask = List.FilterByBoolMask(list=code_block_10, mask=lt)
reverse = Curve.Reverse(curve=filterByBoolMask.in)
join = List.Join(list0=reverse, list1=filterByBoolMask.out)
columnByCurve = StructuralFraming.ColumnByCurve(curve=join, level=Level_To_Place, structuralColumnType=replaceNull_2)

code_block_14 = CodeBlock(a=transpose_2)  # same code as code_block_5

# group: SET ANGLE
code_block_15 = CodeBlock { "Cross-Section Rotation"; }
watch_2 = Watch(code_block_14.out4)
python_script_4 = Python(IN[0]=watch_2)  # same code as python_script_2
setParameterByName_4 = Element.SetParameterByName(element=columnByCurve, parameterName=code_block_15, value=python_script_4)

StructuralColumnsPlaced = Output(setParameterByName_4)
