# Dynamo custom node Dyn2Calc_Xframe3D_SplitColumnsFramingsMaterial.dyf (Dynamo 2.3.0.5885)
# category: Dyn2Calc.Xframe3d
# Split Beams from Xframe 3D in Columns, Framings and order per material

Xframe3DXMLData_Beams = Input(Xframe3DXMLData_Beams: var[]..[])
Xframe3DXMLData_Profiles = Input(Xframe3DXMLData_Profiles: var[]..[])

# group: COMBINE DATA FROM PROFILES AND BEAMS AND SPLIT BEAMS INTO STRUCTURAL COLUMNS AND FRAMING + GROUP BY MATERIALTYPE
watch = Watch(Xframe3DXMLData_Beams)
code_block = CodeBlock { 0; }
getItemAtIndex = List.GetItemAtIndex(list=watch, index=code_block)
watch_2 = Watch(Xframe3DXMLData_Profiles)
code_block_2 = CodeBlock { 0; }
getItemAtIndex_2 = List.GetItemAtIndex(list=watch_2, index=code_block_2)
join = List.Join(list0=getItemAtIndex, list1=getItemAtIndex_2)
join_2 = List.Join()  # unwired: list0, list1
code_block_3 = CodeBlock { 0; }
removeItemAtIndex = List.RemoveItemAtIndex(list=watch, indices=code_block_3)
transpose = List.Transpose(lists=removeItemAtIndex)
code_block_4 = CodeBlock { 0; }
removeItemAtIndex_2 = List.RemoveItemAtIndex(list=watch_2, indices=code_block_4)
transpose_2 = List.Transpose(lists=removeItemAtIndex_2)
code_block_5 = CodeBlock(Beams=transpose, Profiles=transpose_2)
# ---------- code_block_5.designscript (3 lines) ----------
ProfileNumber = String.ToNumber(List.GetItemAtIndex(Beams@L2<1>, 6));
IndexList = ProfileNumber-1;
ProfilePerBeam = List.GetItemAtIndex(Profiles,IndexList);
# ----------------------------------------
combine = List.Combine(comb=join_2, list1=transpose, list2=code_block_5.ProfilePerBeam)
code_block_6 = CodeBlock(beams=combine)
# ---------- code_block_6.designscript (5 lines) ----------
Startpoint = List.GetItemAtIndex(beams@L2<1>, 9);
Endpoint = List.GetItemAtIndex(beams@L2<1>, 10);
BeamCurve = Line.ByStartPointEndPoint(Startpoint, Endpoint);
VectorBeam = StructuralDesign.Vector.ByLine(BeamCurve);
DetermineColumn = Autodesk.Vector.IsParallel(VectorBeam, Autodesk.Vector.ZAxis());
# ----------------------------------------
filterByBoolMask = List.FilterByBoolMask(list=combine, mask=code_block_6.DetermineColumn)
code_block_7 = CodeBlock(StructuralColumns=filterByBoolMask.in, StructuralFramings=filterByBoolMask.out) { StructuralColumns; StructuralFramings; }
code_block_8 = CodeBlock(StructColumns=code_block_7.StructuralColumns) { List.GetItemAtIndex(StructColumns@L2<1>, 14); }
code_block_9 = CodeBlock()
# ---------- code_block_9.designscript (2 lines) ----------
"0";
//steel
# ----------------------------------------
eq = code_block_8 == code_block_9
filterByBoolMask_2 = List.FilterByBoolMask(list=code_block_7.StructuralColumns, mask=eq)
code_block_10 = CodeBlock()
# ---------- code_block_10.designscript (2 lines) ----------
"1";
//concrete
# ----------------------------------------
eq_2 = code_block_8 == code_block_10
filterByBoolMask_3 = List.FilterByBoolMask(list=code_block_7.StructuralColumns, mask=eq_2)
code_block_11 = CodeBlock()
# ---------- code_block_11.designscript (2 lines) ----------
"2";
//wood
# ----------------------------------------
eq_3 = code_block_8 == code_block_11
filterByBoolMask_4 = List.FilterByBoolMask(list=code_block_7.StructuralColumns, mask=eq_3)
code_block_12 = CodeBlock(StructFramings=code_block_7.StructuralFramings) { List.GetItemAtIndex(StructFramings@L2<1>, 14); }
code_block_13 = CodeBlock()  # same code as code_block_9
eq_4 = code_block_12 == code_block_13
filterByBoolMask_5 = List.FilterByBoolMask(list=code_block_7.StructuralFramings, mask=eq_4)
code_block_14 = CodeBlock()  # same code as code_block_10
eq_5 = code_block_12 == code_block_14
filterByBoolMask_6 = List.FilterByBoolMask(list=code_block_7.StructuralFramings, mask=eq_5)
code_block_15 = CodeBlock()  # same code as code_block_11
eq_6 = code_block_12 == code_block_15
filterByBoolMask_7 = List.FilterByBoolMask(list=code_block_7.StructuralFramings, mask=eq_6)
code_block_16 = CodeBlock(ColumnsSteel=filterByBoolMask_2.in, ColumnsConcrete=filterByBoolMask_3.in, ColumnsWood=filterByBoolMask_4.in, FramingSteel=filterByBoolMask_5.in, FramingConcrete=filterByBoolMask_6.in, FramingWood=filterByBoolMask_7.in) { ColumnsSteel; ColumnsConcrete; ColumnsWood; FramingSteel; FramingConcrete; FramingWood; }

Description_Of_Lists = Output(join)
Data_Structural_Column_Steel = Output(code_block_16.ColumnsSteel)
Data_Structural_Column_Concrete = Output(code_block_16.ColumnsConcrete)
Data_Structural_Column_Wood = Output(code_block_16.ColumnsWood)
code_block_17 = CodeBlock { "not implemented yet"; }
Data_Structural_Column_Other = Output(code_block_17)
Data_Structural_Framing_Steel = Output(code_block_16.FramingSteel)
Data_Structural_Framing_Concrete = Output(code_block_16.FramingConcrete)
Data_Structural_Framing_Wood = Output(code_block_16.FramingWood)
Data_Structural_Framing_Other = Output(code_block_17)
