# Dynamo graph Revit to X-frame 3D compact.dyn (Dynamo 2.3.0.5885)

code_block = CodeBlock { "C:/TEMP/test113.xml"; }
code_block_2 = CodeBlock { "Grids"; }
byName = Category.ByName(name=code_block_2)
all_elements_of_category = ElementsOfCategory(Category=byName)
select_model_elements = DSModelElementsSelection()  # 299 picked in the model
xframe3DExportXML = Custom[Xframe3DExportXML](Grids=all_elements_of_category, analyticalElements=select_model_elements)  # Export XML-file from Revit
writeText = FileSystem.WriteText(filePath=code_block, text=xframe3DExportXML)
