# Dynamo graph Revit to Xframe 3D.dyn (Dynamo 2.3.0.5885)
# packages: Dyn2Calc.Xframe3D 0.1.2

code_block = CodeBlock { "C:/TEMP/test113.xml"; }
code_block_2 = CodeBlock { "Grids"; }
byName = Category.ByName(name=code_block_2)
all_elements_of_category = ElementsOfCategory(Category=byName)
select_model_elements = DSModelElementsSelection()  # 299 picked in the model
dyn2Calc_Xframe3D_ExportXML = Custom[Dyn2Calc_Xframe3D_ExportXML](Grids=all_elements_of_category, analyticalElements=select_model_elements)  # package Dyn2Calc.Xframe3D; Export XML-file from Revit
writeText = FileSystem.WriteText(filePath=code_block, text=dyn2Calc_Xframe3D_ExportXML)
