# Dynamo graph Xframe3D To Revit.dyn (Dynamo 2.3.0.5885)
# packages: Dyn2Calc.Xframe3D 0.1.2, Clockwork for Dynamo 2.x 2.1.2, Dyn2Calc.Xframe3D 0.2.1, spring nodes 203.1.0

code_block = CodeBlock { "folder_family"; }  # frozen
dyn2Calc_Xframe3D_Settings = Custom[Dyn2Calc_Xframe3D_Settings](SearchSetting=code_block)  # package Dyn2Calc.Xframe3D; Settings regarding familiies, materials etc
dyn2Calc_Xframe3D_LoadFamilies = Custom[Dyn2Calc_Xframe3D_LoadFamilies](path=dyn2Calc_Xframe3D_Settings.SettingFound)  # package Dyn2Calc.Xframe3D; Load Families for Structural Columns Framings etc
dyn2Calc_Xframe3D_PlaceSteelColumnsFrami = Custom[Dyn2Calc_Xframe3D_PlaceSteelColumnsFramings]()  # frozen; package Dyn2Calc.Xframe3D; Place Structural Columns and Framings from an XML-file generated by X-frame 3D; unwired: Data_Structural_Column_Steel, Data_Structural_Framing_Steel, Level_To_Place
code_block_2 = CodeBlock { 0; 0; 3000; 3000; }
file_path = Filename("..\..\..\..\Bureaublad\TEMP\1264-5.1 Staalconstructie versie 2 met golven.xml")  # graph input
dyn2Calc_Xframe3D_ImportXML = Custom[Dyn2Calc_Xframe3D_ImportXML](xmlFile=file_path)  # package Dyn2Calc.Xframe3D; Import Xframe3D XML and convert to points, lines and metadata
dyn2Calc_Xframe3D_Grids = Custom[Dyn2Calc_Xframe3D_Grids](dx=code_block_2.out0, dy=code_block_2.out1, ExtentionGridX=code_block_2.out2, ExtentionGridY=code_block_2.out3, Xframe3DXML_Grids=dyn2Calc_Xframe3D_ImportXML.Xframe3DXMLData_Grids)  # frozen; package Dyn2Calc.Xframe3D; Create Grids in Revit based on Xframe3DXMLImport
dyn2Calc_Xframe3D_SplitColumnsFramingsMa = Custom[Dyn2Calc_Xframe3D_SplitColumnsFramingsMaterial](Xframe3DXMLData_Beams=dyn2Calc_Xframe3D_ImportXML.Xframe3DXMLData_Beams, Xframe3DXMLData_Profiles=dyn2Calc_Xframe3D_ImportXML.Xframe3DXMLData_Profiles)  # package Dyn2Calc.Xframe3D; Split Beams from Xframe 3D in Columns, Framings and order per material
watch = Watch(dyn2Calc_Xframe3D_SplitColumnsFramingsMa.Description_Of_Lists)
watch_2 = Watch(dyn2Calc_Xframe3D_SplitColumnsFramingsMa.Data_Structural_Column_Steel)
code_block_3 = CodeBlock(Data_Structural_Framing_Steel=dyn2Calc_Xframe3D_SplitColumnsFramingsMa.Data_Structural_Framing_Steel) { Data_Structural_Framing_Steel: var[]..[]; }
transpose = List.Transpose(lists=code_block_3)
code_block_4 = CodeBlock(a=transpose) { a[11]; }
levels = Levels("00_begane grond")
code_block_5 = CodeBlock(Level_To_Place=levels) { Level_To_Place: var[]..[]; }

# group: STEEL FAMILY TYPES
dyn2Calc_Xframe3D_SteelSectionsNames = Custom[Dyn2Calc_Xframe3D_SteelSectionsNames]()  # package Dyn2Calc.Xframe3D; Mapping node for Xframe3D Sectionnames and Revit Type Names
code_block_6 = CodeBlock { "steelprofiletypelistnumber"; }
dyn2Calc_Xframe3D_Settings_2 = Custom[Dyn2Calc_Xframe3D_Settings](SearchSetting=code_block_6)
python_script = Python(IN[0]=dyn2Calc_Xframe3D_SteelSectionsNames.Xframe3D_Steelsectionnames, IN[1]=dyn2Calc_Xframe3D_SteelSectionsNames.Revit_SteelsectionTypeNames, IN[2]=transpose, IN[3]=dyn2Calc_Xframe3D_Settings_2.SettingFound)
# ---------- python_script.python (17 lines) ----------
XframeNames = IN[0]
RevitTypeNamesLists = IN[1]
XMLDataSteelSections = IN[2]
ListNumberSteelSections = IN[3]

RevitTypeNames = RevitTypeNamesLists[ListNumberSteelSections]
SectionNamesXframe = XMLDataSteelSections[13]

RevitTypeNamesFound = []

for i in SectionNamesXframe:
	try: 
		RevitTypeNamesFound.append(RevitTypeNames[XframeNames.index(i)])
	except ValueError:
		RevitTypeNamesFound.append("TypeName not found")

OUT = RevitTypeNamesFound
# ----------------------------------------

# group: Structural Framing Types Steel
code_block_7 = CodeBlock { "Structural Framing"; }
byName = Category.ByName(name=code_block_7)
all_family_types_of_category = Custom[All Family Types Of Category](category=byName)  # package Clockwork for Dynamo 2.x; Gets all family types/symbols of a given category in the model.
name = FamilyType.Name(familyType=all_family_types_of_category)
ꟿ_dictionary_bykeysvalues = Custom[ꟿ Dictionary.ByKeysValues](keys=name, values=all_family_types_of_category, searchKeys=python_script)  # package spring nodes; Dictionaries are an incredibly powerful tool for making associative sets between two equal length lists. The first list must be of unique strings (or numbers) and will be the key and the second list will be the matching values (it can be made up of geometry, elements, even other lists) The search keys list will provide the corresponding value to the input key.

code_block_8 = CodeBlock { "typename_unknown_structural_framing"; }
dyn2Calc_Xframe3D_Settings_3 = Custom[Dyn2Calc_Xframe3D_Settings](SearchSetting=code_block_8)
replaceNull = Custom[List.ReplaceNull](seq=ꟿ_dictionary_bykeysvalues, replacement=dyn2Calc_Xframe3D_Settings_3.SettingFound)  # package Clockwork for Dynamo 2.x; Replaces all null values within a given list with a substitute

# group: PLACE STRUCTURAL FRAMING
beamByCurve = StructuralFraming.BeamByCurve(curve=code_block_4, level=code_block_5, structuralFramingType=replaceNull)

code_block_9 = CodeBlock(a=transpose)
# ---------- code_block_9.designscript (8 lines) ----------
a[10];
a[11];
a[8];
//Z value;
a[7];
//Top Center Bottom;
DSCore.String.ToNumber(a[5])+DSCore.String.ToNumber(a[16]);
//Angle
# ----------------------------------------

# group: SET Z OFFSET VALUE
code_block_10 = CodeBlock { "z Offset Value"; }
toNumber = String.ToNumber(str=code_block_9.out3)
setParameterByName = Element.SetParameterByName(element=beamByCurve, parameterName=code_block_10, value=toNumber)

# group: SET ANGLE
code_block_11 = CodeBlock { "Cross-Section Rotation"; }
watch_3 = Watch(code_block_9.out4)
python_script_2 = Python(IN[0]=watch_3)
# ---------- python_script_2.python (21 lines) ----------
# Load the Python Standard and DesignScript Libraries
import sys
import clr
clr.AddReference('ProtoGeometry')
from Autodesk.DesignScript.Geometry import *

# The inputs to this node will be stored as a list in the IN variables.
dataEnteringNode = IN

lst = IN[0]

lst2 = []

for i in lst:
	if i == 360:
		lst2.append(0)
	else: lst2.append(i)
# Place your code below this line

# Assign your output to the OUT variable.
OUT = lst2
# ----------------------------------------
setParameterByName_2 = Element.SetParameterByName(element=beamByCurve, parameterName=code_block_11, value=python_script_2)

# group: SET Z/Bottom/Center
code_block_12 = CodeBlock { "z Justification"; }
code_block_13 = CodeBlock()
# ---------- code_block_13.designscript (10 lines) ----------
//Top = 0
//Center = 1
//Bottom = 3
//Origin = 2
"Top";
"Center";
"Bottom";
"0";
"1";
"3";
# ----------------------------------------
replace = String.Replace(str=code_block_9.out2, searchFor=code_block_13.out0, replaceWith=code_block_13.out3)
replace_2 = String.Replace(str=replace, searchFor=code_block_13.out1, replaceWith=code_block_13.out4)
replace_3 = String.Replace(str=replace_2, searchFor=code_block_13.out2, replaceWith=code_block_13.out5)
toNumber_2 = String.ToNumber(str=replace_3)
setParameterByName_3 = Element.SetParameterByName(element=beamByCurve, parameterName=code_block_12, value=toNumber_2)

code_block_14 = CodeBlock(StructuralFramingPlaced=setParameterByName_3) { StructuralFramingPlaced; }
code_block_15 = CodeBlock(Data_Structural_Column_Steel=dyn2Calc_Xframe3D_SplitColumnsFramingsMa.Data_Structural_Column_Steel) { Data_Structural_Column_Steel: var[]..[]; }
transpose_2 = List.Transpose(lists=code_block_15)
code_block_16 = CodeBlock(a=transpose_2) { a[11]; }
code_block_17 = CodeBlock { "Structural Columns"; }
byName_2 = Category.ByName(name=code_block_17)
all_family_types_of_category_2 = Custom[All Family Types Of Category](category=byName_2)
name_2 = FamilyType.Name(familyType=all_family_types_of_category_2)

# group: STEEL FAMILY TYPES
dyn2Calc_Xframe3D_SteelSectionsNames_2 = Custom[Dyn2Calc_Xframe3D_SteelSectionsNames]()
code_block_18 = CodeBlock { "steelprofiletypelistnumber"; }
dyn2Calc_Xframe3D_Settings_4 = Custom[Dyn2Calc_Xframe3D_Settings](SearchSetting=code_block_18)
python_script_3 = Python(IN[0]=dyn2Calc_Xframe3D_SteelSectionsNames_2.Xframe3D_Steelsectionnames, IN[1]=dyn2Calc_Xframe3D_SteelSectionsNames_2.Revit_SteelsectionTypeNames, IN[2]=transpose_2, IN[3]=dyn2Calc_Xframe3D_Settings_4.SettingFound)  # same code as python_script

ꟿ_dictionary_bykeysvalues_2 = Custom[ꟿ Dictionary.ByKeysValues](keys=name_2, values=all_family_types_of_category_2, searchKeys=python_script_3)
code_block_19 = CodeBlock { "typename_unknown_structural_column"; }
dyn2Calc_Xframe3D_Settings_5 = Custom[Dyn2Calc_Xframe3D_Settings](SearchSetting=code_block_19)
replaceNull_2 = Custom[List.ReplaceNull](seq=ꟿ_dictionary_bykeysvalues_2, replacement=dyn2Calc_Xframe3D_Settings_5.SettingFound)

# group: REVERSE LINE DIRECTION, PLACE COLUMNS
endPoint = Curve.EndPoint(curve=code_block_16)
Z = Point.Z(point=endPoint)
startPoint = Curve.StartPoint(curve=code_block_16)
Z_2 = Point.Z(point=startPoint)
lt = Z < Z_2
filterByBoolMask = List.FilterByBoolMask(list=code_block_16, mask=lt)
reverse = Curve.Reverse(curve=filterByBoolMask.in)
join = List.Join(list0=reverse, list1=filterByBoolMask.out)
columnByCurve = StructuralFraming.ColumnByCurve(curve=join, level=code_block_5, structuralColumnType=replaceNull_2)

code_block_20 = CodeBlock(a=transpose_2)  # same code as code_block_9

# group: SET ANGLE
code_block_21 = CodeBlock { "Cross-Section Rotation"; }
watch_4 = Watch(code_block_20.out4)
python_script_4 = Python(IN[0]=watch_4)  # same code as python_script_2
setParameterByName_4 = Element.SetParameterByName(element=columnByCurve, parameterName=code_block_21, value=python_script_4)

code_block_22 = CodeBlock(StructuralColumnsPlaced=setParameterByName_4) { StructuralColumnsPlaced; }
watch_5 = Watch(dyn2Calc_Xframe3D_SteelSectionsNames.Xframe3D_Steelsectionnames)
file_path_2 = Filename("..\..\..\..\Bureaublad\TEMP\1264-5.1 Staalconstructie versie 2 met golven.xml")
watch_6 = Watch(dyn2Calc_Xframe3D_SteelSectionsNames.Revit_SteelsectionTypeNames)
code_block_23 = CodeBlock(a=dyn2Calc_Xframe3D_SteelSectionsNames.Revit_SteelsectionTypeNames) { a[0]; }
watch_7 = Watch(code_block_23)
code_block_24 = CodeBlock()
# ---------- code_block_24.designscript (2 lines) ----------
//hoofdletter onafhankelijk
//alle 4 de lijsten zoeken naar types in sublists
# ----------------------------------------
