# Dynamo graph Xframe3DToRevit.dyn (Dynamo 2.3.0.5885)
# packages: Dyn2Calc.Xframe3D 0.1.2

# group: CREATE BEAMS
family_types = FamilyTypes()  # nothing selected; graph input
byStartPointEndPoint = Line.ByStartPointEndPoint()  # frozen; unwired: startPoint, endPoint
byTwoPoints = Vector.ByTwoPoints()  # unwired: start, end
ZAxis = Vector.ZAxis()
isParallel = Vector.IsParallel(vector=byTwoPoints, other=ZAxis)
filterByBoolMask = List.FilterByBoolMask(mask=isParallel)  # unwired: list
levels = Levels("00_begane grond")  # graph input
beamByCurve = StructuralFraming.BeamByCurve(curve=filterByBoolMask.out, level=levels)  # unwired: structuralFramingType

beams = Python(IN[0]=filterByBoolMask.out)
# ---------- beams.python (8 lines) ----------
profiles = IN[0]

uniqueprofiles = []
for i in profiles:
    if i not in uniqueprofiles:
        uniqueprofiles.append(i)

OUT = uniqueprofiles
# ----------------------------------------
structural_columns = Python(IN[0]=filterByBoolMask.in)  # same code as beams
family_types_2 = FamilyTypes()  # nothing selected; graph input
family_types_3 = FamilyTypes()  # nothing selected; graph input
create = List.Create(item0=family_types_2, item1=family_types_3)
python_script = Python(IN[0]=filterByBoolMask.in, IN[1]=structural_columns, IN[2]=create)
# ---------- python_script.python (24 lines) ----------
import clr
clr.AddReference('ProtoGeometry')
from Autodesk.DesignScript.Geometry import *
#The inputs to this node will be stored as a list in the IN variables.
dataEnteringNode = IN

input = IN[0]
inputChars = IN[1]
inputNumbers = IN[2]

# define Dictionary with the conversion step
myDict = {}

# fill the dictionary
for x in range(0, len(inputChars)):
    myDict[inputChars[x]] = inputNumbers[x]

# convert each item in the list step by step
output = []
for c in input:
    output.append(myDict.get(c))

#Assign your output to the OUT variable.
OUT = output
# ----------------------------------------
points = List.FilterByBoolMask(mask=isParallel)  # unwired: list
byPoint = FamilyInstance.ByPoint(familyType=python_script, point=points.in)  # frozen
profiles = List.FilterByBoolMask(mask=isParallel)  # unwired: list
flatten = List.Flatten(list=profiles.in)
code_block = CodeBlock { 0; 0; 3000; 3000; }
file_path = Filename("..\..\..\..\..\..\..\TEMP\test113.xml")  # graph input
xframe3DImportXML = Custom[Xframe3DImportXML](xmlFile=file_path)  # package Dyn2Calc.Xframe3D; Import Xframe3D XML and convert to points, lines and metadata
dyn2CalcXframe3DGrids = Custom[Dyn2CalcXframe3DGrids](dx=code_block.out0, dy=code_block.out1, ExtentionGridX=code_block.out2, ExtentionGridY=code_block.out3, Xframe3DXML_Grids=xframe3DImportXML.Xframe3DXMLData_Grids)  # frozen; package Dyn2Calc.Xframe3D; Create Grids in Revit based on Xframe3DXMLImport
code_block_2 = CodeBlock(a=xframe3DImportXML.Xframe3DXMLData_Beams) { a[7]; }
watch = Watch(xframe3DImportXML.Xframe3DXMLData_Profiles)
xframe3DExportXML = Custom[Xframe3DExportXML]()  # package Dyn2Calc.Xframe3D; Export XML-file from Revit; unwired: Grids, analyticalElements
python_script_2 = Python(IN[0]=xframe3DImportXML.Xframe3DXMLData_Profiles)
# ---------- python_script_2.python (34 lines) ----------
# Load the Python Standard and DesignScript Libraries
import sys
import clr
clr.AddReference('ProtoGeometry')
from Autodesk.DesignScript.Geometry import *

# The inputs to this node will be stored as a list in the IN variables.
dataEnteringNode = IN

ProfileDataXML = IN[0]

ProfileNumber = ProfileDataXML[1]
Profile_name = ProfileDataXML[2]
Material_type = ProfileDataXML[3]
Material = ProfileDataXML[4]
Angle = ProfileDataXML[5]

SteelProfiles = []
ConcreteProfiles = []
WoodProfiles = []

for i,j,k,l,m in zip(ProfileNumber, Profile_name, Material_type,Material,Angle):
	if str(k) == '0':
		SteelProfiles.append([i,j,k,l,m])
	elif str(k) =='1':
		ConcreteProfiles.append([i,j,k,l,m])
	elif str(k) =='2':
		WoodProfiles.append([i,j,k,l,m])


# Place your code below this line

# Assign your output to the OUT variable.
OUT = SteelProfiles, ConcreteProfiles, WoodProfiles, ProfileNumber,Material_type
# ----------------------------------------
code_block_3 = CodeBlock(a=xframe3DImportXML.Xframe3DXMLData_Profiles) { a[2]; }
code_block_4 = CodeBlock { "HEA100"; }
watch_2 = Watch(xframe3DImportXML.Xframe3DXMLData_Beams)
code_block_5 = CodeBlock(a=watch_2) { a[10]; a[11]; }
byStartPointEndPoint_2 = Line.ByStartPointEndPoint(startPoint=code_block_5.out0, endPoint=code_block_5.out1)
levels_2 = Levels("00_begane grond")
dyn2Calc_Xframe3D_SteelSectionsNames = Custom[Dyn2Calc_Xframe3D_SteelSectionsNames]()  # Mapping node for Xframe3D Sectionnames and Revit Type Names
code_block_6 = CodeBlock { 0; }
python_script_3 = Python(IN[0]=dyn2Calc_Xframe3D_SteelSectionsNames.Xframe3D_Steelsectionnames, IN[1]=dyn2Calc_Xframe3D_SteelSectionsNames.Revit_SteelsectionTypeNames, IN[2]=xframe3DImportXML.Xframe3DXMLData_Profiles, IN[3]=code_block_6, IN[4]=xframe3DImportXML.Xframe3DXMLData_Beams)
# ---------- python_script_3.python (23 lines) ----------
XframeNames = IN[0]
RevitTypeNamesLists = IN[1]
Xframe3DXMLData_Profiles = IN[2]
ListNumberSteelSections = IN[3]
Xframe3DXMLData_Beams = IN[4]

RevitTypeNames = RevitTypeNamesLists[ListNumberSteelSections]
SectionNamesXframe = Xframe3DXMLData_Profiles[2]
Xframe3DXMLData_Beams_Profile_number = Xframe3DXMLData_Beams[7]

RevitTypeNamesFound = []

for i in SectionNamesXframe:
	try: 
		RevitTypeNamesFound.append(RevitTypeNames[XframeNames.index(i)])
	except ValueError:
		RevitTypeNamesFound.append("other then steel")

BeamsRevitTypeNamesFound = []
for i in Xframe3DXMLData_Beams_Profile_number:
	BeamsRevitTypeNamesFound.append(RevitTypeNamesFound[int(i)-1])

OUT = RevitTypeNamesFound, BeamsRevitTypeNamesFound
# ----------------------------------------
code_block_7 = CodeBlock(a=python_script_3) { a[1]; }
byName = FamilyType.ByName(name=code_block_7)
beamByCurve_2 = StructuralFraming.BeamByCurve(curve=byStartPointEndPoint_2, level=levels_2, structuralFramingType=byName)
